# Grasshopper definition 20210526_AssymptoticTower.gh (Grasshopper 1.0.7)
# plug-ins: Kangaroo2 Components, Weaverbird

number_slider = Slider(30, range=0..100)
number_slider_2 = Slider(15, range=0..30)
number_slider_3 = Slider(1.2, range=0.1..5)
series = Series(Start=0, Step=1, Count=number_slider_2)
c_script = CSharpScript(U=number_slider, V=number_slider_2, a=number_slider_3, b=number_slider_3, c=Slider(20, range=0.1..20))  # -> out, Pts; inputs U: Int32, V: Int32, a: Double, b: Double, c: Double
# ---------- c_script: C# ----------
    double x, y, z, u, v, sqU, sqV;
    Point3d pt;
    List<Point3d> pts = new List<Point3d>();

    Interval D1 = new Interval(0, 1);
    Interval D2 = new Interval(0, 2 * Math.PI);

    if (D2.T0 < 0) D2.T0 = 0;
    if (D2.T1 > 2 * Math.PI) D2.T1 = 2 * Math.PI;

    double uStep = D1.Length / (U - 1);
    double vStep = D2.Length / (V - 1);

    // Vertices
    for (int i = 0; i < U; i++)
    {
      for (int j = 0; j < V; j++)
      {

        u = uStep * i + D1.T0;
        v = vStep * j + D2.T0;

        sqU = Math.Pow(u, 2);
        sqV = Math.Pow(v, 2);

        x = a * Math.Cosh(u) * Math.Cos(v);
        y = b * Math.Cosh(u) * Math.Sin(v);
        z = c * Math.Sinh(u);
        pt = new Point3d(x, y, z);

        //Temporary list of vertices
        pts.Add(pt);
      }
    }

    Pts = pts;
# ---------- end c_script ----------
item = ListItem(List=c_script.Pts, Index=series, Wrap=True)
srfgrid = SurfaceFromPoints(Points=c_script.Pts, UCount=number_slider, Interpolate=True)
angle = Slider(1, range=-90..90)
srf_cp = SurfaceClosestPoint(Point=item, Surface=srfgrid)  # -> Point, UVPoint, Distance
neg = Negative(Value=angle)

path = FilePath("/Users/suzuki/Code/elastic_rods/python/Seiichi/Curved_XShells/Output/OUT_AssymptoticTower.txt")
# Construction Revision
python = GhPythonScript(path=path)  # -> out, JIdx, JPos, JNorm, VPos
# ---------- python: Python ----------
__author__ = "suzuki"

import rhinoscriptsyntax as rs
import Rhino.Geometry as rh

jointsIdx = []
jointsNorm = []
jointsPos = []
verticesPos = []
file = open(path)
for line in file.readlines():
    data = [d.strip() for d in line.split(' ')]
    
    if(data[0]=="joint_idx"):
        jointsIdx.append(int(data[1]))
        
    if(data[0]=="joint_pos"):
        jointsPos.append(rs.AddPoint(float(data[1]),float(data[2]),float(data[3]) ))
        
    if(data[0]=="joint_norm"):
        jointsNorm.append(rh.Vector3d(float(data[1]),float(data[2]),float(data[3])))

    if(data[0]=="deformedPoints_pos"):
        verticesPos.append(rs.AddPoint(float(data[1]),float(data[2]),float(data[3]) ))
        
JIdx = jointsIdx
JPos = jointsPos
JNorm = jointsNorm
VPos = verticesPos
# ---------- end python ----------
pt = Point(python.VPos)
tag = TextTag(Location=python.JPos, Text=python.JIdx, Colour=ColourSwatch(SwatchColor=RGB(255, 255, 255)))
vdisex = VectorDisplayEx(Point=python.JPos, Vector=python.JNorm, Colour=ColourSwatch(SwatchColor=RGB(0, 255, 238)), Width=1)

c_script_2 = CSharpScript(srf=srfgrid, UV=srf_cp.UVPoint, angle=angle)  # -> out, A, B; inputs srf: Surface, UV: list of Point3d, angle: Double
# ---------- c_script_2: C# ----------
    List<Curve> crvA = new List<Curve>();
    List<Curve> crvB = new List<Curve>();
    Curve cA,cB;

    foreach(Point3d p in UV){
      GenerateAsymptoticCurves(srf, p, angle * Math.PI / 180, out cA, out cB);
      crvA.Add(cA);
      crvB.Add(cB);
    }

    A = crvA;
    B = crvB;
# ---------- c_script_2: C# additional code ----------
  void GenerateAsymptoticCurves(Surface srf, Point3d uv, double angle, out Curve crvA, out Curve crvB){

    // First direction
    List<Point3d> p0 = GenerateAsympoticPoints(srf, uv, angle, true);
    List<Point3d> p1 = GenerateAsympoticPoints(srf, uv, angle + Math.PI, true);
    p1.RemoveAt(0);
    p1.Reverse();
    p1.AddRange(p0);

    crvA = new PolylineCurve(p1);

    // Second direction
    p0 = GenerateAsympoticPoints(srf, uv, angle, false);
    p1 = GenerateAsympoticPoints(srf, uv, angle + Math.PI, false);
    p1.RemoveAt(0);
    p1.Reverse();
    p1.AddRange(p0);

    crvB = new PolylineCurve(p1);
  }

  List<Point3d> GenerateAsympoticPoints(Surface srf, Point3d uv, double angle, bool directionA){
    double accuracy = 0.01;//doc.ModelAbsoluteTolerance;
    Point3d p = uv;
    Interval U = srf.Domain(0);
    Interval V = srf.Domain(1);

    List<Point3d> pts = new List<Point3d>();

    while(pts.Count < 10000){

      //Get the curvature at the current point
      SurfaceCurvature crv = srf.CurvatureAt(p.X, p.Y);
      if(crv == null) break;

      //Add the current point
      pts.Add(srf.PointAt(p.X, p.Y));

      //Get the maximum principal direction & values
      Vector3d dir;
      double k1 = 0;
      double k2 = 0;
      if(crv.Kappa(0) > crv.Kappa(1)){
        if(directionA){
          dir = crv.Direction(0);
          k1 = crv.Kappa(0);
          k2 = crv.Kappa(1);
        }
        else
        {
          dir = crv.Direction(1);
          k1 = crv.Kappa(1);
          k2 = crv.Kappa(0);
        }
      }
      else{
        if (directionA){
          dir = crv.Direction(1);
          k1 = crv.Kappa(1);
          k2 = crv.Kappa(0);
        }else
        {
          dir = crv.Direction(0);
          k1 = crv.Kappa(0);
          k2 = crv.Kappa(1);
        }
      }


      //check if you are on an anticlastic surface, if not: Exit
      if(k1 * k2 > 0) break;

      //Calculate alpha, which is the deviation between A-direction to PC-direction

      double alpha1 = (2 * Math.Atan(Math.Sqrt((2 * Math.Sqrt(k2 * ( -(k1 - k2))) + k1 - (2 * k2)) / k1)));
      double alpha2 = (2 * Math.Atan(Math.Sqrt((-2 * Math.Sqrt(k2 * ( -(k1 - k2))) + k1 - (2 * k2)) / k1)));

      //apply aplpha to the PC-direction to get A-direction
      if(directionA){
        dir.Rotate(-alpha1, crv.Normal);
      }else{
        dir.Rotate(-alpha2, crv.Normal);
      }

      //optional additional angle!
      //dir.Rotate(angle, crv.Normal);

      if(!dir.IsValid)break;
      if (!dir.Unitize())break;

      //Scale the direction vector to match our accuracy.
      dir *= accuracy;

      //Flip the direction 180 degrees if it seems to be going backwards
      int N = pts.Count;
      if(N > 1){
        if (dir.IsParallelTo(pts[N - 1] - pts[N - 2], 0.5 * Math.PI) < 0){
          dir.Reverse();
        }
      }

      //Move the last point in the list along the curvature direction.
      Point3d pt = pts[pts.Count - 1] + dir;

      double t, s;
      if(!srf.ClosestPoint(pt, out s, out t))break;

      //Abort if we've wandered beyond the surface edge.
      if(!U.IncludesParameter(s, true))break;
      if(!V.IncludesParameter(t, true))break;

      //Abort if the new point is basically the same as the old point.
      if(Math.Abs(p.X - s) < 1e-12 && Math.Abs(p.Y - t) < 1e-12) break;

      p.X = s;
      p.Y = t;
    }
    return pts;
  }
# ---------- end c_script_2 ----------
c_script_3 = CSharpScript(srf=srfgrid, UV=srf_cp.UVPoint, angle=neg)  # -> out, A, B; inputs srf: Surface, UV: list of Point3d, angle: Double
# ---------- c_script_3: C# ----------
    List<Curve> crvA = new List<Curve>();
    List<Curve> crvB = new List<Curve>();
    Curve cA,cB;

    foreach(Point3d p in UV){
      GenerateAsymptoticCurves(srf, p, angle * Math.PI / 180, out cA, out cB);
      crvA.Add(cA);
      crvB.Add(cB);
    }

    A = crvA;
    B = crvB;
# ---------- c_script_3: C# additional code ----------
  void GenerateAsymptoticCurves(Surface srf, Point3d uv, double angle, out Curve crvA, out Curve crvB){

    // First direction
    List<Point3d> p0 = GenerateAsympoticPoints(srf, uv, angle, true);
    List<Point3d> p1 = GenerateAsympoticPoints(srf, uv, angle + Math.PI, true);
    p1.RemoveAt(0);
    p1.Reverse();
    p1.AddRange(p0);

    crvA = new PolylineCurve(p1);

    // Second direction
    p0 = GenerateAsympoticPoints(srf, uv, angle, false);
    p1 = GenerateAsympoticPoints(srf, uv, angle + Math.PI, false);
    p1.RemoveAt(0);
    p1.Reverse();
    p1.AddRange(p0);

    crvB = new PolylineCurve(p1);
  }

  List<Point3d> GenerateAsympoticPoints(Surface srf, Point3d uv, double angle, bool directionA){
    double accuracy = 0.01;//doc.ModelAbsoluteTolerance;
    Point3d p = uv;
    Interval U = srf.Domain(0);
    Interval V = srf.Domain(1);

    List<Point3d> pts = new List<Point3d>();

    while(pts.Count < 10000){

      //Get the curvature at the current point
      SurfaceCurvature crv = srf.CurvatureAt(p.X, p.Y);
      if(crv == null) break;

      //Add the current point
      pts.Add(srf.PointAt(p.X, p.Y));

      //Get the maximum principal direction & values
      Vector3d dir;
      double k1 = 0;
      double k2 = 0;
      if(crv.Kappa(0) > crv.Kappa(1)){
        if(directionA){
          dir = crv.Direction(0);
          k1 = crv.Kappa(0);
          k2 = crv.Kappa(1);
        }
        else
        {
          dir = crv.Direction(1);
          k1 = crv.Kappa(1);
          k2 = crv.Kappa(0);
        }
      }
      else{
        if (directionA){
          dir = crv.Direction(1);
          k1 = crv.Kappa(1);
          k2 = crv.Kappa(0);
        }else
        {
          dir = crv.Direction(0);
          k1 = crv.Kappa(0);
          k2 = crv.Kappa(1);
        }
      }


      //check if you are on an anticlastic surface, if not: Exit
      if(k1 * k2 > 0) break;

      //Calculate alpha, which is the deviation between A-direction to PC-direction

      double alpha1 = (2 * Math.Atan(Math.Sqrt((2 * Math.Sqrt(k2 * ( -(k1 - k2))) + k1 - (2 * k2)) / k1)));
      double alpha2 = (2 * Math.Atan(Math.Sqrt((-2 * Math.Sqrt(k2 * ( -(k1 - k2))) + k1 - (2 * k2)) / k1)));

      //apply aplpha to the PC-direction to get A-direction
      if(directionA){
        dir.Rotate(-alpha1, crv.Normal);
      }else{
        dir.Rotate(-alpha2, crv.Normal);
      }

      //optional additional angle!
      dir.Rotate(angle, crv.Normal);

      if(!dir.IsValid)break;
      if (!dir.Unitize())break;

      //Scale the direction vector to match our accuracy.
      dir *= accuracy;

      //Flip the direction 180 degrees if it seems to be going backwards
      int N = pts.Count;
      if(N > 1){
        if (dir.IsParallelTo(pts[N - 1] - pts[N - 2], 0.5 * Math.PI) < 0){
          dir.Reverse();
        }
      }

      //Move the last point in the list along the curvature direction.
      Point3d pt = pts[pts.Count - 1] + dir;

      double t, s;
      if(!srf.ClosestPoint(pt, out s, out t))break;

      //Abort if we've wandered beyond the surface edge.
      if(!U.IncludesParameter(s, true))break;
      if(!V.IncludesParameter(t, true))break;

      //Abort if the new point is basically the same as the old point.
      if(Math.Abs(p.X - s) < 1e-12 && Math.Abs(p.Y - t) < 1e-12) break;

      p.X = s;
      p.Y = t;
    }
    return pts;
  }
# ---------- end c_script_3 ----------
crv = Curve(c_script_2.A)
crv_2 = Curve(c_script_3.A)
ccx = CurveCurve(CurveA=graft(crv_2), CurveB=crv)  # -> Points, ParamsA, ParamsB
ccx_2 = CurveCurve(CurveA=graft(crv), CurveB=crv_2)  # -> Points, ParamsA, ParamsB
path_mapper = PathMapper(ccx_2.Points, source="{A;B;C;D;E}", target="{C;D}")
path_mapper_2 = PathMapper(ccx_2.ParamsA, source="{A;B;C;D;E}", target="{C;D}")
path_mapper_3 = PathMapper(ccx.Points, source="{A;B;C;D;E}", target="{C;D}")
path_mapper_4 = PathMapper(ccx.ParamsA, source="{A;B;C;D;E}", target="{C;D}")
sort = SortList(Keys=path_mapper_2, ValuesA=path_mapper)  # -> Keys, ValuesA
sort_2 = SortList(Keys=path_mapper_4, ValuesA=path_mapper_3)  # -> Keys, ValuesA
number_slider_4 = Slider(1.54, range=-10..10)
duppt = RemoveDuplicatePts(Points=sort.ValuesA, Tolerance=0.01)
duppt_2 = RemoveDuplicatePts(Points=sort_2.ValuesA, Tolerance=0.01)
pline = PolyLine(Vertices=duppt, Closed=False)  # -> flatten(Polyline)
pline_2 = PolyLine(Vertices=duppt_2, Closed=False)  # -> flatten(Polyline)
explode = Explode(Curve=[pline_2, pline], Recursive=True)  # -> flatten(Segments), Vertices
dupln = RemoveDuplicateLines(Lines=explode.Segments, Tolerance=0.01)

panel = Panel("/Users/suzuki/Code/elastic_rods/python/Seiichi/Curved_XShells/Input/")
python_2 = GhPythonScript(edges=dupln, path=panel, name="IN_AssymptoticTower", write=Button())  # -> out, Indexes, Vertices, Normals, Data; inputs edges: list of Line, write: Boolean
# ---------- python_2: Python ----------
__author__ = "suzuki"

import rhinoscriptsyntax as rs
import Rhino.Geometry as rh

#Find unique vertices
pts = rh.PointCloud()
topo = {}
count = len(edges)
eData = []
for i in range(count):
    ln = edges[i]
    
    eD = "l"
    for j in range(2):
        p = ln.PointAt(j)
        
        idx = pts.ClosestPoint(p)
        
        if(idx==-1):
            pts.Add(p)
            pp = ln.From
            if(j==0):
                pp = ln.To
            topo[0] = [pp]
            eD += " " + str(1) 
        else:
            pp = pts[idx].Location
            if(p.DistanceTo(pp)>0.01):
                pts.Add(p)
                pp = ln.From
                if(j==0):
                    pp = ln.To
                topo[pts.Count-1] = [pp]
                eD += " " + str(pts.Count) #index start with 1 for edges
            else:
                pp = ln.From
                if(j==0):
                    pp = ln.To
                topo[idx].append(pp)
                eD += " " + str(idx+1) #index start with 1 for edges          
    eData.append(eD)
    
#Compute normals
normals = []
vData = []
nData = []
for i in topo.Keys:
    p = pts[i].Location
    pp = topo[i]
    
    vData.append("v " + str(p.X) + " " + str(p.Y) + " " + str(p.Z))

# Merge data 
data = []
data += vData + nData + eData

d = "VerticesCount " + str(len(vData)) + " EdgesCount " + str(len(eData)) + "\n"
for e in data:
    d+= e + "\n"
    
# Save file
if(write):
    file = open(path + name + ".txt", 'w')
    file.write(d)
    file.close()

Indexes = topo.Keys
Vertices = pts.GetPoints()
Normals = normals
Data = data
# ---------- end python_2 ----------
tag_2 = TextTag(Location=python_2.Vertices, Text=python_2.Indexes)
vdisex_2 = VectorDisplayEx(Point=python_2.Vertices, Vector=python_2.Normals, Colour=RGB(0, 0, 0), Width=4)
panel_2 = Panel(python_2.Data)

multiplication = Multiplication(A=number_slider_4, B=-1)
ccx_3 = CurveCurve(CurveA=graft(pline_2), CurveB=pline)  # -> simplify(Points), ParamsA, ParamsB
number_slider_5 = Slider(50, range=0..50)
dom = ConstructDomain(DomainStart=number_slider_4, DomainEnd=multiplication)
dom_2 = ConstructDomain(DomainStart=number_slider_4, DomainEnd=multiplication)
path_mapper_5 = PathMapper(ccx_3.Points, source="{A;B}", target="{A}(B)")
c_script_4 = CSharpScript(U=number_slider_5, V=number_slider_5, D1=dom_2, D2=dom)  # -> out, A; inputs U: Int32, V: Int32
# ---------- c_script_4: C# ----------
double pU = D1.Length/(U-1);
double pV = D2.Length/(V-1);

List<Point3d> pts = new List<Point3d>();
for(int i=0; i<U; i++){
    for(int j=0; j<V; j++){
        double u = D1.T0 + pU*i;
        double v = D2.T0 + pV*j;
        double x = -Math.Pow(u,3)/3 + u + u*Math.Pow(v,2);
        double y = -Math.Pow(u,2)*v - v+Math.Pow(v,3)/3;
        double z = Math.Pow(u,2) - Math.Pow(v,2);
        pts.Add(new Point3d(x,y,z));
    }
}

Surface srf = NurbsSurface.CreateFromPoints(pts, U,V, 3,3);

A = srf;
# ---------- end c_script_4 ----------
number_slider_6 = Slider(40, range=0..100)
c_script_5 = CSharpScript(tree=path_mapper_5)  # -> out, A, B; inputs tree: tree
# ---------- c_script_5: C# ----------
    DataTree<int> index = new DataTree<int>();
    DataTree<Point3d> pts = new DataTree<Point3d>();
    for(int i = 0; i < tree.BranchCount; i++){
      GH_Path path = new GH_Path(i);
      for(int j = 0; j < tree.Branch(i).Count; j++){
        if(tree.Branch(i)[j] != null) {
          index.Add(j, path);
          pts.Add((Point3d) tree.Branch(i)[j], path);
        }
      }
    }

    A = index;
    B = pts;
# ---------- end c_script_5 ----------
mesh_uv = MeshSurface(Surface=c_script_4.A, UCount=number_slider_6, VCount=number_slider_6, Overhang=True, Equalize=True)
item_2 = ListItem(List=pline, Index=c_script_5.A, Wrap=True)
tri = Triangulate(Mesh=mesh_uv)  # -> Mesh, Count

python_3 = GhPythonScript(mesh=tri.Mesh, path="/Users/suzuki/Code/libigl/data/", name="Enneper", write=Button())  # -> out, Data; inputs mesh: Mesh, write: Boolean
# ---------- python_3: Python ----------
__author__ = "suzuki"

import rhinoscriptsyntax as rs
import Rhino.Geometry as rh

#Vertices
data = ""
for i in range(len(mesh.Vertices)):
    p = mesh.Vertices[i]
    data += "v " + str(p.X) + " " + str(p.Y) + " " + str(p.Z) + "\n"

for i in range(len(mesh.Faces)):
    f = mesh.Faces[i]
    data += "f " + str(f[0]+1) + " " + str(f[1]+1) + " " + str(f[2]+1) + "\n"
    
# Save file
if(write):
    file = open(path + name + ".obj", 'w')
    file.write(data)
    file.close()
# ---------- end python_3 ----------
panel_3 = Panel(python_3.Data)

wbedges = WeaverbirdsMeshEdges(MeshOrPolylines=tri.Mesh)
graft = GraftTree(Tree=pline_2, IncludeEmptyLists=True, IncludeNullItems=True)  # -> simplify(Tree)
lng = ListLength(List=item_2)
wbvertices = WeaverbirdsVerticesComponent(MeshClosedPolylinesGroup=tri.Mesh, Weld=True)
len = Length(Curve=wbedges)
dup = DuplicateData(Data=graft, Number=lng, Order=True)  # -> graft(Data)
srf_cp_2 = SurfaceClosestPoint(Point=wbvertices, Surface=c_script_4.A)  # -> Point, UVPoint, Distance
avr = Average(Input=len)
multiplication_2 = Multiplication(A=avr, B=0.5)
curvature = PrincipalCurvature(Surface=c_script_4.A, Point=srf_cp_2.UVPoint)  # -> Frame, Maximum, Minimum, MaxDirection, MinDirection
path_mapper_6 = PathMapper(dup, source="{A;B;C}", target="{A;C}")
graft_2 = GraftTree(Tree=item_2, IncludeEmptyLists=True, IncludeNullItems=True)
graft_3 = GraftTree(Tree=c_script_5.B, IncludeEmptyLists=True, IncludeNullItems=True)
unit = UnitVector(Vector=curvature.MaxDirection)
unit_2 = UnitVector(Vector=curvature.MinDirection)
c_script_6 = CSharpScript(k1=curvature.MaxDirection, k2=curvature.MinDirection)  # -> out, A, B; inputs k1: list of Double, k2: list of Double
# ---------- c_script_6: C# ----------
List<double> Kn = new List<double>();
List<double> ang = new List<double>();

for(int i=0; i<k1.Count; i++){
    //double t1 = 2*Math.PI - 2*Math.Atan(( ( 2*Math.Sqrt(k2[i]*(k2[i]-k1[i])) + k1[i] - 2*k2[i] )/ k1[i] ));
    double t1 = (2 * Math.Atan(Math.Sqrt((2 * Math.Sqrt(k2[i] * ( -(k1[i] - k2[i]))) + k1[i] - (2 * k2[i])) / k1[i])));

    Kn.Add(k1[i]* Math.Pow(Math.Cos(t1),2) + k2[i]*Math.Pow(Math.Sin(t1),2));
    ang.Add(t1);
}

A = Kn;
B = ang;
# ---------- end c_script_6 ----------
merge = Merge(Data1=path_mapper_6, Data2=graft_2, Data3=graft_3)
multiplication_3 = Multiplication(A=unit, B=multiplication_2)
multiplication_4 = Multiplication(A=unit_2, B=multiplication_2)
panel_4 = Panel(c_script_6.B)
rev = Reverse(Vector=multiplication_3)
item_3 = ListItem(List=merge, Index=0, Wrap=True)  # -> flatten(Item), flatten(Item1), flatten(Item2)
rev_2 = Reverse(Vector=multiplication_4)
addition = Addition(A=srf_cp_2.Point, B=multiplication_3)
addition_2 = Addition(A=srf_cp_2.Point, B=rev)
addition_3 = Addition(A=srf_cp_2.Point, B=multiplication_4)
addition_4 = Addition(A=srf_cp_2.Point, B=rev_2)
srf_cp_3 = SurfaceClosestPoint(Point=item_3.Item2, Surface=srfgrid)  # -> Point, UVPoint, Distance
ln = Line(StartPoint=addition, EndPoint=addition_2)
ln_2 = Line(StartPoint=addition_3, EndPoint=addition_4)
evalsrf = EvaluateSurface(Surface=srfgrid, Point=srf_cp_3.UVPoint)  # -> Point, Normal, UDirection, VDirection, Frame
rev_3 = Reverse(Vector=evalsrf.Normal)
preview = CustomPreview(Geometry=ln, Material=ColourSwatch(SwatchColor=RGB(245, 0, 0)))
preview_2 = CustomPreview(Geometry=ln_2, Material=ColourSwatch(SwatchColor=RGB(0, 0, 245)))
multiplication_5 = Multiplication(A=rev_3, B=Slider(0.27, range=0..0.5))
merge_2 = Merge(Data1=item_3.Item, Data2=item_3.Item1)  # -> flatten(Result)
vdis = VectorDisplay(Anchor=item_3.Item2, Vector=multiplication_5)
