# Grasshopper definition 160930_CurvatureLineScripts.gh (Grasshopper 1.0.7)
# plug-ins: LunchBox, sof_gh_sofistik_rhino

io = IO(
    SofistikDocumentProperties_VersionMajor="2020",
    SofistikDocumentProperties_VersionMinor="8",
    SofistikDocumentProperties_VersionName="Rhino-Interface")
helicoid = HelicoidSurface(
    UDivisions=100,
    VDivisions=100,
    RParameter=2,
    TParameter=1,
    Scale=5,
    Domain1=Domain(-6.283185307, 6.283185307),
    Domain2=Domain(-3.141592654, 3.141592654))
paraboloid = HyperbolicParaboloid(U=100, V=100, a=2, b=2, S=5, D1=Domain(-4, 4), D2=Domain(-4, 4))
enneper = EnneperSurface(UDivisions=100, VDivisions=100, RParameter=3, Scale=15, Domain1=Domain(0, 1), Domain2=Domain(-3.141592654, 3.141592654))
torus = TorusSurface(
    UDivisions=90,
    VDivisions=96,
    CParameter=4,
    RParameter=2,
    TParameter=1,
    Scale=5,
    Domain1=Domain(0, 6.283185307),
    Domain2=Domain(-3.141592654, 3.141592654))
srf = Surface(<surface referenced from the Rhino model>)
pt = Point([<point referenced from the Rhino model> x62])
angle = Slider(0, range=-90..90)
srf_2 = Surface(srf)
angle_2 = Slider(0, range=-90..90)
srf_cp = SurfaceCP(Point=pt, Surface=srf_2)  # -> Point, UVPoint, Distance
angle_3 = Slider(0, range=-90..90)
slider = Slider(0.02, range=0..10)
panel = Panel("""True
False""")
panel_2 = Panel("""True
False""")
rad = Radians(Degrees=angle_2)
# srf: Surface to sample
# 
# uv: UV point on surface for PrinCrv intersection
# 
# accuracy: Distance between sample-points
# 
# angle: Angle (in radians) to deviate from maximum principle curvature.
# 
# max: If True, the maximum principal curvature will be traced, if False, then the minimum principal curvature will be traced.
slider_2 = Slider(0.13, range=0..10)
panel_3 = Panel("""True
False""")
f_x = F1(Function="x°", X=angle_2)
f_x_2 = F1(Function="x°", X=angle)
f_x_3 = F1(Function="x°", X=angle_3)
# Asymptotic Lines
vb = VBScript(srf=srf_2, uv=srf_cp.UVPoint, accuracy=Slider(0.02, range=0..10), angle=f_x_2, max=graft(panel_2))  # -> out, pts; inputs srf: Surface, uv: Point3d; disabled
# ---------- vb: VB ----------
    If (srf Is Nothing) Then Return
    If (Not uv.IsValid) Then Return

    'Limit the accuracy to the document tolerance.
    accuracy = Math.Max(accuracy, doc.ModelAbsoluteTolerance)

    'Declare our list of samples.
    Dim dir0 As List(Of Point3d) = SampleCurvature(srf, uv, accuracy, max, angle)
    Dim dir1 As List(Of Point3d) = SampleCurvature(srf, uv, accuracy, max, angle + Math.PI)

    'Remove the first point in dir1 as it's a duplicate
    dir1.RemoveAt(0)
    dir1.Reverse()

    dir1.AddRange(dir0)
    pts = dir1
# ---------- vb: VB additional code ----------
  Private Function SampleCurvature(ByVal srf As Surface, ByVal uv As Point3d, ByVal accuracy As Double, ByVal max As Boolean, ByVal angle As Double) As List(Of Point3d)
    Dim p As Point3d = uv
    Dim U As Interval = srf.Domain(0)
    Dim V As Interval = srf.Domain(1)

    Dim samples As New List(Of Point3d)
    Do
      'Abort if we've added more than 10,000 samples.
      If (samples.Count > 10000) Then Exit Do

      'Get the curvature at the current point.
      Dim crv As SurfaceCurvature = srf.CurvatureAt(p.X, p.Y)
      If (crv Is Nothing) Then Exit Do

      'Add the current point.
      samples.Add(srf.PointAt(p.X, p.Y))

      'Get the maximum principal direction & values
      Dim dir As Vector3d
      Dim k1 = 0
      Dim k2 = 0
      If (crv.Kappa(0) > crv.Kappa(1)) Then
        If (max) Then
          dir = crv.Direction(0)
          k1 = crv.Kappa(0)
          k2 = crv.Kappa(1)
        Else
          dir = crv.Direction(1)
          k1 = crv.Kappa(1)
          k2 = crv.Kappa(0)
        End If
      Else
        If (max) Then
          dir = crv.Direction(1)
          k1 = crv.Kappa(1)
          k2 = crv.Kappa(0)
        Else
          dir = crv.Direction(0)
          k1 = crv.Kappa(0)
          k2 = crv.Kappa(1)
        End If
      End If

      Print("K1: " & k1)
      Print("K2: " & k2)
      
      'check if you are on an anticlastic surface, if not: Exit
      If (k1 * k2 > 0) Then Exit Do

      'Calculate alphe, which is the deviation between A-direction to PC-direction
      Dim m = 0
      Dim alpha1 As Double
      Dim alpha2 As Double
      alpha1 = (2 * Math.PI * m) - (2 * Math.ATan(Math.Sqrt((2 * Math.Sqrt(k2 * ( -(k1 - k2))) + k1 - (2 * k2)) / k1)))
      alpha2 = (2 * Math.PI * m) - (2 * Math.ATan(Math.Sqrt((-2 * Math.Sqrt(k2 * ( -(k1 - k2))) + k1 - (2 * k2)) / k1)))
      Print("Alpha1: " & alpha1)
      Print("Alpha2: " & alpha2)



      Dim a1 As Double
      Dim a2 As Double
      a1 = alpha1 * 180 / Math.PI
      a2 = alpha2 * 180 / Math.PI
      Print("A1: " & a1)
      Print("A2: " & a2)

      'check if kn is really zero
      Dim kn1 As Double
      Dim kn2 As Double
      kn1 = (k1 * Math.Cos(alpha1) * Math.Cos(alpha1)) + (k2 * Math.Sin(alpha1) * Math.Sin(alpha1))
      kn2 = (k1 * Math.Cos(alpha2) * Math.Cos(alpha2)) + (k2 * Math.Sin(alpha2) * Math.Sin(alpha2))
      Print("Kn1: " & kn1)
      Print("Kn2: " & kn2)

      'apply aplpha to the PC-direction to get A-direction
      If (max) Then
        dir.Rotate(-alpha1, crv.Normal)
      Else
        dir.Rotate(-alpha2, crv.Normal)
      End If



      'optional additional angle!
      dir.Rotate(angle, crv.Normal)

      If (Not dir.IsValid) Then Exit Do
      If (Not dir.Unitize()) Then Exit Do

      'Scale the direction vector to match our accuracy.
      dir *= accuracy

      'Flip the direction 180 degrees if it seems to be going backwards
      Dim N As Integer = samples.Count
      If (N > 1) Then
        If (dir.IsParallelTo(samples(N - 1) - samples(N - 2), 0.5 * Math.PI) < 0) Then
          dir.Reverse()
        End If
      End If

      'Move the last point in the list along the curvature direction.
      Dim pt As Point3d = samples(samples.Count - 1) + dir

      Dim s, t As Double
      If (Not srf.ClosestPoint(pt, s, t)) Then Exit Do

      'Abort if we've wandered beyond the surface edge.
      If (Not U.IncludesParameter(s, True)) Then Exit Do
      If (Not V.IncludesParameter(t, True)) Then Exit Do

      'Abort if the new point is basically the same as the old point.
      If (Math.Abs(p.X - s) < 1e-12) AndAlso (Math.Abs(p.Y - t) < 1e-12) Then Exit Do

      p.X = s
      p.Y = t
    Loop

    Return samples
  End Function
# ---------- end vb ----------
c_script = CSharpScript(srf=srf_2, uv=srf_cp.UVPoint, accuracy=slider, angle=rad, max=graft(panel))  # -> out, A; inputs srf: Surface, uv: Point3d, accuracy: Double, angle: Double, max: Boolean
# ---------- c_script: C# additional code ----------
  List<Point3d> SampleCurvature(Surface srf, Point3d uv, double accuracy, bool max, double angle){
    Point3d p = uv;
    Interval U = srf.Domain(0);
    Interval V = srf.Domain(1);

    List<Point3d> samples = new List<Point3d>();

    while(samples.Count < 10000){

      //Get the curvature at the current point
      SurfaceCurvature crv = srf.CurvatureAt(p.X, p.Y);
      if(crv == null) break;

      //Add the current point
      samples.Add(srf.PointAt(p.X, p.Y));

      //Get the maximum principal direction & values
      Vector3d dir;
      double k1 = 0;
      double k2 = 0;
      if(crv.Kappa(0) > crv.Kappa(1)){
        if(max){
          dir = crv.Direction(0);
          k1 = crv.Kappa(0);
          k2 = crv.Kappa(1);
        }
        else
        {
          dir = crv.Direction(1);
          k1 = crv.Kappa(1);
          k2 = crv.Kappa(0);
        }
      }
      else{
        if (max){
          dir = crv.Direction(1);
          k1 = crv.Kappa(1);
          k2 = crv.Kappa(0);
        }else
        {
          dir = crv.Direction(0);
          k1 = crv.Kappa(0);
          k2 = crv.Kappa(1);
        }
      }


      //check if you are on an anticlastic surface, if not: Exit
      if(k1 * k2 > 0) break;

      //Calculate alpha, which is the deviation between A-direction to PC-direction

      double alpha1 = (2 * Math.Atan(Math.Sqrt((2 * Math.Sqrt(k2 * ( -(k1 - k2))) + k1 - (2 * k2)) / k1)));
      double alpha2 = (2 * Math.Atan(Math.Sqrt((-2 * Math.Sqrt(k2 * ( -(k1 - k2))) + k1 - (2 * k2)) / k1)));

      //apply aplpha to the PC-direction to get A-direction
      if(max){
        dir.Rotate(-alpha1, crv.Normal);
      }else{
        dir.Rotate(-alpha2, crv.Normal);
      }


      //optional additional angle!
      dir.Rotate(angle, crv.Normal);

      if(!dir.IsValid)break;
      if (!dir.Unitize())break;

      //Scale the direction vector to match our accuracy.
      dir *= accuracy;

      //Flip the direction 180 degrees if it seems to be going backwards
      int N = samples.Count;
      if(N > 1){
        if (dir.IsParallelTo(samples[N - 1] - samples[N - 2], 0.5 * Math.PI) < 0){
          dir.Reverse();
        }
      }

      //Move the last point in the list along the curvature direction.
      Point3d pt = samples[samples.Count - 1] + dir;

      double t, s;
      if(!srf.ClosestPoint(pt, out s, out t))break;

      //Abort if we've wandered beyond the surface edge.
      if(!U.IncludesParameter(s, true))break;
      if(!V.IncludesParameter(t, true))break;

      //Abort if the new point is basically the same as the old point.
      if(Math.Abs(p.X - s) < 1e-12 && Math.Abs(p.Y - t) < 1e-12) break;

      p.X = s;
      p.Y = t;
    }
    return samples;
  }
# ---------- end c_script ----------
# Asymptotic Lines
# faster (no data output)
vb_2 = VBScript(srf=srf_2, uv=srf_cp.UVPoint, accuracy=slider, angle=f_x, max=graft(panel))  # -> out, pts; inputs srf: Surface, uv: Point3d
# ---------- vb_2: VB usings ----------
Imports System.IO
Imports System.Linq
Imports System.Data
Imports System.Drawing
Imports System.Reflection
Imports System.Windows.Forms
Imports System.Xml
Imports System.Xml.Linq
Imports Microsoft.VisualBasic
Imports System.Runtime.InteropServices

Imports Rhino.DocObjects
Imports Rhino.Collections
Imports GH_IO
Imports GH_IO.Serialization
# ---------- vb_2: VB ----------
    If (srf Is Nothing) Then Return
    If (Not uv.IsValid) Then Return

    'Limit the accuracy to the document tolerance.
    accuracy = Math.Max(accuracy, doc.ModelAbsoluteTolerance)

    'Declare our list of samples.
    Dim dir0 As List(Of Point3d) = SampleCurvature(srf, uv, accuracy, max, angle)
    Dim dir1 As List(Of Point3d) = SampleCurvature(srf, uv, accuracy, max, angle + Math.PI)

    'Remove the first point in dir1 as it's a duplicate
    dir1.RemoveAt(0)
    dir1.Reverse()

    dir1.AddRange(dir0)
    pts = dir1
# ---------- vb_2: VB additional code ----------
  Private Function SampleCurvature(ByVal srf As Surface, ByVal uv As Point3d, ByVal accuracy As Double, ByVal max As Boolean, ByVal angle As Double) As List(Of Point3d)
    Dim p As Point3d = uv
    Dim U As Interval = srf.Domain(0)
    Dim V As Interval = srf.Domain(1)

    Dim samples As New List(Of Point3d)
    Do
      'Abort if we've added more than 10,000 samples
      If (samples.Count > 10000) Then Exit Do

      'Get the curvature at the current point
      Dim crv As SurfaceCurvature = srf.CurvatureAt(p.X, p.Y)
      If (crv Is Nothing) Then Exit Do

      'Add the current point
      samples.Add(srf.PointAt(p.X, p.Y))

      'Get the maximum principal direction & values
      Dim dir As Vector3d
      Dim k1 = 0
      Dim k2 = 0
      If (crv.Kappa(0) > crv.Kappa(1)) Then
        If (max) Then
          dir = crv.Direction(0)
          k1 = crv.Kappa(0)
          k2 = crv.Kappa(1)
        Else
          dir = crv.Direction(1)
          k1 = crv.Kappa(1)
          k2 = crv.Kappa(0)
        End If
      Else
        If (max) Then
          dir = crv.Direction(1)
          k1 = crv.Kappa(1)
          k2 = crv.Kappa(0)
        Else
          dir = crv.Direction(0)
          k1 = crv.Kappa(0)
          k2 = crv.Kappa(1)
        End If
      End If


      'check if you are on an anticlastic surface, if not: Exit
      If (k1 * k2 > 0) Then Exit Do

      'Calculate alpha, which is the deviation between A-direction to PC-direction

      Dim alpha1 As Double
      Dim alpha2 As Double
      alpha1 = (2 * Math.ATan(Math.Sqrt((2 * Math.Sqrt(k2 * ( -(k1 - k2))) + k1 - (2 * k2)) / k1)))
      alpha2 = (2 * Math.ATan(Math.Sqrt((-2 * Math.Sqrt(k2 * ( -(k1 - k2))) + k1 - (2 * k2)) / k1)))

      'apply aplpha to the PC-direction to get A-direction
      If (max) Then
        dir.Rotate(-alpha1, crv.Normal)
      Else
        dir.Rotate(-alpha2, crv.Normal)
      End If


      'optional additional angle!
      dir.Rotate(angle, crv.Normal)

      If (Not dir.IsValid) Then Exit Do
      If (Not dir.Unitize()) Then Exit Do

      'Scale the direction vector to match our accuracy.
      dir *= accuracy

      'Flip the direction 180 degrees if it seems to be going backwards
      Dim N As Integer = samples.Count
      If (N > 1) Then
        If (dir.IsParallelTo(samples(N - 1) - samples(N - 2), 0.5 * Math.PI) < 0) Then
          dir.Reverse()
        End If
      End If

      'Move the last point in the list along the curvature direction.
      Dim pt As Point3d = samples(samples.Count - 1) + dir

      Dim s, t As Double
      If (Not srf.ClosestPoint(pt, s, t)) Then Exit Do

      'Abort if we've wandered beyond the surface edge.
      If (Not U.IncludesParameter(s, True)) Then Exit Do
      If (Not V.IncludesParameter(t, True)) Then Exit Do

      'Abort if the new point is basically the same as the old point.
      If (Math.Abs(p.X - s) < 1e-12) AndAlso (Math.Abs(p.Y - t) < 1e-12) Then Exit Do

      p.X = s
      p.Y = t
    Loop

    Return samples
  End Function
# ---------- end vb_2 ----------
# Principal Curvature Lines
vb_3 = VBScript(srf=srf_2, uv=srf_cp.UVPoint, accuracy=slider_2, angle=f_x_3, max=graft(panel_3))  # -> out, pts; inputs srf: Surface, uv: Point3d
# ---------- vb_3: VB ----------
    If (srf Is Nothing) Then Return
    If (Not uv.IsValid) Then Return

    'Limit the accuracy to the document tolerance.
    accuracy = Math.Max(accuracy, doc.ModelAbsoluteTolerance)

    'Declare our list of samples.
    Dim dir0 As List(Of Point3d) = SampleCurvature(srf, uv, accuracy, max, angle)
    Dim dir1 As List(Of Point3d) = SampleCurvature(srf, uv, accuracy, max, angle + Math.PI)

    'Remove the first point in dir1 as it's a duplicate
    dir1.RemoveAt(0)
    dir1.Reverse()

    dir1.AddRange(dir0)
    pts = dir1
# ---------- vb_3: VB additional code ----------
  Private Function SampleCurvature(ByVal srf As Surface, ByVal uv As Point3d, ByVal accuracy As Double, ByVal max As Boolean, ByVal angle As Double) As List(Of Point3d)
    Dim p As Point3d = uv
    Dim U As Interval = srf.Domain(0)
    Dim V As Interval = srf.Domain(1)

    Dim samples As New List(Of Point3d)
    Do
      'Abort if we've added more than 10,000 samples.
      If (samples.Count > 10000) Then Exit Do

      'Get the curvature at the current point.
      Dim crv As SurfaceCurvature = srf.CurvatureAt(p.X, p.Y)
      If (crv Is Nothing) Then Exit Do

      'Add the current point.
      samples.Add(srf.PointAt(p.X, p.Y))

      'Get the maximum principal direction.
      Dim dir As Vector3d
      If (crv.Kappa(0) > crv.Kappa(1)) Then
        If (max) Then
          dir = crv.Direction(0)
        Else
          dir = crv.Direction(1)
        End If
      Else
        If (max) Then
          dir = crv.Direction(1)
        Else
          dir = crv.Direction(0)
        End If
      End If

      dir.Rotate(angle, crv.Normal)

      If (Not dir.IsValid) Then Exit Do
      If (Not dir.Unitize()) Then Exit Do

      'Scale the direction vector to match our accuracy.
      dir *= accuracy

      'Flip the direction 180 degrees if it seems to be going backwards
      Dim N As Integer = samples.Count
      If (N > 1) Then
        If (dir.IsParallelTo(samples(N - 1) - samples(N - 2), 0.5 * Math.PI) < 0) Then
          dir.Reverse()
        End If
      End If

      'Move the last point in the list along the curvature direction.
      Dim pt As Point3d = samples(samples.Count - 1) + dir

      Dim s, t As Double
      If (Not srf.ClosestPoint(pt, s, t)) Then Exit Do

      'Abort if we've wandered beyond the surface edge.
      If (Not U.IncludesParameter(s, True)) Then Exit Do
      If (Not V.IncludesParameter(t, True)) Then Exit Do

      'Abort if the new point is basically the same as the old point.
      If (Math.Abs(p.X - s) < 1e-12) AndAlso (Math.Abs(p.Y - t) < 1e-12) Then Exit Do

      p.X = s
      p.Y = t
    Loop

    Return samples
  End Function
# ---------- end vb_3 ----------
pline = PolyLine(Vertices=vb_2.pts, Closed=False)  # -> flatten(Polyline)
panel_4 = Panel(vb.out)  # disabled
pline_2 = PolyLine(Vertices=vb.pts, Closed=False)  # disabled
panel_5 = Panel(vb_3.out)
pline_3 = PolyLine(Vertices=vb_3.pts, Closed=False)
panel_6 = Panel(pline)
