# Grasshopper definition 20210503_Curvatures.gh (Grasshopper 1.0.7)
# plug-ins: LunchBox, Kangaroo2 Components, Kiwi3d, Kangaroo Components, sof_gh_sofistik_rhino

helicoid = HelicoidSurface(
    UDivisions=100,
    VDivisions=100,
    RParameter=2,
    TParameter=1,
    Scale=5,
    Domain1=Domain(-6.283185307, 6.283185307),
    Domain2=Domain(-3.141592654, 3.141592654))
enneper = EnneperSurface(UDivisions=100, VDivisions=100, RParameter=3, Scale=15, Domain1=Domain(0, 1), Domain2=Domain(-3.141592654, 3.141592654))
number_slider = Slider(30, range=0..100)
number_slider_2 = Slider(15, range=0..30)
number_slider_3 = Slider(1.2, range=0.1..5)
number_slider_4 = Slider(10, range=0..30)
number_slider_5 = Slider(1, range=0..1)
series = Series(Start=0, Step=1, Count=number_slider_2)
subtraction = Subtraction(A=number_slider_4, B=1)
srf = Surface(reparameterize(<surface referenced from the Rhino model>))
c_script = CSharpScript(U=number_slider, V=number_slider_2, a=number_slider_3, b=number_slider_3, c=Slider(20, range=0.1..20))  # -> out, Pts; inputs U: Int32, V: Int32, a: Double, b: Double, c: Double
# ---------- c_script: C# ----------
    double x, y, z, u, v, sqU, sqV;
    Point3d pt;
    List<Point3d> pts = new List<Point3d>();

    Interval D1 = new Interval(0, 1);
    Interval D2 = new Interval(0, 2 * Math.PI);

    if (D2.T0 < 0) D2.T0 = 0;
    if (D2.T1 > 2 * Math.PI) D2.T1 = 2 * Math.PI;

    double uStep = D1.Length / (U - 1);
    double vStep = D2.Length / (V - 1);

    // Vertices
    for (int i = 0; i < U; i++)
    {
      for (int j = 0; j < V; j++)
      {

        u = uStep * i + D1.T0;
        v = vStep * j + D2.T0;

        sqU = Math.Pow(u, 2);
        sqV = Math.Pow(v, 2);

        x = a * Math.Cosh(u) * Math.Cos(v);
        y = b * Math.Cosh(u) * Math.Sin(v);
        z = c * Math.Sinh(u);
        pt = new Point3d(x, y, z);

        //Temporary list of vertices
        pts.Add(pt);
      }
    }

    Pts = pts;
# ---------- end c_script ----------
item = ListItem(List=c_script.Pts, Index=series, Wrap=True)
pi = Pi(Factor=Slider(-1, range=-1..1))
pi_2 = Pi(Factor=Slider(1, range=-1..1))
pt = Point(<point referenced from the Rhino model>)
neg = Negative(Value=number_slider_5)
division = Division(A=1, B=subtraction)
srf_2 = Surface(srf)
dom = ConstructDomain(DomainStart=pi, DomainEnd=pi_2)
dom_2 = ConstructDomain(DomainStart=neg, DomainEnd=number_slider_5)
series_2 = Series(Start=0, Step=division, Count=number_slider_4)
srfgrid = SurfaceFromPoints(Points=c_script.Pts, UCount=number_slider, Interpolate=True)
slider = Slider(0.1, range=0..10)
angle = Slider(0, range=-90..90)
angle_2 = Slider(5, range=-90..90)
range = Range(Domain=dom, Steps=Slider(50, range=0..100))
pt_2 = ConstructPoint(XCoordinate=0.5, YCoordinate=series_2, ZCoordinate=0)
pt_3 = ConstructPoint(XCoordinate=series_2, YCoordinate=0.5, ZCoordinate=0)
srf_cp = SurfaceClosestPoint(Point=pt, Surface=srf_2)  # -> Point, UVPoint, Distance
panel = Panel("""True
False""")
crossref = CrossReference(ListA=range, ListB=range, ListC=range, CrossMode=1)  # -> ListA, ListB, ListC
paraboloid = HyperbolicParaboloid(U=100, V=100, a=Slider(1, range=0..10), b=Slider(1, range=0..10), S=Slider(3, range=1..5), D1=dom_2, D2=dom_2)
srf_cp_2 = SurfaceClosestPoint(Point=item, Surface=srfgrid)  # -> Point, UVPoint, Distance
rad = Radians(Degrees=angle)
number_slider_6 = Slider(17, range=10..20)
neg_2 = Negative(Value=angle_2)
eval = Evaluate(F="cos(x)*sin(y)+cos(y)*sin(x)+cos(z)*sin(x)", x=crossref.ListA, y=crossref.ListB, z=crossref.ListC)
srf_3 = Surface(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)
dedom2num = DeconstructDomain²(Domain=srf_3)  # -> UMin, UMax, VMin, VMax
evalsrf = EvaluateSurface(Surface=srf_2, Point=pt_3)  # -> Point, Normal, UDirection, VDirection, Frame
c_script_2 = CSharpScript(srf=srfgrid, UV=srf_cp_2.UVPoint, angle=angle_2)  # -> out, A, B; inputs srf: Surface, UV: list of Point3d, angle: Double
# ---------- c_script_2: C# ----------
    List<Curve> crvA = new List<Curve>();
    List<Curve> crvB = new List<Curve>();
    Curve cA,cB;

    foreach(Point3d p in UV){
      GenerateAsymptoticCurves(srf, p, angle * Math.PI / 180, out cA, out cB);
      crvA.Add(cA);
      crvB.Add(cB);
    }

    A = crvA;
    B = crvB;
# ---------- c_script_2: C# additional code ----------
  void GenerateAsymptoticCurves(Surface srf, Point3d uv, double angle, out Curve crvA, out Curve crvB){

    // First direction
    List<Point3d> p0 = GenerateAsympoticPoints(srf, uv, angle, true);
    List<Point3d> p1 = GenerateAsympoticPoints(srf, uv, angle + Math.PI, true);
    p1.RemoveAt(0);
    p1.Reverse();
    p1.AddRange(p0);

    crvA = new PolylineCurve(p1);

    // Second direction
    p0 = GenerateAsympoticPoints(srf, uv, angle, false);
    p1 = GenerateAsympoticPoints(srf, uv, angle + Math.PI, false);
    p1.RemoveAt(0);
    p1.Reverse();
    p1.AddRange(p0);

    crvB = new PolylineCurve(p1);
  }

  List<Point3d> GenerateAsympoticPoints(Surface srf, Point3d uv, double angle, bool directionA){
    double accuracy = 0.01;//doc.ModelAbsoluteTolerance;
    Point3d p = uv;
    Interval U = srf.Domain(0);
    Interval V = srf.Domain(1);

    List<Point3d> pts = new List<Point3d>();

    while(pts.Count < 10000){

      //Get the curvature at the current point
      SurfaceCurvature crv = srf.CurvatureAt(p.X, p.Y);
      if(crv == null) break;

      //Add the current point
      pts.Add(srf.PointAt(p.X, p.Y));

      //Get the maximum principal direction & values
      Vector3d dir;
      double k1 = 0;
      double k2 = 0;
      if(crv.Kappa(0) > crv.Kappa(1)){
        if(directionA){
          dir = crv.Direction(0);
          k1 = crv.Kappa(0);
          k2 = crv.Kappa(1);
        }
        else
        {
          dir = crv.Direction(1);
          k1 = crv.Kappa(1);
          k2 = crv.Kappa(0);
        }
      }
      else{
        if (directionA){
          dir = crv.Direction(1);
          k1 = crv.Kappa(1);
          k2 = crv.Kappa(0);
        }else
        {
          dir = crv.Direction(0);
          k1 = crv.Kappa(0);
          k2 = crv.Kappa(1);
        }
      }


      //check if you are on an anticlastic surface, if not: Exit
      if(k1 * k2 > 0) break;

      //Calculate alpha, which is the deviation between A-direction to PC-direction

      double alpha1 = (2 * Math.Atan(Math.Sqrt((2 * Math.Sqrt(k2 * ( -(k1 - k2))) + k1 - (2 * k2)) / k1)));
      double alpha2 = (2 * Math.Atan(Math.Sqrt((-2 * Math.Sqrt(k2 * ( -(k1 - k2))) + k1 - (2 * k2)) / k1)));

      //apply aplpha to the PC-direction to get A-direction
      if(directionA){
        dir.Rotate(-alpha1, crv.Normal);
      }else{
        dir.Rotate(-alpha2, crv.Normal);
      }

      //optional additional angle!
      dir.Rotate(angle, crv.Normal);

      if(!dir.IsValid)break;
      if (!dir.Unitize())break;

      //Scale the direction vector to match our accuracy.
      dir *= accuracy;

      //Flip the direction 180 degrees if it seems to be going backwards
      int N = pts.Count;
      if(N > 1){
        if (dir.IsParallelTo(pts[N - 1] - pts[N - 2], 0.5 * Math.PI) < 0){
          dir.Reverse();
        }
      }

      //Move the last point in the list along the curvature direction.
      Point3d pt = pts[pts.Count - 1] + dir;

      double t, s;
      if(!srf.ClosestPoint(pt, out s, out t))break;

      //Abort if we've wandered beyond the surface edge.
      if(!U.IncludesParameter(s, true))break;
      if(!V.IncludesParameter(t, true))break;

      //Abort if the new point is basically the same as the old point.
      if(Math.Abs(p.X - s) < 1e-12 && Math.Abs(p.Y - t) < 1e-12) break;

      p.X = s;
      p.Y = t;
    }
    return pts;
  }
# ---------- end c_script_2 ----------
evalsrf_2 = EvaluateSurface(Surface=srf_2, Point=pt_2)  # -> Point, Normal, UDirection, VDirection, Frame
c_script_3 = CSharpScript(srf=srfgrid, UV=srf_cp_2.UVPoint, angle=neg_2)  # -> out, A, B; inputs srf: Surface, UV: list of Point3d, angle: Double; same code as c_script_2
angle_3 = Slider(90, range=-90..90)
# Assymptotic Curves
c_script_4 = CSharpScript(srf=srf_2, uv=pt_3, accuracy=slider, angle=rad, max=graft(panel))  # -> out, AssymCrv; inputs srf: Surface, uv: Point3d, accuracy: Double, angle: Double, max: Boolean
# ---------- c_script_4: C# ----------
    //Limit the accuracy to the document tolerance.
    double acc = Math.Max(accuracy, doc.ModelAbsoluteTolerance);

    //Declare our list of samples.
    List<Point3d> dir0 = SampleCurvature(srf, uv, acc, max, angle);
    List<Point3d> dir1 = SampleCurvature(srf, uv, acc, max, angle + Math.PI);

    //Remove the first point in dir1 as it's a duplicate
    dir1.RemoveAt(0);
    dir1.Reverse();

    dir1.AddRange(dir0);

    Polyline pl = new Polyline(dir1);
    AssymCrv = pl;
# ---------- c_script_4: C# additional code ----------
  List<Point3d> SampleCurvature(Surface srf, Point3d uv, double accuracy, bool max, double angle){
    Point3d p = uv;
    Interval U = srf.Domain(0);
    Interval V = srf.Domain(1);

    List<Point3d> samples = new List<Point3d>();

    while(samples.Count < 10000){

      //Get the curvature at the current point
      SurfaceCurvature crv = srf.CurvatureAt(p.X, p.Y);
      if(crv == null) break;

      //Add the current point
      samples.Add(srf.PointAt(p.X, p.Y));

      //Get the maximum principal direction & values
      Vector3d dir;
      double k1 = 0;
      double k2 = 0;
      if(crv.Kappa(0) > crv.Kappa(1)){
        if(max){
          dir = crv.Direction(0);
          k1 = crv.Kappa(0);
          k2 = crv.Kappa(1);
        }
        else
        {
          dir = crv.Direction(1);
          k1 = crv.Kappa(1);
          k2 = crv.Kappa(0);
        }
      }
      else{
        if (max){
          dir = crv.Direction(1);
          k1 = crv.Kappa(1);
          k2 = crv.Kappa(0);
        }else
        {
          dir = crv.Direction(0);
          k1 = crv.Kappa(0);
          k2 = crv.Kappa(1);
        }
      }


      //check if you are on an anticlastic surface, if not: Exit
      if(k1 * k2 > 0) break;

      //Calculate alpha, which is the deviation between A-direction to PC-direction

      double alpha1 = (2 * Math.Atan(Math.Sqrt((2 * Math.Sqrt(k2 * ( -(k1 - k2))) + k1 - (2 * k2)) / k1)));
      double alpha2 = (2 * Math.Atan(Math.Sqrt((-2 * Math.Sqrt(k2 * ( -(k1 - k2))) + k1 - (2 * k2)) / k1)));

      //apply aplpha to the PC-direction to get A-direction
      if(max){
        dir.Rotate(-alpha1, crv.Normal);
      }else{
        dir.Rotate(-alpha2, crv.Normal);
      }


      //optional additional angle!
      dir.Rotate(angle, crv.Normal);

      if(!dir.IsValid)break;
      if (!dir.Unitize())break;

      //Scale the direction vector to match our accuracy.
      dir *= accuracy;

      //Flip the direction 180 degrees if it seems to be going backwards
      int N = samples.Count;
      if(N > 1){
        if (dir.IsParallelTo(samples[N - 1] - samples[N - 2], 0.5 * Math.PI) < 0){
          dir.Reverse();
        }
      }

      //Move the last point in the list along the curvature direction.
      Point3d pt = samples[samples.Count - 1] + dir;

      double t, s;
      if(!srf.ClosestPoint(pt, out s, out t))break;

      //Abort if we've wandered beyond the surface edge.
      if(!U.IncludesParameter(s, true))break;
      if(!V.IncludesParameter(t, true))break;

      //Abort if the new point is basically the same as the old point.
      if(Math.Abs(p.X - s) < 1e-12 && Math.Abs(p.Y - t) < 1e-12) break;

      p.X = s;
      p.Y = t;
    }
    return samples;
  }
# ---------- end c_script_4 ----------
# Principal curvatures
c_script_5 = CSharpScript(srf=srf_2, uv=pt_3, accuracy=slider, angle=rad, max=panel)  # -> out, PrincCrv; inputs srf: Surface, uv: Point3d, accuracy: Double, angle: Double, max: Boolean
# ---------- c_script_5: C# ----------
    //Limit the accuracy to the document tolerance.
    double acc = Math.Max(accuracy, doc.ModelAbsoluteTolerance);

    //Declare our list of samples.
    List<Point3d> dir0 = SampleCurvature(srf, uv, acc, max, angle);
    List<Point3d> dir1 = SampleCurvature(srf, uv, acc, max, angle + Math.PI);

    //Remove the first point in dir1 as it's a duplicate
    dir1.RemoveAt(0);
    dir1.Reverse();

    dir1.AddRange(dir0);

    Polyline pl = new Polyline(dir1);
    PrincCrv = pl;
# ---------- c_script_5: C# additional code ----------
  List<Point3d> SampleCurvature(Surface srf, Point3d uv, double accuracy, bool max, double angle){
    Point3d p = uv;
    Interval U = srf.Domain(0);
    Interval V = srf.Domain(1);

    List<Point3d> samples = new List<Point3d>();

    //Abort if we've added more than 10,000 samples.
    while(samples.Count < 10000){

      //Get the curvature at the current point.
      SurfaceCurvature crv = srf.CurvatureAt(p.X, p.Y);
      if(crv == null) break;

      //Add the current point.
      samples.Add(srf.PointAt(p.X, p.Y));

      //Get the maximum principal direction.
      Vector3d dir;
      if(crv.Kappa(0) > crv.Kappa(1)){
        if (max){
          dir = crv.Direction(0);
        }
        else{
          dir = crv.Direction(1);
        }
      }else{
        if (max){
          dir = crv.Direction(1);
        }
        else{
          dir = crv.Direction(0);
        }
      }

      dir.Rotate(angle, crv.Normal);

      if(!dir.IsValid) break;
      if (!dir.Unitize())break;

      //Scale the direction vector to match our accuracy.
      dir *= accuracy;

      //Flip the direction 180 degrees if it seems to be going backwards
      int N = samples.Count;
      if(N > 1){
        if (dir.IsParallelTo(samples[N - 1] - samples[N - 2], 0.5 * Math.PI) < 0){
          dir.Reverse();
        }
      }

      //Move the last point in the list along the curvature direction.
      Point3d pt = samples[samples.Count - 1] + dir;

      double t, s;
      if(!srf.ClosestPoint(pt, out s, out t)) break;

      //Abort if we've wandered beyond the surface edge.
      if(!U.IncludesParameter(s, true))break;
      if (!V.IncludesParameter(t, true))break;

      //Abort if the new point is basically the same as the old point.
      if(Math.Abs(p.X - s) < 1e-12 && Math.Abs(p.Y - t) < 1e-12) break;

      p.X = s;
      p.Y = t;
    }

    return samples;
  }
# ---------- end c_script_5 ----------
division_2 = Division(A=dedom2num.UMax, B=number_slider_6)
crv = Curve(c_script_2.A)
crv_2 = Curve(c_script_3.A)
series_3 = Series(Start=division_2, Step=division_2, Count=expr("x-1", number_slider_6))
division_3 = Division(A=dedom2num.UMax, B=2)
rad_2 = Radians(Degrees=angle_3)
ccx = CurveCurve(CurveA=graft(crv_2), CurveB=crv)  # -> Points, ParamsA, ParamsB
ccx_2 = CurveCurve(CurveA=graft(crv), CurveB=crv_2)  # -> Points, ParamsA, ParamsB
pt_4 = ConstructPoint(XCoordinate=series_3, YCoordinate=division_3, ZCoordinate=0)
path_mapper = PathMapper(ccx_2.Points, source="{A;B;C;D;E}", target="{C;D}")
path_mapper_2 = PathMapper(ccx_2.ParamsA, source="{A;B;C;D;E}", target="{C;D}")
path_mapper_3 = PathMapper(ccx.Points, source="{A;B;C;D;E}", target="{C;D}")
path_mapper_4 = PathMapper(ccx.ParamsA, source="{A;B;C;D;E}", target="{C;D}")
evalsrf_3 = EvaluateSurface(Surface=srf_3, Point=pt_4)  # -> Point, Normal, UDirection, VDirection, Frame
c_script_6 = CSharpScript(srf=srf_3, UV=pt_4, angle=rad_2)  # -> out, A, B; inputs srf: Surface, UV: list of Point3d, angle: Double
# ---------- c_script_6: C# ----------
    List<Curve> crvA = new List<Curve>();
    List<Curve> crvB = new List<Curve>();
    Curve cA,cB;

    foreach(Point3d p in UV){
      GenerateAsymptoticCurves(srf, p, angle, out cA, out cB);
      crvA.Add(cA);
      crvB.Add(cB);
    }

    A = crvA;
    B = crvB;
# ---------- c_script_6: C# additional code ----------
  void GenerateAsymptoticCurves(Surface srf, Point3d uv, double angle, out Curve crvA, out Curve crvB){

    // First direction
    List<Point3d> p0 = GenerateAsympoticPoints(srf, uv, angle, true);
    List<Point3d> p1 = GenerateAsympoticPoints(srf, uv, angle + Math.PI, true);
    p1.RemoveAt(0);
    p1.Reverse();
    p1.AddRange(p0);

    crvA = new PolylineCurve(p1);

    // Second direction
    p0 = GenerateAsympoticPoints(srf, uv, angle, false);
    p1 = GenerateAsympoticPoints(srf, uv, angle + Math.PI, false);
    p1.RemoveAt(0);
    p1.Reverse();
    p1.AddRange(p0);

    crvB = new PolylineCurve(p1);
  }

  List<Point3d> GenerateAsympoticPoints(Surface srf, Point3d uv, double angle, bool directionA){
    double accuracy = 0.01;//doc.ModelAbsoluteTolerance;
    Point3d p = uv;
    Interval U = srf.Domain(0);
    Interval V = srf.Domain(1);

    List<Point3d> pts = new List<Point3d>();

    while(pts.Count < 1000){

      //Get the curvature at the current point
      SurfaceCurvature crv = srf.CurvatureAt(p.X, p.Y);
      if(crv == null) break;

      //Add the current point
      pts.Add(srf.PointAt(p.X, p.Y));

      //Get the maximum principal direction & values
      Vector3d dir;
      double k1 = 0;
      double k2 = 0;
      if(crv.Kappa(0) > crv.Kappa(1)){
        if(directionA){
          dir = crv.Direction(0);
          k1 = crv.Kappa(0);
          k2 = crv.Kappa(1);
        }
        else
        {
          dir = crv.Direction(1);
          k1 = crv.Kappa(1);
          k2 = crv.Kappa(0);
        }
      }
      else{
        if (directionA){
          dir = crv.Direction(1);
          k1 = crv.Kappa(1);
          k2 = crv.Kappa(0);
        }else
        {
          dir = crv.Direction(0);
          k1 = crv.Kappa(0);
          k2 = crv.Kappa(1);
        }
      }


      //check if you are on an anticlastic surface, if not: Exit
      if(k1 * k2 > 0) break;

      //Calculate alpha, which is the deviation between A-direction to PC-direction

      double alpha1 = (2 * Math.Atan(Math.Sqrt((2 * Math.Sqrt(k2 * ( -(k1 - k2))) + k1 - (2 * k2)) / k1)));
      double alpha2 = (2 * Math.Atan(Math.Sqrt((-2 * Math.Sqrt(k2 * ( -(k1 - k2))) + k1 - (2 * k2)) / k1)));

      //apply aplpha to the PC-direction to get A-direction
      if(directionA){
        dir.Rotate(-alpha1, crv.Normal);
      }else{
        dir.Rotate(-alpha2, crv.Normal);
      }

      //optional additional angle!
      dir.Rotate(angle, crv.Normal);

      if(!dir.IsValid)break;
      if (!dir.Unitize())break;

      //Scale the direction vector to match our accuracy.
      dir *= accuracy;

      //Flip the direction 180 degrees if it seems to be going backwards
      int N = pts.Count;
      if(N > 1){
        if (dir.IsParallelTo(pts[N - 1] - pts[N - 2], 0.5 * Math.PI) < 0){
          dir.Reverse();
        }
      }

      //Move the last point in the list along the curvature direction.
      Point3d pt = pts[pts.Count - 1] + dir;

      double t, s;
      if(!srf.ClosestPoint(pt, out s, out t))break;

      //Abort if we've wandered beyond the surface edge.
      if(!U.IncludesParameter(s, true))break;
      if(!V.IncludesParameter(t, true))break;

      //Abort if the new point is basically the same as the old point.
      if(Math.Abs(p.X - s) < 1e-12 && Math.Abs(p.Y - t) < 1e-12) break;

      p.X = s;
      p.Y = t;
    }
    return pts;
  }
# ---------- end c_script_6 ----------
crv_3 = Curve(c_script_6.B)
crv_4 = Curve(c_script_6.A)
sort = SortList(Keys=path_mapper_2, ValuesA=path_mapper)  # -> Keys, ValuesA
sort_2 = SortList(Keys=path_mapper_4, ValuesA=path_mapper_3)  # -> Keys, ValuesA
duppt = RemoveDuplicatePts(Points=sort.ValuesA, Tolerance=0.01)
duppt_2 = RemoveDuplicatePts(Points=sort_2.ValuesA, Tolerance=0.01)
pline = PolyLine(Vertices=duppt, Closed=False)  # -> flatten(Polyline)
pline_2 = PolyLine(Vertices=duppt_2, Closed=False)  # -> flatten(Polyline)
ccx_3 = CurveCurve(CurveA=graft(pline_2), CurveB=pline)  # -> simplify(Points), ParamsA, ParamsB
path_mapper_5 = PathMapper(ccx_3.Points, source="{A;B}", target="{A}(B)")
explode = Explode(Curve=[pline_2, pline], Recursive=True)  # -> flatten(Segments), Vertices
dupln = RemoveDuplicateLines(Lines=explode.Segments, Tolerance=0.01)
c_script_7 = CSharpScript(tree=path_mapper_5)  # -> out, A, B; inputs tree: tree
# ---------- c_script_7: C# ----------
    DataTree<int> index = new DataTree<int>();
    DataTree<Point3d> pts = new DataTree<Point3d>();
    for(int i = 0; i < tree.BranchCount; i++){
      GH_Path path = new GH_Path(i);
      for(int j = 0; j < tree.Branch(i).Count; j++){
        if(tree.Branch(i)[j] != null) {
          index.Add(j, path);
          pts.Add((Point3d) tree.Branch(i)[j], path);
        }
      }
    }

    A = index;
    B = pts;
# ---------- end c_script_7 ----------

panel_2 = Panel("""0
1
3
7
5
4
9
14
29""")
panel_3 = Panel("D:\OneDrive\SeSuzuki\21._ EPFL\2._ Code\5._ Grasshopper\AssymptoticLines\")
crv_5 = Curve(dupln)
python = GhPythonScript(edges=crv_5, flip=panel_2, path=panel_3, name="NormalLamella01_GH", write=Button())  # -> out, Indexes, Vertices, Normals, Data; inputs edges: list of Line, flip: list of Int32, write: Boolean
# ---------- python: Python ----------
__author__ = "suzuki"

import rhinoscriptsyntax as rs
import Rhino.Geometry as rh

#Find unique vertices
pts = rh.PointCloud()
topo = {}
count = len(edges)
eData = []
for i in range(count):
    ln = edges[i]
    
    eD = "l"
    for j in range(2):
        p = ln.PointAt(j)
        
        idx = pts.ClosestPoint(p)
        
        if(idx==-1):
            pts.Add(p)
            pp = ln.From
            if(j==0):
                pp = ln.To
            topo[0] = [pp]
            eD += " " + str(1) 
        else:
            pp = pts[idx].Location
            if(p.DistanceTo(pp)>0.01):
                pts.Add(p)
                pp = ln.From
                if(j==0):
                    pp = ln.To
                topo[pts.Count-1] = [pp]
                eD += " " + str(pts.Count) #index start with 1 for edges
            else:
                pp = ln.From
                if(j==0):
                    pp = ln.To
                topo[idx].append(pp)
                eD += " " + str(idx+1) #index start with 1 for edges          
    eData.append(eD)
    
#Compute normals
normals = []
vData = []
nData = []
for i in topo.Keys:
    p = pts[i].Location
    pp = topo[i]
    
    vData.append("v " + str(p.X) + " " + str(p.Y) + " " + str(p.Z))

# Merge data 
data = []
data += vData + nData + eData

d = "VerticesCount " + str(len(vData)) + " EdgesCount " + str(len(eData)) + "\n"
for e in data:
    d+= e + "\n"
    
# Save file
if(write):
    file = open(path + name + ".txt", 'w')
    file.write(d)
    file.close()

Indexes = topo.Keys
Vertices = pts.GetPoints()
Normals = normals
Data = data
# ---------- end python ----------
tag = TextTag(Location=python.Vertices, Text=python.Indexes)
vdisex = VectorDisplayEx(Point=python.Vertices, Vector=python.Normals, Colour=RGB(0, 0, 0), Width=4)
panel_4 = Panel(python.Data)

item_2 = ListItem(List=pline, Index=c_script_7.A, Wrap=True)
graft = GraftTree(Tree=pline_2, IncludeEmptyLists=True, IncludeNullItems=True)  # -> simplify(Tree)
lng = ListLength(List=item_2)
dup = DuplicateData(Data=graft, Number=lng, Order=True)  # -> graft(Data)
path_mapper_6 = PathMapper(dup, source="{A;B;C}", target="{A;C}")
graft_2 = GraftTree(Tree=item_2, IncludeEmptyLists=True, IncludeNullItems=True)
graft_3 = GraftTree(Tree=c_script_7.B, IncludeEmptyLists=True, IncludeNullItems=True)
merge = Merge(Data1=path_mapper_6, Data2=graft_2, Data3=graft_3)
structural_line = StructuralLine(Number=0, Group=0, DirZ=Vector(0, 0, 0), ElementType="Beam", ElementSize=0)
item_3 = ListItem(List=merge, Index=0, Wrap=True)  # -> flatten(Item), flatten(Item1), flatten(Item2)
number_slider_7 = Slider(17, range=0..30)
srf_cp_3 = SurfaceClosestPoint(Point=item_3.Item2, Surface=srfgrid)  # -> Point, UVPoint, Distance
evalsrf_4 = EvaluateSurface(Surface=srfgrid, Point=srf_cp_3.UVPoint)  # -> Point, Normal, UDirection, VDirection, Frame

# ----
# Kiwi3d - Preprocessing
# NonLinear Analysis of Arch
panel_5 = Panel("51")
lambda = Range(Domain=Domain(0, 1), Steps=expr("x-1", panel_5))
graph = GraphMapper(lambda, x0=0, x1=1, y0=0, y1=1, container_name="Bezier", cpx=[0, 1, 0.7833336592, 1], cpy=[0, 0, 0.03043466806, 1])  # disabled
series_4 = Series(Start=0, Step=1, Count=panel_5)  # disabled
multiplication = Multiplication(A=graph, B=20)  # disabled
ldc = GHLDCurve(TimeStepList=series_4, ValueList=multiplication)  # disabled
name = Panel("Tut_NonLinear_Arch")  # disabled
bisectioning_factor = Panel("4")  # disabled
list = ValueList({"Displacements": 1, "Stresses": 2, "SupportForces": 3}, selected=["Displacements", "SupportForces"])  # disabled
nonlin = NonLinearAnalysis(
    Name=name,
    Iterations=100,
    EquilibriumAccurancy=0.001,
    OutputSetting=list,
    GlobalLDCurve=ldc,
    AdaptiveForceControl=bisectioning_factor,
    OutputFrequency=1)  # disabled

rev = Reverse(Vector=evalsrf_4.Normal)
multiplication_2 = Multiplication(A=rev, B=Slider(0.27, range=0..0.5))
mat = Material(Name="Steel", Type="LIN_ELAST_ISOTROPIC", YoungsModulus=200000, AlphaT=0, Nue=0, Density=78.5, Strength=235000)  # disabled
pt_5 = Point(item)  # disabled
crvref = CurveRefinement(PDeg=3, ElementRefU=5, IsKnotApproxElementSize=False, IsKnotSubdivision=True)  # disabled
box = BoxSection(Height=Slider(0.02, range=0..0.1), Width=Slider(0.1, range=0..0.1), Thickness=0)  # -> Section, Area; disabled
merge_2 = Merge(Data1=item_3.Item, Data2=item_3.Item1)  # -> flatten(Result); disabled
vdis = VectorDisplay(Anchor=item_3.Item2, Vector=multiplication_2)
beam = BeamElement(C=merge_2, M=mat, S=box.Section, R=crvref, HS=False, HE=False, HB=False)  # disabled
suppt = SupportPoint(Point=pt_5, DispX=True, DispY=True, DispZ=True, Rotation=False, Torsion=False)  # disabled
cpta = CouplingPointAxis(Point=item_3.Item2, Curve1=item_3.Item, Curve2=item_3.Item1, Axis=multiplication_2, CheckProximity=False)  # disabled
merge_3 = Merge(Data1=cpta, Data2=suppt)  # -> flatten(Result); disabled
amodel = AnalysisModel(
    Analysis=nonlin,
    StructuralElements=beam,
    Supports=merge_3,
    IntersectionTolerance=0.001,
    IsCarat=True,
    IsKratos=False,
    PenaltyFac=10000000,
    ShowCouplingIDs=False,
    ShowEdgeIDs=False,
    ShowGeo=True,
    ShowPatchIDs=True,
    ShowPrePro=True,
    ShowRef=False)  # disabled

# ----
# Kiwi3d - Solve
button = Button()  # disabled
analysis_completed = RunAnalysis(AnalysisModel=amodel, Run=button, antiFreeze=False, showWindow=True)  # -> ResultModel, ErrorLog; disabled

panel_6 = Panel(analysis_completed.ErrorLog)  # disabled

# ----
# Kiwi3d - Results
load_case = Slider(50, range=0..50)  # disabled
defmod = DeformedModel(Model=analysis_completed.ResultModel, LoadCase=load_case, ScaleFactor=1, FlyingNodeLimit=100000)  # -> Model, Geo, DeformedStructuralElements; disabled
list_2 = ValueList({"X Displacement": 1, "Y Displacement": 2, "Z Displacement": 3, "Displacement Length": 4, "P_N1": 5, "P_N2": 6, "N1": 7, "N2": 8, "N12": 9, "P_M1 (Shell)": 10, "P_M2 (Shell)": 11, "M1 (Shell)": 12, "M2 (Shell)": 13, "M12 (Shell)": 14, "von_Mises (Shell)": 15}, selected="X Displacement")  # disabled
_2drescolplot = _2DElementResultColourPlot(Model=defmod.Model, Type=list_2, LC=load_case, VisMeshCoarse=True, VisMeshSmooth=False)  # -> Model, Mesh, ValueDomain, LegendC, LegendT; disabled
