# Grasshopper definition PrincipalCurvatures_HyparBase.ghx (Grasshopper 1.0.7)

angle = Slider(90, range=-90..90)
slider = Slider(10, range=0..20)
pt = Point([<point referenced from the Rhino model> x86])
slider_2 = Slider(0, range=0..10)
srf = Surface(<surface referenced from the Rhino model>)
panel = Panel("""True
False""")
rad = Radians(Degrees=angle)
srf_cp = SurfaceCP(Point=pt, Surface=srf)  # -> Point, UVPoint, Distance
vb = VBScript(srf=srf, uv=srf_cp.UVPoint, accuracy=slider_2, angle=rad, max=graft(panel))  # -> out, A; inputs srf: Surface, uv: Point3d
# ---------- vb: C# ----------
    If (Not uv.IsValid) Then Return
# ---------- end vb ----------
# srf: Surface to sample
# 
# uv: UV point on surface for PrinCrv intersection
# 
# accuracy: Distance between sample-points
# 
# angle: Angle (in radians) to deviate from maximum principle curvature.
# 
# max: If True, the maximum principal curvature will be traced, if False, then the minimum principal curvature will be traced.
vb_2 = VBScript(srf=srf, uv=srf_cp.UVPoint, accuracy=slider_2, angle=rad, max=graft(panel))  # -> out, pts; inputs srf: Surface, uv: Point3d
# ---------- vb_2: C# ----------
    If (srf Is Nothing) Then Return
# ---------- vb_2: C# additional code ----------
    If (Not uv.IsValid) Then Return
# ---------- end vb_2 ----------
panel_2 = Panel(vb.A)
pline = PolyLine(Vertices=vb.A, Closed=False)
