# Grasshopper definition AsymptoticNetworks_Tracing.gh (Grasshopper 1.0.7)
# plug-ins: Kangaroo2 Components

brep = Brep(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)
edges = BrepEdges(Brep=brep)  # -> Naked, Interior, NonManifold
item = ListItem(List=edges.Naked, Index=0, Wrap=True)
divide = DivideCurve(Curve=item, Count=10, Kinks=False)  # -> Points, Tangents, Parameters
c_script = CSharpScript(
    Srf=brep,
    pt=divide.Points,
    tolerance=Slider(0.03, range=0..0.1),
    stepSize=Slider(0.1, range=0..0.1),
    maxPoints=Slider(10000, range=0..10000))  # -> out, A, B; inputs Srf: Brep, pt: Point3d, tolerance: Double, stepSize: Double, maxPoints: Int32
# ---------- c_script: C# usings ----------
using System.Diagnostics;
using static System.Math;
using System.Linq;
using Rhino.Geometry.Intersect;
# ---------- c_script: C# ----------
Brep brep = Srf.DuplicateBrep();
BrepFace face = Srf.Faces[0];

// Normalize parameter space. This allows hard-coded tolerances.
foreach (var f in brep.Faces)
{
    f.SetDomain(0, new Interval(0, 1));
    f.SetDomain(1, new Interval(0, 1));
}

var surface = face.UnderlyingSurface();


if (!face.ClosestPoint(pt, out double u, out double v))
    throw new Exception("Projection failed");

// If untrimmed CP is outside boundaries -> compute boundary CP
if (face.IsPointOnFace(u, v) == PointFaceRelation.Exterior)
{
    var closestU = 0.0;
    var closestV = 0.0;
    var closestDistance = 0.0;

    foreach (var loop in face.Loops)
    {
        var curve = loop.To3dCurve();

        if (!curve.ClosestPoint(pt, out var t, closestDistance))
            continue;

        var loopPoint = curve.PointAt(t);

        if (!surface.ClosestPoint(loopPoint, out var loopU, out var loopV))
            continue;

        var loopDistance = loopPoint.DistanceTo(pt);

        // Update result if new point is closer
        if (loopDistance < closestDistance || closestDistance == 0)
        {
            closestU = loopU;
            closestV = loopV;
            closestDistance = loopDistance;
        }

        // Break if point is on boundary
        if (closestDistance < tolerance)
            break;
    }

    u = closestU;
    v = closestV;
}

Vector2d uv = new Vector2d(u, v);



var curves = new List<Curve>(2);

NormalCurvaturePath path = new NormalCurvaturePath(0,0);
double loopTolerance = 0.1;

foreach (var pathfinder in Pathfinder.Create(path, face, uv, false, stepSize, tolerance, maxPoints, loopTolerance))
{
    var curve = new PolylineCurve(pathfinder.Parameters);

    var curveOnSurface = CurveOnSurface.Create(pathfinder.Face.UnderlyingSurface(), curve);

    if (curveOnSurface != null)
        curves.Add(curveOnSurface.ToCurve(RhinoDoc.ActiveDoc.ModelAbsoluteTolerance));
}

foreach (var pathfinder in Pathfinder.Create(path, face, uv, true, stepSize, tolerance, maxPoints, loopTolerance))
{
    var curve = new PolylineCurve(pathfinder.Parameters);

    var curveOnSurface = CurveOnSurface.Create(pathfinder.Face.UnderlyingSurface(), curve);

    if (curveOnSurface != null)
        curves.Add(curveOnSurface.ToCurve(RhinoDoc.ActiveDoc.ModelAbsoluteTolerance));
}

A = curves;
# ---------- c_script: C# additional code ----------
public class NormalCurvaturePath
{
    double Value { get; set; }

    double Angle { get; set; }

    public NormalCurvaturePath(double value, double angle)
    {
        Value = value;
        Angle = angle;
    }

    public Vector3d InitialDirection(Surface surface, Vector2d uv, bool type)
    {
        var u = uv.X;
        var v = uv.Y;

        var crv = new PrincipalCurvature();

        if (!crv.Compute(surface, u, v))
                return Vector3d.Zero;

        if (!crv.FindNormalCurvature(Value, Angle, out var _, out var _, out var dir1, out var dir2))
            return Vector3d.Zero;

        return type ? dir1 : dir2;
    }

    public Vector2d Direction(Surface surface, Vector2d uv, Vector3d lastDirection, double stepSize)
    {
        var u = uv.X;
        var v = uv.Y;

        var crv = new PrincipalCurvature();

        if (!crv.Compute(surface, u, v))
            return Vector2d.Zero;

        if (!crv.FindNormalCurvature(Value, Angle, out var u1, out var u2, out var dir1, out var dir2))
            return Vector2d.Zero;

        var d = Choose(u1, u2, dir1, dir2, lastDirection, stepSize);

        Debug.Assert(d.IsValid);
        Debug.Assert(d.Length > 0);

        return new Vector2d(d.X, d.Y);
    }

    public bool Directions(Surface surface, Vector2d uv, out Vector3d u1, out Vector3d u2, out Vector3d d1, out Vector3d d2)
    {
        var u = uv.X;
        var v = uv.Y;

        var crv = new PrincipalCurvature();

        if (!crv.Compute(surface, u, v))
        {
            u1 = default;
            u2 = default;
            d1 = default;
            d2 = default;
            return false;
        }

        if (!crv.FindNormalCurvature(Value, Angle, out u1, out u2, out d1, out d2))
            return false;

        return true;
    }

    protected static Vector3d Choose(Vector3d u1, Vector3d u2, Vector3d dir1, Vector3d dir2, Vector3d sample, double stepSize)
    {
        Debug.Assert(dir1.Length > 1e-10);
        Debug.Assert(dir2.Length > 1e-10);
        Debug.Assert(sample.Length > 1e-10);

        sample /= sample.Length;

        var d1 = dir1 * sample;
        var d2 = dir2 * sample;

        if (Math.Abs(d1) > Math.Abs(d2))
            return d1 > 0 ? u1 * stepSize : -u1 * stepSize;
        else
            return d2 > 0 ? u2 * stepSize : -u2 * stepSize;
    }
}

/////////////////////////////////////////////////////////
/////////////////////////////////////////////////////////
/////////////////////////////////////////////////////////
/////////////////// Principal Curvatures
/////////////////////////////////////////////////////////
/////////////////////////////////////////////////////////
/////////////////////////////////////////////////////////

struct PrincipalCurvature
{
    public bool Compute(Surface surface, double u, double v)
    {
        surface.Evaluate(u, v, 2, out X, out var ders);

        A1 = ders[0];
        A2 = ders[1];
        A1_1 = ders[2];
        A1_2 = ders[3];
        A2_2 = ders[4];

        G11 = A1 * A1;
        G12 = A1 * A2;
        G22 = A2 * A2;

        N = Vector3d.CrossProduct(A1, A2);
        N /= N.Length;

        H11 = N * A1_1;
        H12 = N * A1_2;
        H22 = N * A2_2;

        {
            var det = G11 * G22 - G12 * G12;

            if (det == 0)
                return false;

            K11 = (G22 * H11 - G12 * H12) / det;
            K12 = (G22 * H12 - G12 * H22) / det;
            K21 = (G11 * H12 - G12 * H11) / det;
            K22 = (G11 * H22 - G12 * H12) / det;
        }

        var eps = Max(Abs(K11), Abs(K22)) * 1e-10;

        if (Abs(K12) < eps && Abs(K21) < eps)
        {
            K1 = K11;
            K2 = K22;

            var l1 = Sqrt(G11);
            var l2 = Sqrt(G22);

            Debug.Assert(Abs(A1.Length / l1 - 1) < 1e-8);
            Debug.Assert(Abs(A2.Length / l2 - 1) < 1e-8);

            var du1 = 1 / l1;
            var dv2 = 1 / l2;

            U1 = new Vector3d(du1, 0, 0);
            U2 = new Vector3d(0, dv2, 0);

            D1 = du1 * A1;
            D2 = dv2 * A2;
        }
        else
        {
            var det = 4 * K12 * K21 + Pow(K11 - K22, 2);

            if (det < 0)
                return false;

            K1 = 0.5 * (K11 + K22 + Sqrt(det));
            K2 = 0.5 * (K11 + K22 - Sqrt(det));

            double du1, dv1, du2, dv2;

            if (Abs(K12) > Abs(K21))
            {
                du1 = K12;
                dv1 = K1 - K11;

                du2 = K12;
                dv2 = K2 - K11;
            }
            else // K21 != 0
            {
                du1 = K1 - K22;
                dv1 = K21;

                du2 = K2 - K22;
                dv2 = K21;
            }

                // first direction

            var l1 = Sqrt(G11 * du1 * du1 + 2 * G12 * du1 * dv1 + G22 * dv1 * dv1);

            Debug.Assert(Abs(l1 / (du1 * A1 + dv1 * A2).Length - 1) < 1e-8);

            du1 /= l1;
            dv1 /= l1;

            U1 = new Vector3d(du1, dv1, 0);

            D1 = du1 * A1 + dv1 * A2;

            // second direction

            var l2 = Sqrt(G11 * du2 * du2 + 2 * G12 * du2 * dv2 + G22 * dv2 * dv2);

            Debug.Assert(Abs(l2 / (du2 * A1 + dv2 * A2).Length - 1) < 1e-8);

            du2 /= l2;
            dv2 /= l2;

            U2 = new Vector3d(du2, dv2, 0);

            D2 = du2 * A1 + dv2 * A2;
        }

        Debug.Assert(D1.IsValid && !D1.IsZero);
        Debug.Assert(D2.IsValid && !D2.IsZero);

        Debug.Assert(U1.IsValid && !U1.IsZero);
        Debug.Assert(U2.IsValid && !U2.IsZero);

        Debug.Assert(Abs(D1 * D2) < 1e-4);

        return true;
    }


    public bool FindNormalCurvature(double value, double angleOffset, out Vector3d u1, out Vector3d u2, out Vector3d dir1, out Vector3d dir2)
    {
        var t = (2 * value - K1 - K2) / (K1 - K2);

        if (Abs(t) > 1 || double.IsNaN(t))
        {
            u1 = default;
            u2 = default;
            dir1 = default;
            dir2 = default;
            return false;
        }

        var alpha = 0.5 * Acos(t);

        {
            var cosAlpha = Cos(alpha + angleOffset);
            var sinAlpha = Sin(alpha + angleOffset);

            var du = A2 * D2 * cosAlpha - A2 * D1 * sinAlpha;
            var dv = A1 * D1 * sinAlpha - A1 * D2 * cosAlpha;

            u1 = new Vector3d(du, dv, 0);

            dir1 = du * A1 + dv * A2;

            Debug.Assert(dir1.Length > 0);

            var l = dir1.Length;

            u1 /= l;
            dir1 /= l;

            Debug.Assert(dir1.IsValid);
        }

        {
            var cosAlpha = Cos(alpha - angleOffset);
            var sinAlpha = Sin(alpha - angleOffset);

            var du = A2 * D2 * cosAlpha + A2 * D1 * sinAlpha;
            var dv = -A1 * D1 * sinAlpha - A1 * D2 * cosAlpha;

            u2 = new Vector3d(du, dv, 0);

            dir2 = du * A1 + dv * A2;

            Debug.Assert(dir2.Length > 0);

            var l = dir2.Length;

            u2 /= l;
            dir2 /= l;

            Debug.Assert(dir2.IsValid);
        }

        return true;
    }

    public Point3d X;

    public Vector3d A1;

    public Vector3d A2;

    public Vector3d A1_1;

    public Vector3d A1_2;

    public Vector3d A2_2;

    public Vector3d N;

    public double G11;

    public double G12;

    public double G22;

    public double H11;

    public double H12;

    public double H22;

    public double K11;

    public double K12;

    public double K21;

    public double K22;

    public double K1;

    public double K2;

    public Vector3d D1;

    public Vector3d D2;

    public Vector3d U1;

    public Vector3d U2;
}

/////////////////////////////////////////////////////////
/////////////////////////////////////////////////////////
/////////////////////////////////////////////////////////
/////////////////// Pathfinder
/////////////////////////////////////////////////////////
/////////////////////////////////////////////////////////
/////////////////////////////////////////////////////////

class Pathfinder
{
    public BrepFace Face { get; set; }

    public List<Point3d> Parameters { get; set; }

    public List<Point3d> Points { get; set; }

    public Pathfinder(BrepFace face, List<Point3d> parameters, List<Point3d> points)
    {
        Face = face;
        Parameters = parameters;
        Points = points;
    }

    struct Task
    {
        public Task(BrepFace face, Vector2d parameter, Point3d location, Vector3d direction, bool flip)
        {
            Face = face;
            Parameter = parameter;
            Location = location;
            Direction = direction;
            Flip = flip;
        }

        public BrepFace Face;

        public Vector2d Parameter;

        public Point3d Location;

        public Vector3d Direction;

        public bool Flip;
    }

    private static void AddTask(Queue<Task> tasks, BrepFace adjacentFace, Vector2d adjacentUV, Point3d location, Vector3d direction, bool flip)
    {
        if (adjacentFace == null)
            return;

        tasks.Enqueue(new Task(adjacentFace, adjacentUV, location, direction, flip));
    }

    public static List<Pathfinder> Create(NormalCurvaturePath path, BrepFace face, Vector2d uv, bool type, double stepSize, double tolerance, int maxPoints, double loopTolerance)
    {
        var tasks = new Queue<Task>();
        var results = new List<Pathfinder>();

        var breakpoints = new List<Point3d>();

        // Initial face
        {
            var parameters = new List<Point3d>();
            var points = new List<Point3d>();

            parameters.Add(new Point3d(uv.X, uv.Y, 0));
            points.Add(face.PointAt(uv.X, uv.Y));

            var direction = path.InitialDirection(face, uv, type);

            if (direction.IsZero)
                return new List<Pathfinder>();

            TrimmedBoundary boundary = TrimmedBoundary.Create(face);

            // First branch
            {
                var endDirection = FindPath(parameters, points, path, face, uv, -direction, boundary, stepSize, tolerance, maxPoints);

                var endLocation = points[points.Count - 1];
                var adjacentFace = boundary.AdjacentFace;

                AddTask(tasks, adjacentFace, boundary.AdjacentUV, endLocation, endDirection, true);

                breakpoints.Add(endLocation);
            }

            parameters.Reverse();
            points.Reverse();

            // Second branch
            {
                var endDirection = FindPath(parameters, points, path, face, uv, direction, boundary, stepSize, tolerance, maxPoints);

                var endLocation = points[points.Count - 1];
                var adjacentFace = boundary.AdjacentFace;

                AddTask(tasks, adjacentFace, boundary.AdjacentUV, endLocation, endDirection, false);

                breakpoints.Add(endLocation);
            }

            if (points.Count > 1)
                results.Add(new Pathfinder(face, parameters, points));

            maxPoints -= points.Count;
        }

        // Adjacent faces

        while (tasks.Count != 0)
        {
            var task = tasks.Dequeue();

            var parameters = new List<Point3d>();
            var points = new List<Point3d>();

            parameters.Add(new Point3d(task.Parameter.X, task.Parameter.Y, 0));
            points.Add(task.Location);

            TrimmedBoundary boundary = TrimmedBoundary.Create(task.Face);

            var endDirection = FindPath(parameters, points, path, task.Face, task.Parameter, task.Direction, boundary, stepSize, tolerance, maxPoints);

            // Skip empty paths
            if (points.Count < 2)
                continue;

            var endLocation = points[points.Count - 1];
            var adjacentFace = boundary.AdjacentFace;

            if (task.Flip)
            {
                parameters.Reverse();
                points.Reverse();
            }

            results.Add(new Pathfinder(task.Face, parameters, points));

            if (breakpoints.Any(o => o.DistanceTo(endLocation) < loopTolerance))
                break;

            AddTask(tasks, adjacentFace, boundary.AdjacentUV, endLocation, endDirection, task.Flip);
            breakpoints.Add(endLocation);

            maxPoints -= points.Count;
        }

        return results;
    }

    private static Vector3d FindPath(List<Point3d> parameters, List<Point3d> points, NormalCurvaturePath path, Surface surface, Vector2d uv, Vector3d direction, TrimmedBoundary boundary, double stepSize, double tolerance, int maxPoints)
    {
        var tolerance2 = tolerance * tolerance;

        while (points.Count < maxPoints)
        {
            // Fourth-order Runge-Kutta

            var d0 = path.Direction(surface, uv, direction, stepSize);

            var uv1 = uv + d0 * 0.5;
            var d1 = path.Direction(surface, uv1, direction, stepSize);

            var uv2 = uv + d1 * 0.5;
            var d2 = path.Direction(surface, uv2, direction, stepSize);

            var uv3 = uv + d2;
            var d3 = path.Direction(surface, uv3, direction, stepSize);

            var delta = (d0 + 2 * d1 + 2 * d2 + d3) / 6;

            Debug.Assert(delta.IsValid);

            // Break if no valid direction

            if (delta.X == 0 && delta.Y == 0)
                break;

            // Compute next point

            var uvNext = uv + delta;

            var isBoundary = boundary.Clip(uv, ref uvNext);

            Debug.Assert(uvNext.IsValid);

            uv = uvNext;

            var x = surface.PointAt(uv.X, uv.Y);

            // Update direction

            var newDirection = x - points[points.Count - 1];

            // Break if no progress in geometry space

            if (newDirection.SquareLength < 1e-20)
                break;

            direction = newDirection;

            // Add point

            parameters.Add(new Point3d(uv.X, uv.Y, 0));
            points.Add(x);

            // Break if boundary reached

            if (isBoundary)
                break;
        }

        return direction;
    }
}


/////////////////////////////////////////////////////////
/////////////////////////////////////////////////////////
/////////////////////////////////////////////////////////
/////////////////// Boundary
/////////////////////////////////////////////////////////
/////////////////////////////////////////////////////////
/////////////////////////////////////////////////////////



class TrimmedBoundary
{
    readonly BrepFace _face;

    public BrepFace AdjacentFace { get; set; }

    public Vector3d AdjacentTangent { get; set; }

    public Vector2d AdjacentUV { get; private set; }

    private TrimmedBoundary(BrepFace face)
    {
        _face = face;
    }

    public static TrimmedBoundary Create(BrepFace face)
    {
        return new TrimmedBoundary(face);
    }

    public bool Clip(Vector2d a, ref Vector2d b)
    {
        // No clip if B is within trimmed region
        if (_face.IsPointOnFace(b.X, b.Y) == PointFaceRelation.Interior)
            return false;

        var boundingTrim = default(BrepTrim);
        var boundingTrimParameter = default(double);

        // Check if A is already on boundary
        if (_face.IsPointOnFace(a.X, a.Y) == PointFaceRelation.Boundary)
        {
            b = a;

            foreach (var loop in _face.Loops)
            {
                foreach (var trim in loop.Trims)
                {
                    if (!trim.TrimCurve.ClosestPoint(new Point3d(a.X, a.Y, 0), out var t))
                        continue;

                    var pointAtTrim = trim.TrimCurve.PointAt(t);

                    var distance = Sqrt(Pow(a.X - pointAtTrim.X, 2) + Pow(a.Y - pointAtTrim.Y, 2));

                    if (distance > 1e-4)
                        continue;

                    if (boundingTrim != null && boundingTrim.Edge.TrimCount >= trim.Edge.TrimCount)
                        continue;

                    boundingTrim = trim;
                    boundingTrimParameter = t;
                }
            }
        }
        else
        {
            // Create 2D-Segment
            var line = new LineCurve(new Line(a.X, a.Y, 0, b.X, b.Y, 0));
            line.ChangeDimension(2);

            // Check for intersection with trimming segments
            foreach (var loop in _face.Loops)
            {
                foreach (var trim in loop.Trims)
                {
                    var intersections = Intersection.CurveCurve(trim, line, 1e-4, 1e-4);

                    if (intersections.Count == 0)
                        continue;

                    if (boundingTrim != null && boundingTrim.Edge.TrimCount >= trim.Edge.TrimCount)
                        continue;

                    var intersection = intersections[0];

                    b.X = intersection.PointA.X;
                    b.Y = intersection.PointA.Y;

                    boundingTrim = trim;
                    boundingTrimParameter = intersection.ParameterA;

                    break;
                }
            }
        }

        if (boundingTrim == null)
            throw new Exception("Trimming failed");

        Debug.Assert(boundingTrim.PointAt(boundingTrimParameter).DistanceTo(new Point3d(b.X, b.Y, 0)) < 1e-4);

        AdjacentTangent = boundingTrim.TangentAt(boundingTrimParameter);

        if (boundingTrim.Edge.TrimCount < 2)
        {
            AdjacentFace = null;
            return true;
        }

        var trims = boundingTrim.Edge.TrimIndices();

        var adjacentTrimIndex = trims[0] == boundingTrim.TrimIndex ? trims[1] : trims[0];
        var adjacentTrim = boundingTrim.Brep.Trims[adjacentTrimIndex];

        AdjacentFace = adjacentTrim.Face;

        var curveOnSurface = CurveOnSurface.Create(AdjacentFace, adjacentTrim);

        var location = _face.PointAt(b.X, b.Y);

        var closestPoint = curveOnSurface.Invert(location, 1e-4);

        Debug.Assert(closestPoint.Item2.DistanceTo(location) < 1e-3);

        var adjacentUV = adjacentTrim.PointAt(closestPoint.Item1);

        Debug.Assert(AdjacentFace.PointAt(adjacentUV.X, adjacentUV.Y).DistanceTo(location) < 1e-3);

        AdjacentUV = new Vector2d(adjacentUV.X, adjacentUV.Y);

        return true;
    }
}

/////////////////////////////////////////////////////////
/////////////////////////////////////////////////////////
/////////////////////////////////////////////////////////
/////////////////// Curve projection
/////////////////////////////////////////////////////////
/////////////////////////////////////////////////////////
/////////////////////////////////////////////////////////

public class CurveOnSurface
{
    public Surface Surface { get; }

    public Curve Curve { get; }

    private CurveOnSurface(Surface surface, Curve curve)
    {
        Surface = (Surface)surface?.DuplicateShallow() ?? throw new ArgumentNullException(nameof(surface));
        Curve = (Curve)curve?.DuplicateShallow() ?? throw new ArgumentNullException(nameof(curve));
    }

    public static CurveOnSurface Create(Surface surface, Curve curve)
    {
        if (!surface.IsValid || !curve.IsValid || curve.Domain.Length == 0)
            return null;
        return new CurveOnSurface(surface, curve);
    }

    private List<Tuple<double, Point3d>> Tessellation(double tolerance)
    {
        var maxIter = 10;
        var length = 0.0;

        var tessellation = new List<Tuple<double, Point3d>>();

        for (int i = 0; i < Curve.SpanCount; i++)
        {
            var span = Curve.SpanDomain(i);

            var samplePoints = new List<Tuple<double, Point3d>>();

            var f = new Func<double, double>((t) =>
            {
                var c = Curve.DerivativeAt(t, 1);
                var c0 = c[0];
                var c1 = c[1];

                Surface.Evaluate(c0.X, c0.Y, 1, out var x, out var s);
                var s1 = c1.X * s[0] + c1.Y * s[1];

                samplePoints.Add(Tuple.Create(t, x));

                return s1.Length;
            });

            length += Integrate.Romberg(f, span.T0, span.T1, tolerance, maxIter);

            samplePoints.Sort((a, b) => -a.Item1.CompareTo(b.Item1));

            //var n = Max(Surface.Degree(0), Surface.Degree(1));

            tessellation.Capacity = tessellation.Count + samplePoints.Count * 2;

            while (true)
            {
                var a = samplePoints[samplePoints.Count - 1];
                samplePoints.RemoveAt(samplePoints.Count - 1);

                tessellation.Add(a);

                if (samplePoints.Count == 0)
                    break;

                while (true)
                {
                    var b = samplePoints[samplePoints.Count - 1];

                    var maxDistance = 0.0;
                    var maxPoint = default(Tuple<double, Point3d>);

                    var domain = new Interval(a.Item1, b.Item1);

                    //for (int j = 1; j <= n; j++)
                    //{
                    //    var t = domain.ParameterAt(j / (n + 1.0));
                    var t = domain.ParameterAt(0.5);
                    var point = PointAt(t);

                    var distance = new Line(a.Item2, b.Item2).DistanceTo(point, true);

                    if (distance < maxDistance)
                        continue;

                    maxDistance = distance;
                    maxPoint = Tuple.Create(t, point);
                    //}

                    if (maxDistance < tolerance * 100)
                        break;

                    samplePoints.Add(maxPoint);
                }
            }
        }

        Debug.Assert(Abs(length - ToCurve(tolerance).GetLength()) < 10 * tolerance);

        return tessellation;
    }

    public Tuple<double, Point3d> Invert(Point3d sample, double tolerance)
    {
        var tessellation = Tessellation(tolerance);

        var polyline = new Polyline(tessellation.Select(o => o.Item2));

        var closestParameter = polyline.ClosestParameter(sample);
        var closestSpan = (int)closestParameter + 1 == tessellation.Count ? (int)closestParameter - 1 : (int)closestParameter;

        var minParameter = tessellation[Max(0, closestSpan - 1)].Item1;
        var maxParameter = tessellation[Min(tessellation.Count - 1, closestSpan + 2)].Item1;

        if (minParameter > maxParameter)
        {
            var tmp = minParameter;
            minParameter = maxParameter;
            maxParameter = tmp;
        }

        var t0 = tessellation[closestSpan].Item1;
        var t1 = tessellation[closestSpan + 1].Item1;

        var t = t0 + (closestParameter - closestSpan) * (t1 - t0);
        var closestPoint = Tuple.Create(t, PointAt(t));

        var maxIterations = 10;

        for (var i = 0; i < maxIterations; i++)
        {
            var c = Curve.DerivativeAt(t, 1);
            var c0 = c[0];
            var c1 = c[1];

            Surface.Evaluate(c0.X, c0.Y, 1, out var x, out var s);
            var a1 = c1.X * s[0] + c1.Y * s[1];

            var r = x - sample;

            if (r.Length < tolerance)
                break;

            if (Abs(r / r.Length * a1 / a1.Length) < tolerance)
                break;

            Debug.Assert((a1 / a1.Length - TangentAt(t)).Length < 1e-10);

            var w = r.Length * a1.Length;
            var lhs = a1 * a1;
            var rhs = a1 * r;

            var delta = -rhs / lhs;

            var deltaMin = minParameter - t;
            var deltaMax = maxParameter - t;

            if (delta < deltaMin)
                delta = deltaMin;
            else if (delta > deltaMax)
                delta = deltaMax;

            Debug.Assert(t + delta >= minParameter);
            Debug.Assert(t + delta <= maxParameter);

            var alpha = 1.0;

            for (int j = 0; j < 5; j++)
            {
                var x1 = PointAt(t + alpha * delta);

                if (sample.DistanceToSquared(x1) <= r.SquareLength)
                    break;

                alpha /= 2;

                Debug.Assert(j + 1 < 5);
            }

            var nextParameter = t + alpha * delta;

            t = nextParameter;

            Debug.Assert(i + 1 < maxIterations || t == minParameter || t == maxParameter);
        }

        return Tuple.Create(t, PointAt(t));
    }

    public Point3d PointAt(double t)
    {
        var uv = Curve.PointAt(t);
        return Surface.PointAt(uv.X, uv.Y);
    }

    public Vector3d TangentAt(double t)
    {
        var c_t = Curve.TangentAt(t);
        var uv = Curve.PointAt(t);
        Surface.Evaluate(uv.X, uv.Y, 1, out var _, out var s_uv);
        var x_t = c_t.X * s_uv[0] + c_t.Y * s_uv[1];
        return x_t / x_t.Length;
    }

    public Curve ToCurve(double tolerance)
    {
        var curve = Surface.Pushup(Curve, tolerance);

        if (curve == null)
            return null;

        return curve.IsValid ? curve : null;
    }
}

/////////////////////////////////////////////////////////
/////////////////////////////////////////////////////////
/////////////////////////////////////////////////////////
/////////////////// Integrate
/////////////////////////////////////////////////////////
/////////////////////////////////////////////////////////
/////////////////////////////////////////////////////////

static class Integrate
{
    public static double Romberg(Func<double, double> f, double a, double b, double tolerance, int maxIter)
    {
        var r1 = new double[maxIter];
        var r2 = new double[maxIter];

        var Rp = r1; // current row
        var Rc = r2; // previous row

        double h = (b - a); // step size

        Rp[0] = (f(a) + f(b)) * h * 0.5; // first trapezoidal step

        for (int i = 1; i < maxIter; ++i)
        {
            h /= 2.0;

            double c = 0;

            int ep = 1 << (i - 1);

            for (int j = 1; j <= ep; ++j)
                c += f(a + (2 * j - 1) * h);

            Rc[0] = h * c + 0.5 * Rp[0]; // R(i,0)

            for (int j = 1; j <= i; ++j)
            {
                var n_k = Math.Pow(4.0, j);
                Rc[j] = (n_k * Rc[j - 1] - Rp[j - 1]) / (n_k - 1); // compute R(i,j)
            }

            if (i > 1 && Math.Abs(Rp[i - 1] - Rc[i]) < tolerance)
                return Rc[i - 1];

            // swap Rn and Rc as we only need the last row
            var rt = Rp;

            Rp = Rc;
            Rc = rt;
        }

        return Rp[maxIter - 1];
    }
}
# ---------- end c_script ----------

brep_2 = Brep(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)
edges_2 = BrepEdges(Brep=brep_2)  # -> Naked, Interior, NonManifold
item_2 = ListItem(List=edges_2.Naked, Index=0, Wrap=True)
item_3 = ListItem(List=edges_2.Naked, Index=2, Wrap=True)
divide_2 = DivideCurve(Curve=[item_2, item_3], Count=10, Kinks=False)  # -> Points, Tangents, Parameters
duppt = RemoveDuplicatePts(Points=flatten(divide_2.Points), Tolerance=0.01)
c_script_2 = CSharpScript(
    Srf=brep_2,
    pt=duppt,
    tolerance=Slider(0.03, range=0..0.1),
    stepSize=Slider(0.1, range=0..0.1),
    maxPoints=Slider(10000, range=0..10000))  # -> out, A, B; inputs Srf: Brep, pt: Point3d, tolerance: Double, stepSize: Double, maxPoints: Int32; same code as c_script

# ----
# Simplified version
srf = Surface(brep)
srf_cp = SurfaceClosestPoint(Point=divide.Points, Surface=srf)  # -> Point, UVPoint, Distance
c_script_3 = CSharpScript(srf=srf, uv=srf_cp.UVPoint, stepSize=Slider(0.01, range=0..0.01), numSamples=Slider(10000, range=0..10000))  # -> out, A, B; inputs srf: Surface, uv: Point3d, stepSize: Double, numSamples: Int32
# ---------- c_script_3: C# ----------
AsymptoticNetwork(srf, uv, stepSize, numSamples, out var C0, out var C1);

A = C0;
B = C1;
# ---------- c_script_3: C# additional code ----------
void AsymptoticNetwork(Surface srf, Point3d uv, double stepSize, int numSamples, out Curve C0, out Curve C1)
{
    List<Point3d> d0_A = AsymptoticPath(srf, uv, stepSize, numSamples, true);
    List<Point3d> d0_B = AsymptoticPath(srf, uv, stepSize, numSamples, true, Math.PI);

    List<Point3d> d1_A = AsymptoticPath(srf, uv, stepSize, numSamples, false);
    List<Point3d> d1_B = AsymptoticPath(srf, uv, stepSize, numSamples, false, Math.PI);

    d0_A.RemoveAt(0);
    d0_A.Reverse();

    d0_A.AddRange(d0_B);

    d1_A.RemoveAt(0);
    d1_A.Reverse();

    d1_A.AddRange(d1_B);

    C0 = new PolylineCurve(d0_A);
    C1 = new PolylineCurve(d1_A);
}

List<Point3d> AsymptoticPath(Surface srf, Point3d uv, double stepSize=0.01, int numSamples=1000, bool direction0=true, double angle=0)
{
    Point3d oldUV = uv;
    Interval U = srf.Domain(0);
    Interval V = srf.Domain(1);

    List<Point3d> pathA = new List<Point3d>();

    while(pathA.Count < numSamples){

        //1. Get the curvature at the current point
        SurfaceCurvature crv = srf.CurvatureAt(oldUV.X, oldUV.Y);
        if(crv == null) break;

        //2. Add the current point to the path
        Point3d oldPt = srf.PointAt(oldUV.X, oldUV.Y);
        pathA.Add(oldPt);

        //3. Get the principal direction & values
        Vector3d dir = crv.Direction(0);
        double k1 = crv.Kappa(0);
        double k2 = crv.Kappa(1);

        //4. Calculate deviation angle based on PC-direction
        double alpha = (2 * Math.Atan(Math.Sqrt((2 * Math.Sqrt(k2 * ( -(k1 - k2))) + k1 - (2 * k2)) / k1)));

        //5. Switch direction and values for second direction
        if(!direction0)
        {
            dir = crv.Direction(1);
            k1 = crv.Kappa(1);
            k2 = crv.Kappa(0);
            alpha = (2 * Math.Atan(Math.Sqrt((-2 * Math.Sqrt(k2 * ( -(k1 - k2))) + k1 - (2 * k2)) / k1)));
        }

        //6. Check for anticlastic surfaces
        if(k1 * k2 > 0) break;

        //6. Rotate PC-direction to get A-direction
        dir.Rotate(angle+alpha, crv.Normal);

        //8. Check if the direction is valid
        if(!dir.IsValid || !dir.Unitize())break;

        //9. Scale the direction vector to a given size
        dir *= stepSize;

        //10. Flip the direction (in case it goes backwards)
        int N = pathA.Count;
        if(N > 1)
        {
            Vector3d oldDirection = oldPt - pathA[N - 2];
            if (dir.IsParallelTo(oldDirection, 0.5 * Math.PI) < 0)
            {
                dir.Reverse();
            }
        }

        //11. Compute the new point for the path
        Point3d newPt = oldPt + dir;
        if(!srf.ClosestPoint(newPt, out var newU, out var newV))break;

        //12. Check if the new point is within the current surface domain
        if(!U.IncludesParameter(newU, true) || !V.IncludesParameter(newV, true))break;

        //13. Check if the new and old point are not duplicated (within a given tolerance)
        if(Math.Abs(oldPt.X - newU) < 1e-12 && Math.Abs(oldPt.Y - newV) < 1e-12) break;

        //14. Set the old point as the new point
        oldUV.X = newU;
        oldUV.Y = newV;
    }
    return pathA;
  }
# ---------- end c_script_3 ----------
