# Grasshopper definition AsymptoticNetworks_Tracing_Surfaces.gh (Grasshopper 1.0.7)

number_slider = Slider(31, range=0..50)
c_script = CSharpScript(c=Slider(14.06, range=1..100), numU=number_slider, numV=Slider(10, range=0..10), Height=Slider(44.03, range=1..50))  # -> out, A; inputs c: Double, numU: Int32, numV: Int32, Height: Double
# ---------- c_script: C# ----------
    List<Point3d> pts = new List<Point3d>();
    double stepU = 2 * Math.PI / (numU - 1);
    double stepV = Height / (numV - 1);

    for(int i = 0; i < numU; i++){
      for(int j = 0; j < numV; j++){
        double u = stepU * i;
        double v = -0.5 * Height + stepV * j;
        double x = c * Math.Cosh(v / c) * Math.Cos(u);
        double y = c * Math.Cosh(v / c) * Math.Sin(u);
        double z = v;

        pts.Add(new Point3d(x, y, z));
      }
    }

    A = pts;
# ---------- end c_script ----------
srfgrid = SurfaceFromPoints(Points=c_script.A, UCount=number_slider, Interpolate=False)
srf = Surface(srfgrid)
edges = BrepEdges(Brep=srf)  # -> Naked, Interior, NonManifold
item = ListItem(List=edges.Naked, Index=0, Wrap=True)
divide = DivideCurve(Curve=item, Count=10, Kinks=False)  # -> Points, Tangents, Parameters

number_slider_2 = Slider(10000, range=0..10000)
number_slider_3 = Slider(0.01, range=0..0.01)

number_slider_4 = Slider(1.5, range=1..3)
srf_cp = SurfaceClosestPoint(Point=divide.Points, Surface=srf)  # -> Point, UVPoint, Distance
c_script_2 = CSharpScript(
    srf=srf,
    uv=srf_cp.UVPoint,
    stepSize=Slider(0.05, range=0..1),
    numSamples=Slider(3000, range=0..10000),
    Width=number_slider_4)  # -> out, CenterLineA, StripA, CenterLineB, StripB; inputs srf: Surface, uv: Point3d, stepSize: Double, numSamples: Int32, Width: Double
# ---------- c_script_2: C# ----------
    Curve C0, C1;
    Surface S0, S1;
    AsymptoticNetwork(srf, uv, stepSize, numSamples, Width, out C0, out C1, out S0, out S1);

    CenterLineA = C0;
    StripA = S0;
    CenterLineB = C1;
    StripB = S1;
# ---------- c_script_2: C# additional code ----------
  void AsymptoticNetwork(Surface srf, Point3d uv, double stepSize, int numSamples, double offset, out Curve C0, out Curve C1, out Surface S0, out Surface S1)
  {
    List<Point3d> d0_A = AsymptoticPath(srf, uv, stepSize, numSamples, true);
    List<Point3d> d0_B = AsymptoticPath(srf, uv, stepSize, numSamples, true, Math.PI);

    List<Point3d> d1_A = AsymptoticPath(srf, uv, stepSize, numSamples, false);
    List<Point3d> d1_B = AsymptoticPath(srf, uv, stepSize, numSamples, false, Math.PI);

    d0_A.RemoveAt(0);
    d0_A.Reverse();

    d0_A.AddRange(d0_B);

    d1_A.RemoveAt(0);
    d1_A.Reverse();

    d1_A.AddRange(d1_B);

    //C0 = new PolylineCurve(d0_A);
    //C1 = new PolylineCurve(d1_A);
    C0 = Curve.CreateInterpolatedCurve(d0_A, 3);
    C0.Rebuild(10, 3, true);
    C0.Domain = new Interval(0, 1);
    C1 = Curve.CreateInterpolatedCurve(d1_A, 3);
    C1.Rebuild(10, 3, true);
    C1.Domain = new Interval(0, 1);

    List<Point3d> tempA = new List<Point3d>();
    List<Point3d> tempB = new List<Point3d>();
    for(int i = 0; i < d0_A.Count;i++){
      Point3d p = d0_A[i];
      double u,v;
      srf.ClosestPoint(p, out u, out v);
      Vector3d n = srf.NormalAt(u, v);
      n.Unitize();
      n *= offset / 2;

      tempA.Add(p + n);
      tempB.Add(p - n);
    }

    Curve cc0 = new PolylineCurve(tempA);//Curve.CreateInterpolatedCurve(tempA, 3);
    //cc0.Rebuild(10, 3, true);
    Curve cc1 = new PolylineCurve(tempB);//Curve.CreateInterpolatedCurve(tempB, 3);
    //cc1.Rebuild(10, 3, true);

    S0 = NurbsSurface.CreateRuledSurface(cc0, cc1);

    tempA = new List<Point3d>();
    tempB = new List<Point3d>();
    for(int i = 0; i < d1_A.Count;i++){
      Point3d p = d1_A[i];
      double u,v;
      srf.ClosestPoint(p, out u, out v);
      Vector3d n = srf.NormalAt(u, v);
      n.Unitize();
      n *= offset/2;

      tempA.Add(p + n);
      tempB.Add(p - n);
    }

    cc0 = new PolylineCurve(tempA);//Curve.CreateInterpolatedCurve(tempA, 3);
    //cc0.Rebuild(10, 3, true);
    cc1 = new PolylineCurve(tempB);//Curve.CreateInterpolatedCurve(tempB, 3);
    //cc1.Rebuild(10, 3, true);

    S1 = NurbsSurface.CreateRuledSurface(cc0, cc1);
  }

  List<Point3d> AsymptoticPath(Surface srf, Point3d uv, double stepSize=0.01, int numSamples=1000, bool direction0=true, double angle=0)
  {
    Point3d oldUV = uv;
    Interval U = srf.Domain(0);
    Interval V = srf.Domain(1);

    List<Point3d> pathA = new List<Point3d>();

    while(pathA.Count < numSamples){

      //1. Get the curvature at the current point
      SurfaceCurvature crv = srf.CurvatureAt(oldUV.X, oldUV.Y);
      if(crv == null) break;

      //2. Add the current point to the path
      Point3d oldPt = srf.PointAt(oldUV.X, oldUV.Y);
      pathA.Add(oldPt);

      //3. Get the principal direction & values
      Vector3d dir = crv.Direction(0);
      double k1 = crv.Kappa(0);
      double k2 = crv.Kappa(1);

      //4. Calculate deviation angle based on PC-direction
      double alpha = (2 * Math.Atan(Math.Sqrt((2 * Math.Sqrt(k2 * ( -(k1 - k2))) + k1 - (2 * k2)) / k1)));

      //5. Switch direction and values for second direction
      if(!direction0)
      {
        dir = crv.Direction(1);
        k1 = crv.Kappa(1);
        k2 = crv.Kappa(0);
        alpha = (2 * Math.Atan(Math.Sqrt((-2 * Math.Sqrt(k2 * ( -(k1 - k2))) + k1 - (2 * k2)) / k1)));
      }

      //6. Check for anticlastic surfaces
      if(k1 * k2 > 0) break;

      //6. Rotate PC-direction to get A-direction
      dir.Rotate(angle + alpha, crv.Normal);

      //8. Check if the direction is valid
      if(!dir.IsValid || !dir.Unitize())break;

      //9. Scale the direction vector to a given size
      dir *= stepSize;

      //10. Flip the direction (in case it goes backwards)
      int N = pathA.Count;
      if(N > 1)
      {
        Vector3d oldDirection = oldPt - pathA[N - 2];
        if (dir.IsParallelTo(oldDirection, 0.5 * Math.PI) < 0)
        {
          dir.Reverse();
        }
      }

      //11. Compute the new point for the path
      Point3d newPt = oldPt + dir;
      double newU, newV;
      if(!srf.ClosestPoint(newPt, out newU, out newV)) break;

      //12. Check if the new point is within the current surface domain
      if(!U.IncludesParameter(newU, true) || !V.IncludesParameter(newV, true))break;

      //13. Check if the new and old point are not duplicated (within a given tolerance)
      if(Math.Abs(oldPt.X - newU) < 1e-12 && Math.Abs(oldPt.Y - newV) < 1e-12) break;

      //14. Set the old point as the new point
      oldUV.X = newU;
      oldUV.Y = newV;
    }
    return pathA;
  }
# ---------- end c_script_2 ----------
ccx = CurveCurve(CurveA=graft(c_script_2.CenterLineA), CurveB=c_script_2.CenterLineB)  # -> simplify(Points), simplify(ParamsA), ParamsB
ccx_2 = CurveCurve(CurveA=graft(c_script_2.CenterLineB), CurveB=c_script_2.CenterLineA)  # -> Points, simplify(ParamsA), ParamsB
lng = ListLength(List=c_script_2.CenterLineA)
preview = CustomPreview(Geometry=c_script_2.StripB, Material=ColourSwatch(SwatchColor=RGB(0, 81, 255)))
series = Series(Start=0, Step=expr("x*2", number_slider_4), Count=lng)
path_mapper = PathMapper(ccx_2.ParamsA, source="{A;B}", target="{A}")
path_mapper_2 = PathMapper(ccx.ParamsA, source="{A;B}", target="{A}")
pt = ConstructPoint(XCoordinate=series, YCoordinate=0, ZCoordinate=0)
Y = UnitY(Factor=1)
len = Length(Curve=c_script_2.CenterLineA)
sort = SortList(Keys=path_mapper_2)  # -> Keys, ValuesA
line = LineSDL(Start=pt, Direction=Y, Length=len)
c_script_3 = CSharpScript(param=sort.Keys, CenterLine=graft(c_script_2.CenterLineA), Offset=Slider(0.001, range=0..0.01), Width=number_slider_4)  # -> out, Strip; inputs param: list of Double, CenterLine: Curve, Offset: Double, Width: Double
# ---------- c_script_3: C# ----------
    double length = CenterLine.GetLength();
    Curve crv = new LineCurve(Origin, Origin + Vector3d.YAxis * length);
    crv.Domain = new Interval(0, 1);
    Curve crvA = crv.Offset(Plane.WorldXY, Width * 0.5, RhinoDoc.ActiveDoc.ModelAbsoluteTolerance, CurveOffsetCornerStyle.None)[0];
    crvA.Domain = new Interval(0, 1);

    List<Point3d> pts = new List<Point3d>();
    for(int i = 0; i < param.Count; i++){
      double t = param[i];
      if(i == 0 && t != 0){
        pts.Add(crvA.PointAt(0));
      }
      if(i == param.Count - 1 && t != 1)
      {
        pts.Add(crvA.PointAt(1));
      }
      else{
        double tL = t - Offset;
        if(tL < 0) tL = 0;
        double tR = t + Offset;
        if(tR > 1) tR = 1;

        if(tL > 0) pts.Add(crvA.PointAt(tL));
        pts.Add(crv.PointAt(tL));
        pts.Add(crv.PointAt(tR));
        if(tR < 1) pts.Add(crvA.PointAt(tR));
      }
    }

    pts.Add(crv.PointAt(1) - Vector3d.XAxis * (Width * 0.5));
    pts.Add(crv.PointAt(0) - Vector3d.XAxis * (Width * 0.5));
    pts.Add(pts[0]);
    Curve poly = new PolylineCurve(pts);
    Strip = poly;
# ---------- end c_script_3 ----------
patch = Patch(Curves=c_script_3.Strip, Spans=20, Flexibility=1, Trim=True)
preview_2 = CustomPreview(Geometry=flatten([c_script_2.StripA, patch]), Material=ColourSwatch(SwatchColor=RGB(255, 255, 255)))
