# Grasshopper definition AsymptoticNetworks_Tracing_Surfaces01.gh (Grasshopper 1.0.7)

number_slider = Slider(31, range=0..50)
c_script = CSharpScript(c=Slider(14.06, range=1..100), numU=number_slider, numV=Slider(10, range=0..10), Height=Slider(44.03, range=1..50))  # -> out, A; inputs c: Double, numU: Int32, numV: Int32, Height: Double
# ---------- c_script: C# ----------
    List<Point3d> pts = new List<Point3d>();
    double stepU = 2 * Math.PI / (numU - 1);
    double stepV = Height / (numV - 1);

    for(int i = 0; i < numU; i++){
      for(int j = 0; j < numV; j++){
        double u = stepU * i;
        double v = -0.5 * Height + stepV * j;
        double x = c * Math.Cosh(v / c) * Math.Cos(u);
        double y = c * Math.Cosh(v / c) * Math.Sin(u);
        double z = v;

        pts.Add(new Point3d(x, y, z));
      }
    }

    A = pts;
# ---------- end c_script ----------
brep = Brep(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)
srfgrid = SurfaceFromPoints(Points=c_script.A, UCount=number_slider, Interpolate=False)
brep_2 = Brep(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)
srf = Surface(brep_2)
edges = BrepEdges(Brep=srf)  # -> Naked, Interior, NonManifold
item = ListItem(List=edges.Naked, Index=0, Wrap=True)
divide = DivideCurve(Curve=item, Count=10, Kinks=False)  # -> Points, Tangents, Parameters

number_slider_2 = Slider(10000, range=0..10000)
number_slider_3 = Slider(0.01, range=0..0.01)

number_slider_4 = Slider(1.93, range=1..3)
srf_cp = SurfaceClosestPoint(Point=divide.Points, Surface=srf)  # -> Point, UVPoint, Distance
c_script_2 = CSharpScript(
    srf=srf,
    uv=srf_cp.UVPoint,
    stepSize=Slider(0.05, range=0..1),
    numSamples=Slider(3000, range=0..10000),
    Width=number_slider_4)  # -> out, CenterLineA, StripA, CenterLineB, StripB; inputs srf: Surface, uv: Point3d, stepSize: Double, numSamples: Int32, Width: Double
# ---------- c_script_2: C# ----------
    Curve C0, C1;
    Surface S0, S1;
    AsymptoticNetwork(srf, uv, stepSize, numSamples, Width, out C0, out C1, out S0, out S1);

    CenterLineA = C0;
    StripA = S0;
    CenterLineB = C1;
    StripB = S1;
# ---------- c_script_2: C# additional code ----------
  void AsymptoticNetwork(Surface srf, Point3d uv, double stepSize, int numSamples, double offset, out Curve C0, out Curve C1, out Surface S0, out Surface S1)
  {
    List<Point3d> d0_A = AsymptoticPath(srf, uv, stepSize, numSamples, true);
    List<Point3d> d0_B = AsymptoticPath(srf, uv, stepSize, numSamples, true, Math.PI);

    List<Point3d> d1_A = AsymptoticPath(srf, uv, stepSize, numSamples, false);
    List<Point3d> d1_B = AsymptoticPath(srf, uv, stepSize, numSamples, false, Math.PI);

    d0_A.RemoveAt(0);
    d0_A.Reverse();

    d0_A.AddRange(d0_B);

    d1_A.RemoveAt(0);
    d1_A.Reverse();

    d1_A.AddRange(d1_B);

    //C0 = new PolylineCurve(d0_A);
    //C1 = new PolylineCurve(d1_A);
    C0 = Curve.CreateInterpolatedCurve(d0_A, 3);
    C0.Rebuild(10, 3, true);
    C0.Domain = new Interval(0, 1);
    C1 = Curve.CreateInterpolatedCurve(d1_A, 3);
    C1.Rebuild(10, 3, true);
    C1.Domain = new Interval(0, 1);

    List<Point3d> tempA = new List<Point3d>();
    List<Point3d> tempB = new List<Point3d>();
    for(int i = 0; i < d0_A.Count;i++){
      Point3d p = d0_A[i];
      double u,v;
      srf.ClosestPoint(p, out u, out v);
      Vector3d n = srf.NormalAt(u, v);
      n.Unitize();
      n *= offset / 2;

      tempA.Add(p + n);
      tempB.Add(p - n);
    }

    Curve cc0 = new PolylineCurve(tempA);//Curve.CreateInterpolatedCurve(tempA, 3);
    //cc0.Rebuild(10, 3, true);
    Curve cc1 = new PolylineCurve(tempB);//Curve.CreateInterpolatedCurve(tempB, 3);
    //cc1.Rebuild(10, 3, true);

    S0 = NurbsSurface.CreateRuledSurface(cc0, cc1);

    tempA = new List<Point3d>();
    tempB = new List<Point3d>();
    for(int i = 0; i < d1_A.Count;i++){
      Point3d p = d1_A[i];
      double u,v;
      srf.ClosestPoint(p, out u, out v);
      Vector3d n = srf.NormalAt(u, v);
      n.Unitize();
      n *= offset/2;

      tempA.Add(p + n);
      tempB.Add(p - n);
    }

    cc0 = new PolylineCurve(tempA);//Curve.CreateInterpolatedCurve(tempA, 3);
    //cc0.Rebuild(10, 3, true);
    cc1 = new PolylineCurve(tempB);//Curve.CreateInterpolatedCurve(tempB, 3);
    //cc1.Rebuild(10, 3, true);

    S1 = NurbsSurface.CreateRuledSurface(cc0, cc1);
  }

  List<Point3d> AsymptoticPath(Surface srf, Point3d uv, double stepSize=0.01, int numSamples=1000, bool direction0=true, double angle=0)
  {
    Point3d oldUV = uv;
    Interval U = srf.Domain(0);
    Interval V = srf.Domain(1);

    List<Point3d> pathA = new List<Point3d>();

    while(pathA.Count < numSamples){

      //1. Get the curvature at the current point
      SurfaceCurvature crv = srf.CurvatureAt(oldUV.X, oldUV.Y);
      if(crv == null) break;

      //2. Add the current point to the path
      Point3d oldPt = srf.PointAt(oldUV.X, oldUV.Y);
      pathA.Add(oldPt);

      //3. Get the principal direction & values
      Vector3d dir = crv.Direction(0);
      double k1 = crv.Kappa(0);
      double k2 = crv.Kappa(1);

      //4. Calculate deviation angle based on PC-direction
      double alpha = (2 * Math.Atan(Math.Sqrt((2 * Math.Sqrt(k2 * ( -(k1 - k2))) + k1 - (2 * k2)) / k1)));

      //5. Switch direction and values for second direction
      if(!direction0)
      {
        dir = crv.Direction(1);
        k1 = crv.Kappa(1);
        k2 = crv.Kappa(0);
        alpha = (2 * Math.Atan(Math.Sqrt((-2 * Math.Sqrt(k2 * ( -(k1 - k2))) + k1 - (2 * k2)) / k1)));
      }

      //6. Check for anticlastic surfaces
      if(k1 * k2 > 0) break;

      //6. Rotate PC-direction to get A-direction
      dir.Rotate(angle + alpha, crv.Normal);

      //8. Check if the direction is valid
      if(!dir.IsValid || !dir.Unitize())break;

      //9. Scale the direction vector to a given size
      dir *= stepSize;

      //10. Flip the direction (in case it goes backwards)
      int N = pathA.Count;
      if(N > 1)
      {
        Vector3d oldDirection = oldPt - pathA[N - 2];
        if (dir.IsParallelTo(oldDirection, 0.5 * Math.PI) < 0)
        {
          dir.Reverse();
        }
      }

      //11. Compute the new point for the path
      Point3d newPt = oldPt + dir;
      double newU, newV;
      if(!srf.ClosestPoint(newPt, out newU, out newV)) break;

      //12. Check if the new point is within the current surface domain
      if(!U.IncludesParameter(newU, true) || !V.IncludesParameter(newV, true))break;

      //13. Check if the new and old point are not duplicated (within a given tolerance)
      if(Math.Abs(oldPt.X - newU) < 1e-12 && Math.Abs(oldPt.Y - newV) < 1e-12) break;

      //14. Set the old point as the new point
      oldUV.X = newU;
      oldUV.Y = newV;
    }
    return pathA;
  }
# ---------- end c_script_2 ----------
Y = UnitY(Factor=Slider(16.53, range=1..50))
ccx = CurveCurve(CurveA=graft(c_script_2.CenterLineA), CurveB=c_script_2.CenterLineB)  # -> simplify(Points), simplify(ParamsA), ParamsB
ccx_2 = CurveCurve(CurveA=graft(c_script_2.CenterLineB), CurveB=c_script_2.CenterLineA)  # -> Points, simplify(ParamsA), ParamsB
lng = ListLength(List=c_script_2.CenterLineA)
lng_2 = ListLength(List=c_script_2.CenterLineB)
path_mapper = PathMapper(ccx.ParamsA, source="{A;B}", target="{A}")
path_mapper_2 = PathMapper(ccx_2.ParamsA, source="{A;B}", target="{A}")
series = Series(Start=number_slider_4, Step=expr("x*2", number_slider_4), Count=lng)
series_2 = Series(Start=expr("x*-1", number_slider_4), Step=expr("x*-2", number_slider_4), Count=lng_2)
number_slider_5 = Slider(0.001, range=0..0.01)
pt = ConstructPoint(XCoordinate=series, YCoordinate=Y, ZCoordinate=0)
pt_2 = ConstructPoint(XCoordinate=series_2, YCoordinate=Y, ZCoordinate=0)
sort = SortList(Keys=path_mapper)  # -> Keys, ValuesA
sort_2 = SortList(Keys=path_mapper_2)  # -> Keys, ValuesA
neg = Negative(Value=number_slider_4)
c_script_3 = CSharpScript(
    Origin=graft(pt_2),
    param=sort_2.Keys,
    CenterLine=graft(c_script_2.CenterLineB),
    Offset=number_slider_5,
    Width=number_slider_4)  # -> out, Strip; inputs Origin: Point3d, param: list of Double, CenterLine: Curve, Offset: Double, Width: Double
# ---------- c_script_3: C# ----------
    double length = CenterLine.GetLength();
    Curve crv = new LineCurve(Origin, Origin + Vector3d.YAxis * length);
    crv.Domain = new Interval(0, 1);
    Curve crvA = crv.Offset(Plane.WorldXY, Width * 0.5, RhinoDoc.ActiveDoc.ModelAbsoluteTolerance, CurveOffsetCornerStyle.None)[0];
    crvA.Domain = new Interval(0, 1);

    List<Point3d> pts = new List<Point3d>();
    for(int i = 0; i < param.Count; i++){
      double t = param[i];
      if(i == 0 && t != 0){
        pts.Add(crvA.PointAt(0));
      }
      if(i == param.Count - 1 && t != 1)
      {
        pts.Add(crvA.PointAt(1));
      }
      else{
        double tL = t - Offset;
        if(tL < 0) tL = 0;
        double tR = t + Offset;
        if(tR > 1) tR = 1;

        if(tL > 0) pts.Add(crvA.PointAt(tL));
        pts.Add(crv.PointAt(tL));
        pts.Add(crv.PointAt(tR));
        if(tR < 1) pts.Add(crvA.PointAt(tR));
      }
    }

    pts.Add(crv.PointAt(1) - Vector3d.XAxis * (Width * 0.5));
    pts.Add(crv.PointAt(0) - Vector3d.XAxis * (Width * 0.5));
    pts.Add(pts[0]);
    Curve poly = new PolylineCurve(pts);
    Strip = poly;
# ---------- end c_script_3 ----------
c_script_4 = CSharpScript(Origin=graft(pt), param=sort.Keys, CenterLine=graft(c_script_2.CenterLineA), Offset=number_slider_5, Width=neg)  # -> out, Strip; inputs Origin: Point3d, param: list of Double, CenterLine: Curve, Offset: Double, Width: Double; same code as c_script_3
patch = Patch(Curves=c_script_3.Strip, Spans=20, Flexibility=1, Trim=True)
patch_2 = Patch(Curves=c_script_4.Strip, Spans=20, Flexibility=1, Trim=True)
merge = Merge(Data1=patch, Data2=c_script_2.StripB)
merge_2 = Merge(Data1=patch_2, Data2=c_script_2.StripA)
preview = CustomPreview(Geometry=flatten(merge), Material=ColourSwatch(SwatchColor=RGB(0, 81, 255)))
preview_2 = CustomPreview(Geometry=flatten(merge_2), Material=ColourSwatch(SwatchColor=RGB(255, 255, 255)))
number_slider_6 = Slider(0.5, range=0..1)
crv = Curve(c_script_2.CenterLineB)
crv_2 = Curve(c_script_2.CenterLineA)
young_s_modulus_gpa = Panel("12.4")
tensile_strength_mpa = Panel("31")
yield_strength_mpa = Panel("13.8")
c_script_5 = CSharpScript(Crv=crv_2, t=number_slider_6)  # -> out, Direction, Value, Points, Inflection_Points; inputs Crv: Curve, t: list of Double
# ---------- c_script_5: C# usings ----------
using System.Linq;
# ---------- c_script_5: C# ----------
Crv.Domain = new Interval(0,1);
List<Point3d> infl_pts = new List<Point3d>();

List<double> param = new List<double>(t);
if(!param.Contains(0.0)) param.Add(0.0);
if(!param.Contains(1.0)) param.Add(1.0);

if(infl_pts!=null){
    foreach(Point3d p in infl_pts){
        double tt;
        Crv.ClosestPoint(p, out tt);
        param.Add(tt);
    }
}

param.Sort();

List<Vector3d> dir = new List<Vector3d>();
List<double> val = new List<double>();
List<Point3d> pts =new List<Point3d>();
for(int i=1; i<param.Count-1; i++){
    Vector3d v = Crv.CurvatureAt(param[i]);
    dir.Add(v);
    val.Add(v.Length);
    pts.Add(Crv.PointAt(param[i]));
}

Direction = dir;
Value = val;
Points = pts;
Inflection_Points = infl_pts;
# ---------- end c_script_5 ----------
c_script_6 = CSharpScript(Crv=crv, t=number_slider_6)  # -> out, Direction, Value, Points, Inflection_Points; inputs Crv: Curve, t: list of Double; same code as c_script_5
multiplication = Multiplication(A=young_s_modulus_gpa, B=1000)
merge_3 = Merge(Data1=c_script_5.Direction, Data2=c_script_6.Direction)
merge_4 = Merge(Data1=c_script_5.Value, Data2=c_script_6.Value)
merge_5 = Merge(Data1=c_script_5.Points, Data2=c_script_6.Points)
c_script_7 = CSharpScript(E=multiplication, Height=Slider(0.05, range=0..0.1), Yield_Strength=yield_strength_mpa)  # -> out, Ix, Iy, Rmin; inputs E: Double, Height: Double, Yield_Strength: Double
# ---------- c_script_7: C# ----------
Rmin = (2 * Yield_Strength) / (E * Height);
# ---------- end c_script_7 ----------
multiplication_2 = Multiplication(A=merge_3, B=Slider(50, range=1..50))
panel = Panel(c_script_7.Rmin)
vdis = VectorDisplay(Anchor=merge_5, Vector=multiplication_2)
tag = TextTag(Location=merge_5, Text=merge_4, Colour=ColourSwatch(SwatchColor=RGB(0, 255, 255)))
