# Grasshopper definition CGeomTest.gh (Grasshopper 1.0.7)
# plug-ins: CGeomGH Info, Weaverbird

crv = Curve(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)
patch = Patch(Curves=crv, Spans=20, Flexibility=1, Trim=True)
mesh = MeshBrep(
    Brep=patch,
    Settings={GridMaxCount=0, GridMinCount=16, JaggedSeams=False, MaxEdgeLength=0, MinEdgeLength=0.0001, MinTolerance=0, Refine=True, RefineAngle=0, RelativeTolerance=0.65, SimplePlanes=True, Tolerance=0})
tri = Triangulate(Mesh=mesh)  # -> Mesh, Count
pc = PrincipalCurvatures(Mesh=mesh)  # -> Val1, Val2, Dir1, Dir2
wbvertices = WeaverbirdsVerticesComponent(MeshClosedPolylinesGroup=mesh, Weld=True)
srf_cp = SurfaceClosestPoint(Point=wbvertices, Surface=patch)  # -> Point, UVPoint, Distance
vdis = VectorDisplay(Anchor=wbvertices, Vector=pc.Dir1)
vdis_2 = VectorDisplay(Anchor=wbvertices, Vector=pc.Dir2)
curvature = PrincipalCurvature(Surface=patch, Point=srf_cp.UVPoint)  # -> Frame, Maximum, Minimum, MaxDirection, MinDirection
vdis_3 = VectorDisplay(Anchor=wbvertices, Vector=curvature.MaxDirection)
vdis_4 = VectorDisplay(Anchor=wbvertices, Vector=curvature.MinDirection)
panel = Panel(curvature.Minimum)
