# Grasshopper definition CGeom_Test.gh (Grasshopper 1.0.7)
# plug-ins: IguanaMesh, CGeomGH Info

number_slider = Slider(1, range=0..10)
srf = Surface(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)
ilineartria = ILinearTria(
    MinimumSize=number_slider,
    MaximunSize=number_slider,
    CurvatureAdapt=False,
    MininimumElements=6,
    SmoothingSteps=10,
    RightAngles=False,
    Massive_Refinement=False)
ipatchsrf = IPatchSurface(Surface=srf, ISettings=ilineartria)  # -> IMesh, Entities, Info
nickname = PerVertexNormalsGH(Mesh=ipatchsrf.IMesh)
ivertices = IVertices(IMesh=ipatchsrf.IMesh)
pc = PrincipalCurvatures(Mesh=ipatchsrf.IMesh)  # -> Val1, Val2, Dir1, Dir2
nickname_2 = MeanCurvatureGH(Mesh=ipatchsrf.IMesh)
nickname_3 = GaussianCurvatureGH(Mesh=ipatchsrf.IMesh)
bnd = Bounds(Numbers=nickname_2)
vdis = VectorDisplay(Anchor=ivertices, Vector=nickname)
dedomain = DeconstructDomain(Domain=bnd)  # -> Start, End
gradient = Gradient(
    LowerLimit=dedomain.Start,
    UpperLimit=dedomain.End,
    Parameter=nickname_2,
    stops=[0: RGB(234, 38, 0), 0.25: RGB(234, 126, 0), 0.5: RGB(254, 244, 84), 0.75: RGB(173, 203, 249), 1: RGB(75, 107, 169)])
vdisex = VectorDisplayEx(Point=ivertices, Vector=pc.Dir2, Colour=ColourSwatch(SwatchColor=RGB(255, 254, 254)), Width=2)
vdisex_2 = VectorDisplayEx(Point=ivertices, Vector=pc.Dir1, Colour=ColourSwatch(SwatchColor=RGB(136, 255, 0)), Width=2)
mcol = MeshColours(Mesh=ipatchsrf.IMesh, Colours=gradient)
