# Grasshopper definition Elastica.gh (Grasshopper 1.0.7)
# plug-ins: sof_gh_sofistik_rhino

io = IO(
    SofistikDocumentProperties_VersionMajor="2020",
    SofistikDocumentProperties_VersionMinor="8",
    SofistikDocumentProperties_VersionName="Rhino-Interface")

# ----
# Reference vector
# Supports
# Distance between supports
pt = Point(Point(5, 0, 0))
pt_2 = Point(Point(0, 0, 0))
Z = UnitZ(Factor=1)

# ----
# Extension lengths
number_slider = Slider(9, range=0..10)

dist = Distance(PointA=pt_2, PointB=pt)
multiplication = Multiplication(A=dist, B=Slider(0.3, range=0..1))
c_script = CSharpScript(PtA=pt_2, PtB=pt, Normal=Z, Width=multiplication, DistA=number_slider, DistB=Slider(7, range=0..10))  # -> out, Crv, LnA, LnB; inputs PtA: Point3d, PtB: Point3d, Normal: Vector3d, Width: Double, DistA: Double, DistB: Double
# ---------- c_script: C# usings ----------
using System.IO;
using System.Linq;
using System.Data;
using System.Drawing;
using System.Reflection;
using System.Windows.Forms;
using System.Xml;
using System.Xml.Linq;
using System.Runtime.InteropServices;

using Rhino.DocObjects;
using Rhino.Collections;
using GH_IO;
using GH_IO.Serialization;
# ---------- c_script: C# ----------
    Elastica e = new Elastica(PtA, PtB, Normal, Width);
    Curve c = e.Crv;
    c.Domain = new Interval(0, 1);
    Vector3d v1 = c.TangentAt(0);
    Vector3d v2 = c.TangentAt(1);

    //Add ends
    Point3d PtAA = c.PointAtStart - v1 * DistA;
    Line lnA = new Line(c.PointAtStart, PtAA);
    Point3d PtBB = c.PointAtEnd + v2 * DistB;
    Line lnB = new Line(c.PointAtEnd, PtBB);

    Crv = c;
    LnA = lnA;
    LnB = lnB;
# ---------- c_script: C# additional code ----------
  public class Elastica{
    private double length, height, angle, m, width;
    private Plane refPln;
    private List<Point3d> Pts;
    public Curve Crv;

    public Elastica(Point3d PtA, Point3d PtB, Vector3d normal, double width){
      Vector3d vec = (PtB - PtA) * 0.5;
      Point3d mid = PtA + vec;
      Point3d Proj = PtA + normal;

      refPln = new Plane(mid, PtB, Proj);

      //Initialize variables
      this.width = width;
      this.length = PtA.DistanceTo(PtB);

      UpdateParam();
      run();
    }

    private void UpdateParam(){
      if(width == length){
        height = 0;
        m = 0;
        angle = 0;
      }else{
        SolveM();
        height = length * Math.Sqrt(m) / EllipticK(m);
        angle = Math.Acos(1 - 2 * m);
      }
    }

    private void SolveM(){
      if(width == 0.0) m = 0.826114765984970336;
      else{
        double lower = 0;
        double upper = 1;
        double cwl = 0;
        m = 0;

        for(int n = 0; n < 100; n++){
          if((upper - lower) > 1e-9){

            m = (upper + lower) / 2;
            cwl = 2 * EllipticE(m) / EllipticK(m) - 1;
            if(cwl < (width / length)) upper = m;
            else lower = m;
          }
        }
      }
    }


    public void run(){
      FindBendForm();
      MakeCurve();
    }

    private void FindBendForm(){

      double L = length / 2;
      double W = width / 2;
      Pts = new List<Point3d>();

      if(angle == 0){
        Pts.Add(refPln.PointAt(-W, 0, 0));
        Pts.Add(refPln.PointAt(W, 0, 0));
        //Pts.Add(refPln.PointAt(-W, 0, 0));
      }else{

        double x, y;
        List<Point3d> halfCurvePts = new List<Point3d>();
        List<Point3d> fullCurvePts = new List<Point3d>();

        double ang = angle - Math.PI / 2;
        double angB = ang + (-Math.PI / 2 - ang) / 50;
        halfCurvePts.Add(new Point3d(W, 0, 0));

        while(Math.Round(angB, 10) >= Math.Round(-Math.PI / 2, 10)){

          y = (Math.Sqrt(2) * Math.Sqrt(Math.Sin(ang) - Math.Sin(angB)) * (W + L)) / (2 * EllipticE(m));
          x = (L / (Math.Sqrt(2) * EllipticK(m))) * Simpson(angB, -Math.PI / 2, 500, ang);

          if(Math.Round(x, 10) == 0) x = 0;

          halfCurvePts.Add(new Point3d(x, y, 0));

          angB += (-Math.PI / 2 - ang) / 50;
        }

        foreach(Point3d point in halfCurvePts){
          if(Math.Round(point.X, 10) == 0){
            if(Math.Round(point.Y, 10) == 0){
              fullCurvePts.Add(new Point3d(0, 0, 0));
            }
          }else{
            fullCurvePts.Add(new Point3d(-point.X, point.Y, 0));
          }
        }

        halfCurvePts.Reverse();
        fullCurvePts.AddRange(halfCurvePts);

        foreach(Point3d p in fullCurvePts){
          Pts.Add(refPln.PointAt(p.X, p.Y, p.Z));
        }
      }
    }

    private void MakeCurve(){
      if(angle != 0){
        Vector3d ts = new Vector3d(refPln.XAxis);
        Vector3d te = new Vector3d(refPln.XAxis);
        ts.Rotate(angle, refPln.ZAxis);
        te.Rotate(-angle, refPln.ZAxis);
        Crv = Curve.CreateInterpolatedCurve(Pts, 3, CurveKnotStyle.Chord, ts, te);
      }
      else Crv = Curve.CreateInterpolatedCurve(Pts, 3);
    }

    private double Simpson(double a, double b, int n, double theta){
      double s1, s2,h;

      h = (b - a) / n;
      s1 = 0;
      s2 = 0;
      for(int j = 1; j < n; j += 2){
        double x = a + j * h;
        s1 = s1 + (Math.Sin(x) / (Math.Sqrt(Math.Sin(theta) - Math.Sin(x))));
      }
      for(int j = 2; j < n - 1; j += 2){
        double x = a + j * h;
        s2 = s2 + (Math.Sin(x) / (Math.Sqrt(Math.Sin(theta) - Math.Sin(x))));
      }

      return h / 3 * ((Math.Sin(a) / (Math.Sqrt(Math.Sin(theta) - Math.Sin(a)))) + 4 * s1 + 2 * s2 + (Math.Sin(b) / (Math.Sqrt(Math.Sin(theta) - Math.Sin(b)))));
    }

    private double EllipticK(double m){
      double sum = 1, term = 1, above = 1, below = 2;

      for(int i = 1; i <= 100; i++){
        term *= above / below;
        sum += Math.Pow(m, i) * Math.Pow(term, 2);
        above += 2;
        below += 2;
      }
      sum *= 0.5 * Math.PI;
      return sum;
    }

    private double EllipticE(double m){
      double sum=1, term = 1, above = 1, below = 2;

      for(int i = 1; i <= 100; i++){
        term *= above / below;
        sum -= Math.Pow(m, i) * Math.Pow(term, 2) / above;
        above += 2;
        below += 2;
      }
      sum *= 0.5 * Math.PI;
      return sum;
    }
  }

  public double ComputeLength(Line ln, Polyline crv){
    Point3d p1 = ln.PointAt(0);
    Point3d p2 = ln.PointAt(1);

    if(crv.Contains(p1) && crv.Contains(p2)){
      int idx1 = crv.IndexOf(p1);
      int idx2 = crv.IndexOf(p2);

      if(idx2 < idx1){
        idx1 = crv.IndexOf(p2);
        idx2 = crv.IndexOf(p1);
      }

      int count = idx2 - idx1;

      List<Point3d> pts = new List<Point3d>();
      double dist = 0;
      for(int i = 0; i < count; i++){
        pts.Add(crv[idx1 + i]);
        dist += crv[idx1 + i].DistanceTo(crv[idx1 + i + 1]);
      }
      return dist;
    }
    else return -1;
  }
# ---------- end c_script ----------
crv = Curve(c_script.Crv)
c_script_2 = CSharpScript(Count=Slider(11, range=0..20), Offset=Slider(0.007, range=0.001..0.2))  # -> out, T, TT; inputs Count: Int32, Offset: Double
# ---------- c_script_2: C# ----------
    List<double> t = new List<double>();
    List<double> tO = new List<double>();
    double param = 1.0 / (Count - 1);

    for(int i = 0; i < Count; i++){
      double tt = i * param;
      double t0 = tt - Offset;
      double t1 = tt + Offset;

      if(i != 0 && i != Count - 1) tO.Add(t0);
      if(i != Count - 1 && i != 0) tO.Add(t1);
      t.Add(tt);
      if(i == 0 || i == Count - 1) tO.Add(tt);
    }

    T = t;
    TT = tO;
# ---------- end c_script_2 ----------
eval = EvaluateCurve(Curve=crv, Parameter=c_script_2.T)  # -> Point, Tangent, Angle
eval_2 = EvaluateCurve(Curve=crv, Parameter=c_script_2.TT)  # -> Point, Tangent, Angle

# ----
# Reference vector
# Supports
# Distance between supports
pt_3 = Point(Point(0, 0, 0))
pt_4 = Point(Point(5, 0, 0))
Z_2 = UnitZ(Factor=1)

# ----
# Extension lengths
number_slider_2 = Slider(9, range=0..10)

c_script_3 = CSharpScript(pts=eval_2.Point, InvertZ=Toggle(True), Size=Slider(0.09, range=0..1))  # -> out, X, Y, Z; inputs pts: list of Vector3d, InvertZ: Boolean, Size: Double
# ---------- c_script_3: C# ----------
    Vector3d[] uX = computeUnitX(pts, Size);
    Vector3d[] uY = computeUnitY(uX, InvertZ, Size);
    Vector3d[] uZ = computeUnitZ(uX, uY, Size);
    X = uX;
    Y = uY;
    Z = uZ;
# ---------- c_script_3: C# additional code ----------
  public Vector3d[] computeUnitX(List<Vector3d> pts, double size){
    Vector3d[] unitX = new Vector3d[pts.Count - 1];
    for(int i = 0; i < pts.Count - 1; i++){
      Vector3d v = Vector3d.Subtract(pts[i + 1], pts[i]);
      v.Unitize();
      unitX[i] = v * size;
    }
    return unitX;
  }

  public Vector3d[] computeUnitY(Vector3d[] unitX, bool invertZ, double size){
    Vector3d z = new Vector3d(0, 0, 1);
    if(invertZ) z = new Vector3d(0, 0, -1);

    Vector3d[] unitY = new Vector3d[unitX.Length];
    Vector3d old = new Vector3d(0, 0, 0);
    for(int i = 0; i < unitX.Length; i++){
      Vector3d v = Vector3d.CrossProduct(new Vector3d(1, 0, 0), unitX[i]);
      if(v.Length == 0) v = Vector3d.CrossProduct(z, unitX[i]);
      v.Unitize();
      if(i != 0){
        double dot = v * old;
        if(dot < 0) v.Reverse();
      }
      unitY[i] = v * size;
      old = v;
    }
    return unitY;
  }

  public Vector3d[] computeUnitZ(Vector3d[] unitX, Vector3d[] unitY, double size){
    Vector3d[] unitZ = new Vector3d[unitX.Length];
    for(int i = 0; i < unitX.Length; i++){
      Vector3d v = Vector3d.CrossProduct(unitX[i], unitY[i]);
      v.Unitize();
      unitZ[i] = v * size;
    }
    return unitZ;
  }
# ---------- end c_script_3 ----------
c_script_4 = CSharpScript(pts=eval.Point, InvertZ=Toggle(True), Size=Slider(0.04, range=0..1))  # -> out, X, Y, Z; inputs pts: list of Vector3d, InvertZ: Boolean, Size: Double; same code as c_script_3
dist_2 = Distance(PointA=pt_3, PointB=pt_4)
addition = Addition(A=eval_2.Point, B=c_script_3.Z)
multiplication_2 = Multiplication(A=dist_2, B=Slider(1, range=0..1))
shift = ShiftList(List=eval_2.Point, Shift=1, Wrap=False)
dispatch = Dispatch(List=addition, DispatchPattern=[True, False])  # -> ListA, ListB
shift_2 = ShiftList(List=c_script_3.Z, Shift=1, Wrap=False)
pt_5 = Point(dispatch.ListB)
lng = ListLength(List=shift)
pt_6 = Point(dispatch.ListA)
c_script_5 = CSharpScript(PtA=pt_3, PtB=pt_4, Normal=Z_2, Width=multiplication_2, DistA=number_slider_2, DistB=Slider(7, range=0..10))  # -> out, Crv, LnA, LnB; inputs PtA: Point3d, PtB: Point3d, Normal: Vector3d, Width: Double, DistA: Double, DistB: Double; same code as c_script
split = SplitList(List=shift, Index=expr("x-1", lng))  # -> flatten(ListA), ListB
ln = Line(StartPoint=pt_6, EndPoint=pt_5)
ln_2 = Line(StartPoint=eval_2.Point, EndPoint=addition)
shift_3 = ShiftList(List=eval_2.Point, Shift=1, Wrap=False)
crv_2 = Curve(c_script_5.Crv)
c_script_6 = CSharpScript(Count=Slider(11, range=0..20), Offset=Slider(0.007, range=0.001..0.2))  # -> out, T, TT; inputs Count: Int32, Offset: Double; same code as c_script_2
lng_2 = ListLength(List=shift_3)
vdisex = VectorDisplayEx(Point=eval.Point, Vector=c_script_4.Y, Colour=ColourSwatch(SwatchColor=RGB(49, 247, 0)), Width=2)
vdisex_2 = VectorDisplayEx(Point=eval.Point, Vector=c_script_4.Z, Colour=ColourSwatch(SwatchColor=RGB(0, 74, 247)), Width=2)
vdisex_3 = VectorDisplayEx(Point=eval.Point, Vector=c_script_4.X, Colour=ColourSwatch(SwatchColor=RGB(247, 0, 0)), Width=2)
vdisex_4 = VectorDisplayEx(Point=split.ListA, Vector=shift_2, Colour=ColourSwatch(SwatchColor=RGB(0, 74, 247)), Width=2)
split_2 = SplitList(List=shift_3, Index=expr("x-1", lng_2))  # -> flatten(ListA), ListB
multiplication_3 = Multiplication(A=c_script_4.Z, B=Slider(0.6, range=0..1))
eval_3 = EvaluateCurve(Curve=crv_2, Parameter=c_script_6.TT)  # -> Point, Tangent, Angle
dispatch_2 = Dispatch(List=split_2.ListA, DispatchPattern=[True, False])  # -> graft(ListA), graft(ListB)
addition_2 = Addition(A=eval.Point, B=c_script_4.Z)
addition_3 = Addition(A=eval.Point, B=multiplication_3)
shift_4 = ShiftList(List=addition_3, Shift=1, Wrap=False)
merge = Merge(Data1=dispatch_2.ListA, Data2=dispatch_2.ListB)  # -> simplify(Result)
lng_3 = ListLength(List=shift_4)
c_script_7 = CSharpScript(pts=eval_3.Point, InvertZ=Toggle(True), Size=Slider(0.09, range=0..1))  # -> out, X, Y, Z; inputs pts: list of Vector3d, InvertZ: Boolean, Size: Double; same code as c_script_3
split_3 = SplitList(List=shift_4, Index=expr("x-1", lng_3))  # -> simplify(graft(ListA)), ListB
pt_7 = Point(split_3.ListA)
vec2pt = Vector2Pt(PointA=merge, PointB=pt_7, Unitize=False)  # -> Vector, Length
shift_5 = ShiftList(List=addition_2, Shift=1, Wrap=False)
flatten = FlattenTree(Tree=vec2pt.Vector, Path="{0}")
xz = XZPlane(Origin=Point(0, 0, 0))
shift_6 = ShiftList(List=eval_3.Point, Shift=1, Wrap=False)
short = ShortestList(ListA=addition_2, ListB=shift_5, TrimMode=2)  # -> ListA, ListB
shift_7 = ShiftList(List=c_script_7.Z, Shift=1, Wrap=False)
ln_3 = Line(StartPoint=addition_2, EndPoint=addition_3)
lng_4 = ListLength(List=shift_6)
angle = Angle(VectorA=flatten, VectorB=shift_2, Plane=xz)  # -> simplify(Angle), Reflex
ln_4 = Line(StartPoint=short.ListA, EndPoint=shift_5)
split_4 = SplitList(List=shift_6, Index=expr("x-1", lng_4))  # -> flatten(ListA), ListB
vec2pt_2 = Vector2Pt(PointA=addition_3, PointB=addition_2, Unitize=False)  # -> Vector, Length
rev = Reverse(Vector=xz)
shift_8 = ShiftList(List=vec2pt_2.Vector, Shift=1, Wrap=False)
vdisex_5 = VectorDisplayEx(Point=split_4.ListA, Vector=shift_7, Colour=ColourSwatch(SwatchColor=RGB(0, 74, 247)), Width=2)
lng_5 = ListLength(List=shift_8)
vrot = Rotate(Vector=shift_7, Axis=rev, Angle=angle.Angle)
split_5 = SplitList(List=shift_8, Index=expr("x-1", lng_5))  # -> simplify(graft(ListA)), ListB
vlen = VectorLength(Vector=vec2pt.Vector)  # -> flatten(Length)
amp = Amplitude(Vector=vrot, Amplitude=vlen)
addition_4 = Addition(A=split_4.ListA, B=amp)
dispatch_3 = Dispatch(List=addition_4, DispatchPattern=[True, False])  # -> graft(ListA), graft(ListB)
merge_2 = Merge(Data1=dispatch_3.ListA, Data2=dispatch_3.ListB)  # -> simplify(Result)
addition_5 = Addition(A=merge_2, B=split_5.ListA)
graft = GraftTree(Tree=flatten(addition_5), IncludeEmptyLists=True, IncludeNullItems=True)  # -> simplify(Tree)
graft_2 = GraftTree(Tree=flatten(merge_2), IncludeEmptyLists=True, IncludeNullItems=True)  # -> simplify(Tree)
pt_8 = Point(simplify(graft(split_4.ListA)))
# Old
ln_5 = Line(StartPoint=addition_5, EndPoint=merge_2)
merge_3 = Merge(Data1=graft, Data2=graft_2, Data3=pt_8)
pline = PolyLine(Vertices=merge_3, Closed=False)
