# Grasshopper definition Test01.gh (Grasshopper 1.0.7)
# plug-ins: sof_gh_sofistik_rhino

io = IO(
    SofistikDocumentProperties_VersionMajor="2020",
    SofistikDocumentProperties_VersionMinor="8",
    SofistikDocumentProperties_VersionName="Rhino-Interface")

# ----
# Reference vector
# Supports
# Distance between supports
pt = Point(Point(5, 0, 0))
pt_2 = Point(Point(0, 0, 0))
Z = UnitZ(Factor=1)

dist = Distance(PointA=pt_2, PointB=pt)
multiplication = Multiplication(A=dist, B=Slider(0.4, range=0..1))
c_script = CSharpScript(PtA=pt_2, PtB=pt, Normal=Z, Width=multiplication, DistA=Slider(9, range=0..10), DistB=Slider(7, range=0..10))  # -> out, Crv, LnA, LnB; inputs PtA: Point3d, PtB: Point3d, Normal: Vector3d, Width: Double, DistA: Double, DistB: Double
# ---------- c_script: C# usings ----------
using System.IO;
using System.Linq;
using System.Data;
using System.Drawing;
using System.Reflection;
using System.Windows.Forms;
using System.Xml;
using System.Xml.Linq;
using System.Runtime.InteropServices;

using Rhino.DocObjects;
using Rhino.Collections;
using GH_IO;
using GH_IO.Serialization;
# ---------- c_script: C# ----------
    Elastica e = new Elastica(PtA, PtB, Normal, Width);
    Curve c = e.Crv;
    c.Domain = new Interval(0, 1);
    Vector3d v1 = c.TangentAt(0);
    Vector3d v2 = c.TangentAt(1);

    //Add ends
    Point3d PtAA = c.PointAtStart - v1 * DistA;
    Line lnA = new Line(c.PointAtStart, PtAA);
    Point3d PtBB = c.PointAtEnd + v2 * DistB;
    Line lnB = new Line(c.PointAtEnd, PtBB);

    Crv = c;
    LnA = lnA;
    LnB = lnB;
# ---------- c_script: C# additional code ----------
  public class Elastica{
    private double length, height, angle, m, width;
    private Plane refPln;
    private List<Point3d> Pts;
    public Curve Crv;

    public Elastica(Point3d PtA, Point3d PtB, Vector3d normal, double width){
      Vector3d vec = (PtB - PtA) * 0.5;
      Point3d mid = PtA + vec;
      Point3d Proj = PtA + normal;

      refPln = new Plane(mid, PtB, Proj);

      //Initialize variables
      this.width = width;
      this.length = PtA.DistanceTo(PtB);

      UpdateParam();
      run();
    }

    private void UpdateParam(){
      if(width == length){
        height = 0;
        m = 0;
        angle = 0;
      }else{
        SolveM();
        height = length * Math.Sqrt(m) / EllipticK(m);
        angle = Math.Acos(1 - 2 * m);
      }
    }

    private void SolveM(){
      if(width == 0.0) m = 0.826114765984970336;
      else{
        double lower = 0;
        double upper = 1;
        double cwl = 0;
        m = 0;

        for(int n = 0; n < 100; n++){
          if((upper - lower) > 1e-9){

            m = (upper + lower) / 2;
            cwl = 2 * EllipticE(m) / EllipticK(m) - 1;
            if(cwl < (width / length)) upper = m;
            else lower = m;
          }
        }
      }
    }


    public void run(){
      FindBendForm();
      MakeCurve();
    }

    private void FindBendForm(){

      double L = length / 2;
      double W = width / 2;
      Pts = new List<Point3d>();

      if(angle == 0){
        Pts.Add(refPln.PointAt(-W, 0, 0));
        Pts.Add(refPln.PointAt(W, 0, 0));
        //Pts.Add(refPln.PointAt(-W, 0, 0));
      }else{

        double x, y;
        List<Point3d> halfCurvePts = new List<Point3d>();
        List<Point3d> fullCurvePts = new List<Point3d>();

        double ang = angle - Math.PI / 2;
        double angB = ang + (-Math.PI / 2 - ang) / 50;
        halfCurvePts.Add(new Point3d(W, 0, 0));

        while(Math.Round(angB, 10) >= Math.Round(-Math.PI / 2, 10)){

          y = (Math.Sqrt(2) * Math.Sqrt(Math.Sin(ang) - Math.Sin(angB)) * (W + L)) / (2 * EllipticE(m));
          x = (L / (Math.Sqrt(2) * EllipticK(m))) * Simpson(angB, -Math.PI / 2, 500, ang);

          if(Math.Round(x, 10) == 0) x = 0;

          halfCurvePts.Add(new Point3d(x, y, 0));

          angB += (-Math.PI / 2 - ang) / 50;
        }

        foreach(Point3d point in halfCurvePts){
          if(Math.Round(point.X, 10) == 0){
            if(Math.Round(point.Y, 10) == 0){
              fullCurvePts.Add(new Point3d(0, 0, 0));
            }
          }else{
            fullCurvePts.Add(new Point3d(-point.X, point.Y, 0));
          }
        }

        halfCurvePts.Reverse();
        fullCurvePts.AddRange(halfCurvePts);

        foreach(Point3d p in fullCurvePts){
          Pts.Add(refPln.PointAt(p.X, p.Y, p.Z));
        }
      }
    }

    private void MakeCurve(){
      if(angle != 0){
        Vector3d ts = new Vector3d(refPln.XAxis);
        Vector3d te = new Vector3d(refPln.XAxis);
        ts.Rotate(angle, refPln.ZAxis);
        te.Rotate(-angle, refPln.ZAxis);
        Crv = Curve.CreateInterpolatedCurve(Pts, 3, CurveKnotStyle.Chord, ts, te);
      }
      else Crv = Curve.CreateInterpolatedCurve(Pts, 3);
    }

    private double Simpson(double a, double b, int n, double theta){
      double s1, s2,h;

      h = (b - a) / n;
      s1 = 0;
      s2 = 0;
      for(int j = 1; j < n; j += 2){
        double x = a + j * h;
        s1 = s1 + (Math.Sin(x) / (Math.Sqrt(Math.Sin(theta) - Math.Sin(x))));
      }
      for(int j = 2; j < n - 1; j += 2){
        double x = a + j * h;
        s2 = s2 + (Math.Sin(x) / (Math.Sqrt(Math.Sin(theta) - Math.Sin(x))));
      }

      return h / 3 * ((Math.Sin(a) / (Math.Sqrt(Math.Sin(theta) - Math.Sin(a)))) + 4 * s1 + 2 * s2 + (Math.Sin(b) / (Math.Sqrt(Math.Sin(theta) - Math.Sin(b)))));
    }

    private double EllipticK(double m){
      double sum = 1, term = 1, above = 1, below = 2;

      for(int i = 1; i <= 100; i++){
        term *= above / below;
        sum += Math.Pow(m, i) * Math.Pow(term, 2);
        above += 2;
        below += 2;
      }
      sum *= 0.5 * Math.PI;
      return sum;
    }

    private double EllipticE(double m){
      double sum=1, term = 1, above = 1, below = 2;

      for(int i = 1; i <= 100; i++){
        term *= above / below;
        sum -= Math.Pow(m, i) * Math.Pow(term, 2) / above;
        above += 2;
        below += 2;
      }
      sum *= 0.5 * Math.PI;
      return sum;
    }
  }

  public double ComputeLength(Line ln, Polyline crv){
    Point3d p1 = ln.PointAt(0);
    Point3d p2 = ln.PointAt(1);

    if(crv.Contains(p1) && crv.Contains(p2)){
      int idx1 = crv.IndexOf(p1);
      int idx2 = crv.IndexOf(p2);

      if(idx2 < idx1){
        idx1 = crv.IndexOf(p2);
        idx2 = crv.IndexOf(p1);
      }

      int count = idx2 - idx1;

      List<Point3d> pts = new List<Point3d>();
      double dist = 0;
      for(int i = 0; i < count; i++){
        pts.Add(crv[idx1 + i]);
        dist += crv[idx1 + i].DistanceTo(crv[idx1 + i + 1]);
      }
      return dist;
    }
    else return -1;
  }
# ---------- end c_script ----------
c_script_2 = CSharpScript(Count=Slider(11, range=0..20), Offset=Slider(0.001, range=0.001..0.2))  # -> out, T, TT; inputs Count: Int32, Offset: Double
# ---------- c_script_2: C# ----------
    List<double> t = new List<double>();
    List<double> tO = new List<double>();
    double param = 1.0 / (Count - 1);

    for(int i = 0; i < Count; i++){
      double tt = i * param;
      double t0 = tt - Offset;
      double t1 = tt + Offset;

      if(i != 0 && i != Count - 1) tO.Add(t0);
      if(i != Count - 1 && i != 0) tO.Add(t1);
      t.Add(tt);
      if(i == 0 || i == Count - 1) tO.Add(tt);
    }

    T = t;
    TT = tO;
# ---------- end c_script_2 ----------
crv = Curve(c_script.Crv)

# ----
# Reference vector
# Supports
# Distance between supports
pt_3 = Point(Point(5, 0, 0))
pt_4 = Point(Point(0, 0, 0))
Z_2 = UnitZ(Factor=1)

eval = EvaluateCurve(Curve=crv, Parameter=c_script_2.TT)  # -> Point, Tangent, Angle
shift = ShiftList(List=eval.Point, Shift=1, Wrap=False)
dist_2 = Distance(PointA=pt_4, PointB=pt_3)
lng = ListLength(List=shift)
multiplication_2 = Multiplication(A=dist_2, B=Slider(0.4, range=0..1))
dispatch = Dispatch(List=eval.Point, DispatchPattern=[True, False])  # -> simplify(graft(ListA)), simplify(graft(ListB))
Y = UnitY(Factor=-1)
split = SplitList(List=shift, Index=expr("x-1", lng))  # -> ListA, ListB
number_slider = Slider(0.03, range=0.01..0.2)
dispatch_2 = Dispatch(List=split.ListA, DispatchPattern=[True, False])  # -> graft(ListA), graft(ListB)
vec2pt = Vector2Pt(PointA=dispatch.ListA, PointB=dispatch.ListB, Unitize=False)  # -> Vector, Length
c_script_3 = CSharpScript(PtA=pt_4, PtB=pt_3, Normal=Z_2, Width=multiplication_2, DistA=Slider(9, range=0..10), DistB=Slider(7, range=0..10))  # -> out, Crv, LnA, LnB; inputs PtA: Point3d, PtB: Point3d, Normal: Vector3d, Width: Double, DistA: Double, DistB: Double; same code as c_script
xz = XZPlane(Origin=Point(0, 0, 0))
vec2pt_2 = Vector2Pt(PointA=dispatch_2.ListA, PointB=dispatch_2.ListB, Unitize=False)  # -> flatten(Vector), Length
xprod = CrossProduct(VectorA=vec2pt.Vector, VectorB=Y, Unitize=True)  # -> Vector, Length
multiplication_3 = Multiplication(A=xprod.Vector, B=number_slider)
xprod_2 = CrossProduct(VectorA=vec2pt_2.Vector, VectorB=Y, Unitize=True)  # -> Vector, Length
multiplication_4 = Multiplication(A=vec2pt_2.Vector, B=0.5)
crv_2 = Curve(c_script_3.Crv)
lng_2 = ListLength(List=eval.Point)
dup = DuplicateData(Data=multiplication_3, Number=2, Order=True)  # -> flatten(Data)
offset = OffsetCurve(Curve=crv_2, Distance=expr("x*-1", Slider(0.02, range=0.01..0.1)), Plane=xz, Corners=1)
dom = ConstructDomain(DomainStart=1, DomainEnd=expr("x-2", lng_2))
multiplication_5 = Multiplication(A=Y, B=Slider(0.05, range=0..1))
addition = Addition(A=flatten(dispatch_2.ListA), B=multiplication_4)
multiplication_6 = Multiplication(A=xprod_2.Vector, B=number_slider)
end = EndPoints(Curve=offset)  # -> Start, End
end_2 = EndPoints(Curve=crv_2)  # -> Start, End
ln = Line(StartPoint=end_2.Start, EndPoint=end.Start)
ln_2 = Line(StartPoint=end_2.End, EndPoint=end.End)
addition_2 = Addition(A=addition, B=multiplication_6)
join = JoinCurves(Curves=flatten([crv_2, ln, ln_2, offset]), Preserve=False)
eval_2 = EvaluateCurve(Curve=crv_2, Parameter=c_script_2.TT)  # -> Point, Tangent, Angle
subset = SubList(List=eval.Point, Domain=dom, Wrap=True)  # -> List, Index
subset_2 = SubList(List=dup, Domain=dom, Wrap=True)  # -> List, Index
dup_2 = DuplicateData(Data=graft(addition_2), Number=2, Order=True)  # -> flatten(Data)
extr = Extrude(Base=join, Direction=multiplication_5)
dispatch_3 = Dispatch(List=eval_2.Point, DispatchPattern=[True, False])  # -> simplify(graft(ListA)), simplify(graft(ListB))
cap = CapHoles(Brep=extr)
vec2pt_3 = Vector2Pt(PointA=subset.List, PointB=dup_2, Unitize=False)  # -> Vector, Length
vec2pt_4 = Vector2Pt(PointA=dispatch_3.ListA, PointB=dispatch_3.ListB, Unitize=Y)  # -> Vector, Length
xz_2 = XZPlane(Origin=subset.List)
xprod_3 = CrossProduct(VectorA=vec2pt_4.Vector, VectorB=Y, Unitize=True)  # -> Vector, Length
angle = Angle(VectorA=subset_2.List, VectorB=vec2pt_3.Vector, Plane=xz_2)  # -> Angle, Reflex
multiplication_7 = Multiplication(A=xprod_3.Vector, B=number_slider)
vdis = VectorDisplay(Anchor=subset.List, Vector=vec2pt_3.Vector)
vdis_2 = VectorDisplay(Anchor=subset.List, Vector=subset_2.List)
lng_3 = ListLength(List=eval_2.Point)
dup_3 = DuplicateData(Data=multiplication_7, Number=2, Order=True)  # -> flatten(Data)
dom_2 = ConstructDomain(DomainStart=1, DomainEnd=expr("x-2", lng_3))
lng_4 = ListLength(List=dup_3)
lng_5 = ListLength(List=dup_3)
subset_3 = SubList(List=eval_2.Point, Domain=dom_2, Wrap=True)  # -> List, Index
subset_4 = SubList(List=dup_3, Domain=dom_2, Wrap=True)  # -> List, Index
item = ListItem(List=eval_2.Point, Index=expr("x-1", lng_4), Wrap=True)
item_2 = ListItem(List=dup_3, Index=0, Wrap=True)
item_3 = ListItem(List=dup_3, Index=expr("x-1", lng_5), Wrap=True)
item_4 = ListItem(List=eval_2.Point, Index=0, Wrap=True)
xz_3 = XZPlane(Origin=subset_3.List)
vrot = Rotate(Vector=subset_4.List, Axis=xz_3, Angle=angle.Angle)
vlen = VectorLength(Vector=vec2pt_3.Vector)
amp = Amplitude(Vector=vrot, Amplitude=vlen)
ins = InsertItems(List=amp, Item=item_2, Indices=0, Wrap=True)  # -> flatten(List)
merge = Merge(Data1=ins, Data2=item_3)
addition_3 = Addition(A=eval_2.Point, B=merge)
dispatch_4 = Dispatch(List=addition_3, DispatchPattern=[True, False])  # -> simplify(graft(ListA)), simplify(graft(ListB))
pt_5 = Point(dispatch_3.ListA)
pt_6 = Point(dispatch_4.ListA)
pt_7 = Point(dispatch_3.ListB)
pt_8 = Point(dispatch_4.ListB)
offset_2 = OffsetCurve(Curve=crv_2, Distance=number_slider, Plane=xz, Corners=1)
ln_3 = Line(StartPoint=pt_5, EndPoint=pt_6)
ln_4 = Line(StartPoint=pt_7, EndPoint=pt_8)
ccx = CurveCurve(CurveA=offset_2, CurveB=ln_3)  # -> Points, ParamsA, ParamsB
ccx_2 = CurveCurve(CurveA=offset_2, CurveB=ln_4)  # -> Points, ParamsA, ParamsB
merge_2 = Merge(Data1=ccx.ParamsA, Data2=ccx_2.ParamsA)  # -> flatten(Result)
shatter = Shatter(Curve=crv_2, Parameters=c_script_2.TT)
shatter_2 = Shatter(Curve=offset_2, Parameters=merge_2)
dispatch_5 = Dispatch(List=shatter, DispatchPattern=[True, False])  # -> simplify(graft(ListA)), simplify(graft(ListB))
dispatch_6 = Dispatch(List=shatter_2, DispatchPattern=[True, False])  # -> simplify(graft(ListA)), simplify(graft(ListB))
end_3 = EndPoints(Curve=dispatch_6.ListA)  # -> Start, End
end_4 = EndPoints(Curve=dispatch_5.ListA)  # -> Start, End
ln_5 = Line(StartPoint=end_3.Start, EndPoint=end_4.Start)
ln_6 = Line(StartPoint=end_3.End, EndPoint=end_4.End)
join_2 = JoinCurves(Curves=[dispatch_6.ListA, ln_5, ln_6, dispatch_5.ListA], Preserve=False)
extr_2 = Extrude(Base=join_2, Direction=multiplication_5)
cap_2 = CapHoles(Brep=extr_2)  # -> flatten(Brep)
colmm = CollisionManyMany(Colliders=cap_2)  # -> Collision, Indices
equals = Equality(FirstNumber=colmm.Collision, SecondNumber=1)  # -> Equality, Inequality
dispatch_7 = Dispatch(List=cap_2, DispatchPattern=equals.Equality)  # -> ListA, ListB
preview = CustomPreview(Geometry=dispatch_7.ListA, Material=ColourSwatch(SwatchColor=RGB(0, 238, 255)))
preview_2 = CustomPreview(Geometry=dispatch_7.ListB, Material=ColourSwatch(SwatchColor=RGB(158, 89, 89)))
