# Grasshopper definition TestRodLinkage.gh (Grasshopper 1.0.7)
# plug-ins: ElasticRodGH Info, Weaverbird, Kangaroo2 Components

number_slider = Slider(4, range=0..10)
mplane = MeshPlane(
    Boundary={Plane=PlaneXY(0, 0, 0), Size=Domain2(u=-10..10, v=-10..10)},
    WidthCount=number_slider,
    HeightCount=number_slider)  # -> Mesh, Area

# ----
# Vector Method
pt = Point(Point(0, 0, 0))
crv = Curve([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])
Z = UnitZ(Factor=1)
lng = ListLength(List=crv)
dup = DuplicateData(Data=Z, Number=lng, Order=True)
c_script = CSharpScript(
    Vertex=pt,
    Edges=crv,
    Normals=dup,
    numPairs=Slider(1, range=0..5),
    edge_opening=Slider(3.18, range=0..10),
    edge_offset=Slider(3.65, range=0..10),
    x_offset=Slider(1.43, range=0..10),
    y_offset=Slider(0.96, range=0..10),
    z_offset=Slider(2.04, range=0..10))  # -> out, A; inputs Vertex: Point3d, Edges: list of Curve, Normals: list of Vector3d, numPairs: Int32, edge_opening: Double, edge_offset: Double, x_offset: Double, y_offset: Double, z_offset: Double
# ---------- c_script: C# usings ----------
using Rhino.Geometry.Intersect;
using System.Linq;
# ---------- c_script: C# ----------
int nE = Edges.Count;
int nR = numPairs*2; //Number of ribbons per side

List<Point3d> refPts = new List<Point3d>();
Point3d[][] pts = new Point3d[nE][];
Point3d[][] midA = new Point3d[nE][];
Point3d[][] midB = new Point3d[nE][];
for(int i=0; i<nE; i++){
    Curve e = Edges[i];
    double length = e.GetLength();

    Vector3d vecX = e.PointAtEnd - e.PointAtStart;
    Vector3d vecZ = Normals[i];
    Vector3d vecY = Vector3d.CrossProduct(vecX, vecZ);
    vecX.Unitize();
    vecZ.Unitize();
    vecY.Unitize();

    Point3d p = Vertex + vecX * x_offset;
    Point3d mid = p + vecX * ((length-x_offset)*0.5);

    // Ribbon points
    pts[i] = new Point3d[nR];
    midA[i] = new Point3d[nR];
    midB[i] = new Point3d[nR];
    for(int j=0; j<numPairs; j++){
        // Sort points to facilitate connection
        pts[i][j] = p + (vecY*y_offset) * (numPairs-1+0.5) - (vecY*y_offset)*j;
        pts[i][numPairs+j] = p - (vecY*y_offset)*(j+0.5);

        Point3d mA = mid + vecY * edge_opening;
        midA[i][j] = mA + (vecX*edge_offset) * (numPairs-1+0.5) - (vecX*edge_offset)*j;
        midA[i][numPairs+j] = mA - (vecX*edge_offset)*(j+0.5);

        Point3d mB = mid - vecY * edge_opening;
        midB[i][j] = mB + (vecX*edge_offset) * (numPairs-1+0.5) - (vecX*edge_offset)*j;
        midB[i][numPairs+j] = mB - (vecX*edge_offset)*(j+0.5);
    }
}

List<Curve> crv = new List<Curve>();

List<Curve> tempA = new List<Curve>();
List<Curve> tempB = new List<Curve>();

for(int i=0; i<nE; i++){

    Curve e = Edges[i];
    double length = e.GetLength();
    Vector3d dir = e.PointAtEnd - e.PointAtStart;
    dir.Unitize();
    Vector3d vecZ = Normals[i];
    vecZ.Unitize();

    int next = i+1;
    int prev = i-1;
    if(i==nE-1) next = 0;
    if(i==0) prev = nE-1;

    List<Curve> tempE = new List<Curve>();
    for(int j=0; j<nR; j++){
        Point3d pA = pts[i][j] + vecZ*z_offset;
        tempA.Add(new LineCurve(pA, pts[next][nR-(1+j)] + vecZ*z_offset));
        Point3d pB = pts[i][j] - vecZ*z_offset;
        tempB.Add(new LineCurve(pB, pts[next][nR-(1+j)] - vecZ*z_offset));

        //Edge lines
        tempE.Add(new LineCurve(pA, midA[i][nR-(1+j)]));
        tempE.Add(new LineCurve(pA, midB[i][j]));
        tempE.Add(new LineCurve(pB, midA[i][nR-(1+j)]));
        tempE.Add(new LineCurve(pB, midB[i][j]));

        // Mirror
        Point3d pMA = pA + dir * (length-x_offset);
        tempE.Add(new LineCurve(pMA, midA[i][j]));
        tempE.Add(new LineCurve(pMA, midB[i][nR-(1+j)]));
        Point3d pMB = pB + dir * (length-x_offset);
        tempE.Add(new LineCurve(pMB, midA[i][j]));
        tempE.Add(new LineCurve(pMB, midB[i][nR-(1+j)]));

    }
    crv.AddRange(DivideCurves(tempE));
}
crv.AddRange(DivideCurves(tempA));
crv.AddRange(DivideCurves(tempB));

A = crv;
# ---------- c_script: C# additional code ----------
  public List<Curve> DivideCurves(List<Curve> crv){

    List<Curve> ln = new List<Curve>();

    for(int j=0; j<crv.Count; j++)
    {

        Curve cA = crv[j];

        Dictionary<double, Point3d> param = new Dictionary<double, Point3d>();

        for(int k=0; k<crv.Count; k++)
        {
            Curve cB = crv[k];
            var events = Intersection.CurveCurve(cA, cB, 0.1, 0.01);

            if (events != null)
            {
                foreach(var e in events)
                {
                    if(!param.ContainsKey(e.ParameterA)) param.Add(e.ParameterA, (e.PointA+e.PointB)*0.5);
                }
            }
        }

        List<double> keys = param.Keys.ToList();
        keys.Sort();
        keys.Reverse();

        for(int h=0; h<keys.Count-1; h++){
            LineCurve l = new LineCurve(param[keys[h]], param[keys[h+1]]);
            if(l.GetLength()>0.001) ln.Add(l);
        }
    }

    return ln;
}
# ---------- end c_script ----------

warpweft = WarpWeft(Mesh=mplane.Mesh)  # -> Warp, Weft, NakedA, NakedB

wbedges = WeaverbirdsMeshEdges(MeshOrPolylines=mplane.Mesh)
crv_2 = Curve(c_script.A)

wbvertices = WeaverbirdsVerticesComponent(MeshClosedPolylinesGroup=mplane.Mesh, Weld=True)
# EdgeData
Z_2 = UnitZ(Factor=1)

# ----
# JointData
crv_3 = Curve(warpweft.Warp)
crv_4 = Curve(warpweft.Weft)
edge = Edge(Curve=crv_4, edgeLabel=2)
edge_2 = Edge(Curve=crv_3, edgeLabel=1)
merge = Merge(Data1=edge_2, Data2=edge)

normal = Normal(Point=wbvertices, Vector=Z_2)
materialglobal = MaterialGlobal(
    E=Slider(21000, range=0..100000),
    Nu=Slider(0.5, range=0..1),
    Width=Slider(0.2, range=0..1),
    Height=Slider(0.03, range=0..0.1),
    orientation=0,
    section=0)
number_slider_2 = Slider(6, range=0..10)
edge_3 = Edge(Curve=crv_2, edgeLabel=0)
# EdgeData
rodlinkagedata = RodLinkageData(Edges=edge_3, Material=materialglobal, MinSubdivisions=number_slider_2, MaxSubdivisions=number_slider_2)  # -> Data, Joints, JointIndexes, Nodes
# Draft
rodlinkagedatadraft = RodLinkageDataDRAFT(Edges=edge_3, Material=materialglobal, MinSubdivisions=5, MaxSubdivisions=5)  # -> Data, Joints, JointIndexes, Nodes
# JointData
rodlinkagedatadraft_2 = RodLinkageDataDRAFT(Edges=merge, Material=materialglobal, MinSubdivisions=5, MaxSubdivisions=5)  # -> Data, Joints, JointIndexes, Nodes

pt_2 = Point(rodlinkagedatadraft.Joints)
dejoint = DeconstructJoint(Data=rodlinkagedatadraft.Data, Index=rodlinkagedatadraft.JointIndexes)  # -> SegmentsA, SegmentsB, StartA, StartB, EVectorA, EVecB, Normal
vdisex = VectorDisplayEx(Point=pt_2, Vector=dejoint.EVectorA, Colour=ColourSwatch(SwatchColor=RGB(102, 255, 0)), Width=2)
vdisex_2 = VectorDisplayEx(Point=pt_2, Vector=dejoint.EVecB, Colour=ColourSwatch(SwatchColor=RGB(0, 102, 255)), Width=2)
vdisex_3 = VectorDisplayEx(Point=pt_2, Vector=dejoint.Normal, Colour=ColourSwatch(SwatchColor=RGB(255, 0, 0)), Width=2)

rodlinkage = RodLinkage(Data=rodlinkagedata.Data, ConsistentAngle=True, interleaving=0)
derodlinkage = DeconstructRodLinkage(Model=rodlinkage)  # -> Joints, Segments
dejoint_2 = DeconstructJoint(Joint=derodlinkage.Joints)  # -> Position, Normal, EdgeVectorA, EdgeVectorB, RodSegmentA, RodSegmentB
vdisex_4 = VectorDisplayEx(Point=dejoint_2.Position, Vector=dejoint_2.EdgeVectorA, Colour=ColourSwatch(SwatchColor=RGB(102, 255, 0)), Width=2)
vdisex_5 = VectorDisplayEx(Point=dejoint_2.Position, Vector=dejoint_2.EdgeVectorB, Colour=ColourSwatch(SwatchColor=RGB(0, 102, 255)), Width=2)
vdisex_6 = VectorDisplayEx(Point=dejoint_2.Position, Vector=dejoint_2.Normal, Colour=ColourSwatch(SwatchColor=RGB(255, 0, 0)), Width=2)

crv_5 = Curve(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)
c_script_2 = CSharpScript(curve=crv_5, Subdivision=Slider(5, range=0..10))  # -> out, A, B; inputs curve: Curve, Subdivision: Int32
# ---------- c_script_2: C# ----------
            int nv = Subdivision;
            double t = _curve.Domain.Length / (Subdivision-1);
            double[] RestCurvatures = new double[nv-1];
            Point3d[] CurvePoints = new Point3d[nv+1];

            Plane pl;
            _curve.TryGetPlane(out pl);

            int idx = 0;
            for (int i = 0; i <= nv; i++)
            {
                Point3d centerPt = _curve.PointAt(_curve.Domain.T0 + t * (i - 0.5));

                if (i > 0 && i < nv )
                {
                    double kappa = 0;

                        Point3d prevPt = _curve.PointAt(_curve.Domain.T0 + t * (i - 1 - 0.5));
                        Point3d nextPt = _curve.PointAt(_curve.Domain.T0 + t * (i + 1 - 0.5));
                        Vector3d v1 = centerPt - prevPt;
                        Vector3d v2 = nextPt - centerPt;

                        Vector3d v1v2 = Vector3d.CrossProduct(v1, v2);
                        double l1 = v1.Length;
                        double l2 = v2.Length;

                        Vector3d normal = pl.ZAxis;

                        kappa = (2 * v1v2 / (l1 * l2 + v1 * v2)) * normal;

                    RestCurvatures[idx] = kappa;

                    idx++;
                }

                CurvePoints[i] = centerPt;
            }

            A = RestCurvatures;
            B = CurvePoints;
# ---------- end c_script_2 ----------
number_slider_3 = Slider(6, range=0..10)
derodlinkage_2 = DeconstructRodLinkage(Model=rodlinkage)  # -> Joints, Segments
points = PointList(Points=c_script_2.B, Size=Slider(1, range=0..1))
multiplication = Multiplication(A=Slider(3, range=0..40), B=number_slider_3)
item = ListItem(List=derodlinkage_2.Segments, Index=Slider(3, range=0..40), Wrap=True)
solver = Solver(Model=rodlinkage, Threshold=1e-06, Run=Toggle(False), Reset=Button(), graphics=0)
series = Series(Start=multiplication, Step=1, Count=number_slider_3)
derodsegment = DeconstructRodSegment(RodSegment=item)  # -> CenterLine, Nodes, RestLengths, Stretching, Twisting, MaxBend, MinBend, SqrtBend
item_2 = ListItem(List=rodlinkagedata.Nodes, Index=series, Wrap=True)
points_2 = PointList(Points=derodsegment.Nodes, Size=Slider(0.2, range=0..1))
