# Grasshopper definition Test_ElasticPlates.gh (Grasshopper 1.0.7)
# plug-ins: LunchBox, ElasticCurves

pi = Pi(Factor=Slider(2, range=0..2))
pi_2 = Pi(Factor=Slider(0.15, range=0..1))
pi_3 = Pi(Factor=1)
dom = ConstructDomain(DomainStart=0, DomainEnd=pi)
dom_2 = ConstructDomain(DomainStart=pi_2, DomainEnd=pi_3)
torus = TorusSurface(
    UDivisions=90,
    VDivisions=96,
    CParameter=Slider(2.89, range=0..10),
    RParameter=Slider(2, range=0..10),
    TParameter=1,
    Scale=1,
    Domain1=dom,
    Domain2=dom_2)
number_slider = Slider(10, range=10..30)
stretch = Stretch(Geometry=torus, Axis=Line((0, 0, 0), (10, 10, 0)), Length=Slider(30, range=0..100), Rigid=False)
geo = Geometry(stretch)
edges = BrepEdges(Brep=geo)  # -> Naked, Interior, NonManifold
item = ListItem(List=edges.Naked, Index=0, Wrap=True)  # -> Item, Item1
flip = FlipCurve(Curve=item.Item, Guide=item.Item1)  # -> Curve, Flag
divide = DivideCurve(Curve=item.Item, Count=number_slider, Kinks=False)  # -> Points, Tangents, Parameters
shift = ShiftList(List=divide.Points, Shift=Slider(1, range=0..10), Wrap=True)
crv_cp = CurveClosestPoint(Point=divide.Points, Curve=item.Item1)  # -> Point, Parameter, Distance
divide_2 = DivideCurve(Curve=flip.Curve, Count=number_slider, Kinks=False)  # -> Points, Tangents, Parameters
divide_3 = DivideCurve(Curve=item.Item1, Count=number_slider, Kinks=False)  # -> Points, Tangents, Parameters
ln = Line(StartPoint=divide_2.Points, EndPoint=divide_3.Points)
xy = XYPlane(Origin=Point(0, 0, 0))
pl_origin = PlaneOrigin(Base=xy, Origin=divide_3.Points)
vec2pt = Vector2Pt(PointA=divide_3.Points, PointB=divide_2.Points, Unitize=False)  # -> Vector, Length
ext = ExtendCurve(Curve=ln, Type=0, Start=Slider(2.69, range=0..10), End=Slider(0, range=0..100))
align = AlignPlane(Plane=pl_origin, Direction=vec2pt.Vector)  # -> Plane, Angle
project = Project(Curve=ext, Brep=geo, Direction=Vector(0, 0, 1))
divide_4 = DivideCurve(Curve=project, Count=10, Kinks=False)  # -> simplify(Points), Tangents, Parameters
ecrv = ElasticCurve(ControlPoints=divide_4.Points, Width=Slider(0.7, range=0..1), Samples=20)  # -> flatten(ElasticCurve), CenterLine, Ribbon
optsimple = OptimizeSimple(ElasticCurve=ecrv.ElasticCurve)  # -> OptimizedElasticCurve, IsFeasible
outlineprofile = OutlineProfile(OptimizedElasticCurve=optsimple.OptimizedElasticCurve)  # -> FlatProfile, DeformedProfile
srf = Surface(outlineprofile.DeformedProfile)
orient = Orient(Geometry=outlineprofile.FlatProfile, Source=PlaneXY(0, 0, 0), Target=align.Plane)  # -> Geometry, Transform
