# Grasshopper definition Test_miq.gh (Grasshopper 1.0.7)
# plug-ins: CGeomGH Info, IguanaMesh

number_slider = Slider(2.48, range=0..10)
crv = Curve(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)
ilineartria = ILinearTria(
    MinimumSize=number_slider,
    MaximunSize=number_slider,
    CurvatureAdapt=False,
    MininimumElements=6,
    SmoothingSteps=10,
    RightAngles=False,
    Massive_Refinement=False)
patch = Patch(Curves=crv, Spans=20, Flexibility=1, Trim=True)
ipatchsrf = IPatchSurface(Surface=patch, ISettings=ilineartria)  # -> IMesh, Entities, Info
number_slider_2 = Slider(0, range=0..100)
perfaceprincipalcurvatures = PerFacePrincipalCurvatures(Mesh=ipatchsrf.IMesh)  # -> Val1, Val2, Dir1, Dir2
lng = ListLength()  # -> expr("x/2", Length)
crv_2 = Curve(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)
item = ListItem(List=perfaceprincipalcurvatures.Dir1, Index=number_slider_2, Wrap=True)
split = SplitList(Index=lng)  # -> ListA, ListB
nrosy = NRosy(Mesh=ipatchsrf.IMesh, FaceIdx=number_slider_2, Vector=item)  # -> X1, X2, B, Singularity
mesh_uv = MeshSurface(Surface=crv_2, UCount=5, VCount=5, Overhang=True, Equalize=False)
panel = Panel(split.ListA)
pt = Point([Point(13.28582178, 8.149656238, 0), Point(28.15943806, -7.591916425, 0), Point(28.15943806, 8.149656238, 0), Point(13.28582178, -7.591916425, 0)])
tri = Triangulate(Mesh=mesh_uv)  # -> Mesh, Count
nickname = SeamlessIntegerGH(Mesh=ipatchsrf.IMesh, X1=nrosy.X1, X2=nrosy.X2, Grad=Slider(22.11, range=0..100), Stiffness=5, Round=False, Iterations=0)  # -> UV, FUV
panel_2 = Panel(split.ListB)
laplaciansmoothing = LaplacianSmoothing(Mesh=tri.Mesh, Anchors=pt, Iter=1)
vdis = VectorDisplay(Anchor=nrosy.B, Vector=nrosy.X1)
vdis_2 = VectorDisplay(Anchor=nrosy.B, Vector=nrosy.X2)
nickname_2 = QuadMeshExtraction(Mesh=ipatchsrf.IMesh, UV=nickname.UV, FUV=nickname.FUV)
