# Grasshopper definition cgeom_edgeVectors.gh (Grasshopper 1.0.7)
# plug-ins: CGeomGH Info

mesh = Mesh(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)
number_slider = Slider(0.01, range=0.01..0.1)
edgevec = EdgeVectors(Mesh=mesh)  # -> MidPoints, ParallelVectors, PerpendicularVectors
multiplication = Multiplication(A=edgevec.PerpendicularVectors, B=number_slider)
multiplication_2 = Multiplication(A=edgevec.ParallelVectors, B=number_slider)
vdisex = VectorDisplayEx(Point=edgevec.MidPoints, Vector=multiplication_2, Colour=ColourSwatch(SwatchColor=RGB(17, 255, 0)), Width=2)
vdisex_2 = VectorDisplayEx(Point=edgevec.MidPoints, Vector=multiplication, Colour=ColourSwatch(SwatchColor=RGB(68, 0, 255)), Width=2)
