# Grasshopper definition cgeom_geodesicDistances.gh (Grasshopper 1.0.7)
# plug-ins: Weaverbird, CGeomGH Info

mesh = Mesh(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)
wbvertices = WeaverbirdsVerticesComponent(MeshClosedPolylinesGroup=mesh, Weld=True)
item = ListItem(List=wbvertices, Index=Slider(1965, range=0..3388), Wrap=True)
item_2 = ListItem(List=wbvertices, Index=Slider(759, range=0..3388), Wrap=True)
item_3 = ListItem(List=wbvertices, Index=Slider(0, range=0..3388), Wrap=True)
item_4 = ListItem(List=wbvertices, Index=Slider(2229, range=0..3388), Wrap=True)
number_slider = Slider(0.01, range=0.01..0.1)
heatgeo = HeatGeodesics(Mesh=mesh, SourcePoint=item_2, HeatParam=0.01)
edgevec = EdgeVectors(Mesh=mesh)  # -> MidPoints, ParallelVectors, PerpendicularVectors
geodist = GeodesicDistances(Mesh=mesh, SourcePoints=[item_2, item], TargetPoints=[item_3, item_4], UseFaces=False)
paralleltransp = ParallelTransport(Mesh=mesh, SourceIndex=Slider(20, range=0..100), ParParam=Slider(0.5, range=0..1), PerpParam=Slider(1, range=0..1))  # -> Points, Vectors
multiplication = Multiplication(A=edgevec.ParallelVectors, B=number_slider)
multiplication_2 = Multiplication(A=edgevec.PerpendicularVectors, B=number_slider)
bnd = Bounds(Numbers=heatgeo)
multiplication_3 = Multiplication(A=paralleltransp.Vectors, B=number_slider)
vdisex = VectorDisplayEx(Point=edgevec.MidPoints, Vector=multiplication, Colour=RGB(0, 0, 0), Width=2)
vdisex_2 = VectorDisplayEx(Point=edgevec.MidPoints, Vector=multiplication_2, Colour=RGB(0, 0, 0), Width=2)
dedomain = DeconstructDomain(Domain=bnd)  # -> Start, End
vdisex_3 = VectorDisplayEx(Point=paralleltransp.Points, Vector=multiplication_3, Colour=RGB(0, 0, 0), Width=2)
gradient = Gradient(
    LowerLimit=dedomain.Start,
    UpperLimit=dedomain.End,
    Parameter=heatgeo,
    stops=[0: RGB(0, 142, 0), 0.5: RGB(254, 251, 0), 1: RGB(255, 38, 0)])
mcol = MeshColours(Mesh=mesh, Colours=gradient)
