# Grasshopper definition cgeom_geodesicPaths.gh (Grasshopper 1.0.8)
# plug-ins: Weaverbird, CGeomGH Info

mesh = Mesh(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)
number_slider = Slider(-0.89, range=-2..2)
pi = Pi(Factor=Slider(0.3, range=0..0.5))
bff = BFF(UCount=10, VCount=10, Angle=0, Diagonalize=False)  # -> Disk, Texture2D, Texture3D
harmonic = Harmonic(Mesh=mesh, UCount=Slider(50, range=10..50), VCount=Slider(50, range=10..50), Angle=pi, Diagonalize=False)  # -> Disk, Texture2D, Texture3D
vec = VectorXYZ(XComponent=Slider(1.8, range=0..3), YComponent=number_slider, ZComponent=0)  # -> Vector, Length
vec_2 = VectorXYZ(XComponent=Slider(-3.56, range=-5..3), YComponent=number_slider, ZComponent=0)  # -> Vector, Length
curvatures = Curvatures(Mesh=mesh, Alpha=Slider(0.54, range=0..1), cmapIdx=0, metricsIdx=0)  # -> CMesh, Data
move = Move(Geometry=harmonic.Texture3D, Motion=vec_2.Vector)  # -> Geometry, Transform
move_2 = Move(Geometry=mesh, Motion=vec.Vector)  # -> Geometry, Transform
bang = ExplodeTree(Data=harmonic.Texture2D)  # -> Branch0, Branch1
bang_2 = ExplodeTree(Data=move.Geometry)  # -> Branch0, Branch1
move_3 = Move(Geometry=mesh, Motion=vec_2.Vector)  # -> Geometry, Transform
wbedges = WeaverbirdsMeshEdges(MeshOrPolylines=move_2.Geometry)
preview = CustomPreview(Geometry=move_3.Geometry, Material=ColourSwatch(SwatchColor=RGBA(140, 139, 139, 85)))
preview_2 = CustomPreview(Geometry=[harmonic.Disk, move_2.Geometry], Material=ColourSwatch(SwatchColor=RGBA(140, 139, 139, 85)))
preview_3 = CustomPreview(Geometry=[bang.Branch0, bang_2.Branch0], Material=ColourSwatch(SwatchColor=RGB(51, 0, 255)))
preview_4 = CustomPreview(Geometry=[bang.Branch1, bang_2.Branch1], Material=ColourSwatch(SwatchColor=RGB(255, 0, 0)))
preview_5 = CustomPreview(Geometry=wbedges, Material=ColourSwatch(SwatchColor=RGBA(140, 140, 140, 85)))
