# Grasshopper definition cgeom_heatGeodesicDistances.gh (Grasshopper 1.0.7)
# plug-ins: Weaverbird, CGeomGH Info

mesh = Mesh(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)
wbvertices = WeaverbirdsVerticesComponent(MeshClosedPolylinesGroup=mesh, Weld=True)
item = ListItem(List=wbvertices, Index=Slider(1000, range=0..3388), Wrap=True)
heatgeo = HeatGeodesics(Mesh=mesh, SourcePoint=item, HeatParam=0.01)
bnd = Bounds(Numbers=heatgeo)
dedomain = DeconstructDomain(Domain=bnd)  # -> Start, End
gradient = Gradient(
    LowerLimit=dedomain.Start,
    UpperLimit=dedomain.End,
    Parameter=heatgeo,
    stops=[0: RGB(0, 142, 0), 0.5: RGB(254, 251, 0), 1: RGB(255, 38, 0)])
mcol = MeshColours(Mesh=mesh, Colours=gradient)
