# Grasshopper definition cgeom_parallelTransport.gh (Grasshopper 1.0.7)
# plug-ins: CGeomGH Info

mesh = Mesh(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)
number_slider = Slider(0.1, range=0.01..0.1)
number_slider_2 = Slider(100, range=0..100)
edgevec = EdgeVectors(Mesh=mesh)  # -> MidPoints, ParallelVectors, PerpendicularVectors
paralleltransp = ParallelTransport(Mesh=mesh, SourceIndex=number_slider_2, ParParam=1, PerpParam=1)  # -> Points, Vectors
item = ListItem(List=edgevec.MidPoints, Index=number_slider_2, Wrap=True)
item_2 = ListItem(List=edgevec.ParallelVectors, Index=number_slider_2, Wrap=True)
item_3 = ListItem(List=edgevec.PerpendicularVectors, Index=number_slider_2, Wrap=True)
multiplication = Multiplication(A=item_2, B=number_slider)
multiplication_2 = Multiplication(A=item_3, B=number_slider)
multiplication_3 = Multiplication(A=paralleltransp.Vectors, B=Slider(0.01, range=0.01..0.1))
vdisex = VectorDisplayEx(Point=item, Vector=multiplication, Colour=ColourSwatch(SwatchColor=RGB(17, 255, 0)), Width=2)
vdisex_2 = VectorDisplayEx(Point=item, Vector=multiplication_2, Colour=ColourSwatch(SwatchColor=RGB(68, 0, 255)), Width=2)
vdisex_3 = VectorDisplayEx(Point=paralleltransp.Points, Vector=multiplication_3, Colour=ColourSwatch(SwatchColor=RGB(18, 208, 255)), Width=2)
