# Grasshopper definition cgeom_remeshAlongIsolines.gh (Grasshopper 1.0.7)
# plug-ins: CGeomGH Info, Weaverbird, Kangaroo2 Components

mesh = Mesh(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)
wbvertices = WeaverbirdsVerticesComponent(MeshClosedPolylinesGroup=mesh, Weld=True)
item = ListItem(List=wbvertices, Index=Slider(671, range=0..3388), Wrap=True)
heatgeo = HeatGeodesics(Mesh=mesh, SourcePoint=item, HeatParam=0.01)
item_2 = ListItem(List=heatgeo, Index=Slider(1040, range=0..3388), Wrap=True)
panel = Panel(heatgeo)
remeshalongiso = RemeshAlongIsolines(Mesh=mesh, ScalarField=heatgeo, IsoValue=item_2)
panel_2 = Panel(remeshalongiso)
wbvertices_2 = WeaverbirdsVerticesComponent(MeshClosedPolylinesGroup=remeshalongiso, Weld=False)
demesh = DeconstructMesh(Mesh=remeshalongiso)  # -> Vertices, Faces, Colours, Normals
duppt = RemoveDuplicatePts(Points=wbvertices_2, Tolerance=0.01)
panel_3 = Panel(demesh.Faces)
