# Grasshopper definition cgeom_laplacianSmoothing.gh (Grasshopper 1.0.7)
# plug-ins: IguanaMesh, CGeomGH Info

number_slider = Slider(0.5, range=0..10)
crv = Curve([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])
loft = Loft(Curves=crv, Options={Adjust=False, Closed=False, LoftEnds=0, LoftSimp=0, LoftType=0, Rebuild=10, Refit=0.01})
ilineartria = ILinearTria(
    MinimumSize=number_slider,
    MaximunSize=number_slider,
    CurvatureAdapt=False,
    MininimumElements=6,
    SmoothingSteps=10,
    RightAngles=False,
    Massive_Refinement=False)
ipatchsrf = IPatchSurface(Surface=loft, ISettings=ilineartria)  # -> IMesh, Entities, Info
inakedvertices = INakedVertices(IMesh=ipatchsrf.IMesh)
pt = Point(inakedvertices)
laplaciansmoothing = LaplacianSmoothing(Mesh=ipatchsrf.IMesh, Anchors=pt, Tolerance=0.001, Iterations=Slider(2, range=0..5))
